# Grasshopper definition FieldViewer.gh (Grasshopper 0.9.76)

data = Data(["0,0,0,-0.05504522241871722,-0.019803007812178298,-0.042038389061928735,-0.047706874302755865,-0.05002531941308158,-0.20605539245675047,0.44862316300270333,-0.8821814450701903,0.14315430692550302,0.8578102534187177,0.38008798377881614,-0.345969209203175,0.25079638503607965,0.27800903323601894,0.9272605624591228,-0.029518520851616766,-0.04686497173987779,-0.232423996586729", "0.030976999999999998,0,0,-0.10965109179996732,0,-0.01330082139262112,-0.10965109179996732,-0.08590944078290423,-0.2558525475332571,0.1386997124710768,0.8958555553381257,-0.4221435937335289,0.9882260556440794,-0.1530008592987143,0,0.06458833258867726,0.41717329855070184,0.9065289770711917,-0.06916898522415335,-0.10965109179996732,-0.296334654109071", "0.06195300000000001,0,0,-0.10232918006728604,0,-7.425327721913527E-4,-0.10232918006728604,-0.0780926227846123,-0.23876808682366743,0.00865659848606746,0.9104197221831186,-0.41359520398895416,0.9999547986098166,-0.00950793022697783,0,0.003932434341739639,0.41357650891076075,0.9104608762804339,-0.06685242856064665,-0.10232918006728604,-0.27424483833030683", "0.09293000000000001,0,0,-0.10926628636207196,0,0.013237045509938124,-0.10926628636207196,-0.0806597099254104,-0.2549546681781679,-0.1477738113587423,0.9004571865995031,-0.40907182227308003,0.9868000294540836,0.1619435144407448,0,-0.06624652855758233,0.403672086267911,0.9125021886122694,-0.07262310663710275,-0.10926628636207196,-0.29159784790313703", "0.123907,0,0,-0.07987221113158625,0,0.03519201244522081,-0.07987221113158625,-0.047803003761634176,-0.18636849264036795,-0.5413777620507927,0.7353794624863419,-0.4075870028719928,0.8053072032465344,0.5928577471866627,0,-0.24164111230525348,0.32823274936248165,0.913166378646206,-0.05337720545709078,-0.07987221113158625,-0.21286349831486343", "0,0.031303,0,-0.0500710008514603,0,-0.031282106665178964,-0.0500710008514603,-0.03472609244347776,-0.11683233532007405,0.5951142192279052,0.6606329814206615,-0.45760586745802173,0.7429895512528564,-0.6693030156282572,0,0.30627698705883855,0.3399963781133095,0.8891551439810668,-0.02601700399854432,-0.0500710008514603,-0.14088633217299001"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])

# ----
# Isolate required data:
# Pts + Tensor components
split = TextSplit(Text=data, Separators=",")
split_2 = SplitList(List=split, Index=9)  # -> simplify(ListA), ListB

num = Number(split_2.ListA)
tensorfieldvisualizer = CSharpScript(x=num, scale="0.3")  # -> out, A; inputs x: list of Double, scale: Double
# ---------- tensorfieldvisualizer: C# ----------
    Point3d Pt = new Point3d(x[0], x[1], x[2]);


    double[] Stress = new double[9]{x[3],x[4],x[5],x[4],x[6],x[7],x[5],x[7],x[8]};
    double[] EigenVals;
    Vector3d[] EigenVecs;
    EigenSolve(Stress, out EigenVals, out EigenVecs);


    Box B = new Box(new Plane(Pt, EigenVecs[0], EigenVecs[1]), 
      new Interval(-EigenVals[0]*scale, EigenVals[0]*scale), 
      new Interval(-EigenVals[1]*scale, EigenVals[1]*scale), 
      new Interval(-EigenVals[2]*scale, EigenVals[2]*scale));
    A = B;
# ---------- tensorfieldvisualizer: C# additional code ----------
  public static void EigenSolve(double[] x, out double[] eigenValues, out Vector3d[] eigenVectors)
  {
    double[,] matValues = new double[3, 3] { { x[0], x[1], x[2] }, { x[3], x[4], x[5] }, { x[6], x[7], x[8] } };
    double[,] outMatValues = new double[3, 3];
    double[] outVecValues = new double[3];
    Eigen eigenCalculate = new Eigen();

    eigenCalculate.eigen_decomposition(matValues, outMatValues, outVecValues);

    var eigenVectorsUnsorted = new Vector3d[3];

    if (eigenCalculate.CalcDone)
    {
      eigenVectorsUnsorted[0] = new Vector3d(outMatValues[0, 0], outMatValues[1, 0], outMatValues[2, 0]);
      eigenVectorsUnsorted[1] = new Vector3d(outMatValues[0, 1], outMatValues[1, 1], outMatValues[2, 1]);
      eigenVectorsUnsorted[2] = new Vector3d(outMatValues[0, 2], outMatValues[1, 2], outMatValues[2, 2]);
    }

    Array.Sort(outVecValues, eigenVectorsUnsorted, new DescendingAbsoluteVals());
    eigenValues = outVecValues;
    eigenVectors = eigenVectorsUnsorted;
  }

  public class DescendingAbsoluteVals : Comparer < double >
  {
    public override int Compare(double x, double y)
    {
      return (y * y).CompareTo(x * x);
    }
  }


  public class Eigen
  {
    public bool StartCalc = false;
    public bool CalcDone = false;

    ///////////////////////////////
    //Eigen solver implementation
    ///////////////////////////////
    private static double Hypot2(double x, double y)
    {
      return Math.Sqrt(x * x + y * y);
    }

    private static void Tred2(double[,] v, double[] d, double[] e)
    {
      for (int j = 0; j < 3; j++)
      {
        d[j] = v[3 - 1, j];
      }

      for (int i = 3 - 1; i > 0; i--)
      {
        double scale = 0.0;
        double h = 0.0;

        for (int k = 0; k < i; k++)
        {
          scale = scale + Math.Abs(d[k]);
        }

        if (scale == 0.0)
        {
          e[i] = d[i - 1];
          for (int j = 0; j < i; j++)
          {
            d[j] = v[i - 1, j];
            v[i, j] = 0.0;
            v[j, i] = 0.0;
          }
        }
        else
        {
          for (int k = 0; k < i; k++)
          {
            d[k] /= scale;
            h += d[k] * d[k];
          }

          double f = d[i - 1];
          double g = Math.Sqrt(h);

          if (f > 0)
          {
            g = -g;
          }

          e[i] = scale * g;
          h = h - f * g;
          d[i - 1] = f - g;

          for (int j = 0; j < i; j++)
          {
            e[j] = 0.0;
          }

          for (int j = 0; j < i; j++)
          {
            f = d[j];
            v[j, i] = f;
            g = e[j] + v[j, j] * f;

            for (int k = j + 1; k <= i - 1; k++)
            {
              g += v[k, j] * d[k];
              e[k] += v[k, j] * f;
            }

            e[j] = g;
          }

          f = 0.0;

          for (int j = 0; j < i; j++)
          {
            e[j] /= h;
            f += e[j] * d[j];
          }

          double hh = f / (h + h);

          for (int j = 0; j < i; j++)
          {
            e[j] -= hh * d[j];
          }

          for (int j = 0; j < i; j++)
          {
            f = d[j];
            g = e[j];

            for (int k = j; k <= i - 1; k++)
            {
              v[k, j] -= (f * e[k] + g * d[k]);
            }

            d[j] = v[i - 1, j];
            v[i, j] = 0.0;
          }
        }
        d[i] = h;
      }

      for (int i = 0; i < 3 - 1; i++)
      {
        v[3 - 1, i] = v[i, i];
        v[i, i] = 1.0;

        double h = d[i + 1];

        if (h != 0.0)
        {
          for (int k = 0; k <= i; k++)
          {
            d[k] = v[k, i + 1] / h;
          }
          for (int j = 0; j <= i; j++)
          {
            double g = 0.0;

            for (int k = 0; k <= i; k++)
            {
              g += v[k, i + 1] * v[k, j];
            }
            for (int k = 0; k <= i; k++)
            {
              v[k, j] -= g * d[k];
            }
          }
        }
        for (int k = 0; k <= i; k++)
        {
          v[k, i + 1] = 0.0;
        }
      }
      for (int j = 0; j < 3; j++)
      {
        d[j] = v[3 - 1, j];
        v[3 - 1, j] = 0.0;
      }

      v[3 - 1, 3 - 1] = 1.0;
      e[0] = 0.0;
    }

    static void Tql2(double[,] v, double[] d, double[] e)
    {
      for (int i = 1; i < 3; i++)
      {
        e[i - 1] = e[i];
      }
      e[3 - 1] = 0.0;

      double f = 0.0;
      double tst1 = 0.0;
      double eps = Math.Pow(2.0, -52.0);
      for (int l = 0; l < 3; l++)
      {
        tst1 = Math.Max(tst1, Math.Abs(d[l]) + Math.Abs(e[l]));
        int m = l;

        while (m < 3)//not in original code, was m < 3!!!
        {
          if (Math.Abs(e[m]) <= eps * tst1)
          {
            break;
          }
          m++;
        }

        if (m > l)
        {
          int iter = 0;
          do
          {
            iter = iter + 1;

            double g = d[l];
            double p = (d[l + 1] - g) / (2.0 * e[l]);
            double r = Hypot2(p, 1.0);

            if (p < 0)
            {
              r = -r;
            }

            d[l] = e[l] / (p + r);
            d[l + 1] = e[l] * (p + r);

            double dl1 = d[l + 1];
            double h = g - d[l];

            for (int i = l + 2; i < 3; i++)
            {
              d[i] -= h;
            }

            f = f + h;
            p = d[m];

            double c = 1.0;
            double c2 = c;
            double c3 = c;
            double el1 = e[l + 1];
            double s = 0.0;
            double s2 = 0.0;

            for (int i = m - 1; i >= l; i--)
            {
              c3 = c2;
              c2 = c;
              s2 = s;
              g = c * e[i];
              h = c * p;
              r = Hypot2(p, e[i]);
              e[i + 1] = s * r;
              s = e[i] / r;
              c = p / r;
              p = c * d[i] - s * g;
              d[i + 1] = h + s * (c * g + s * d[i]);

              for (int k = 0; k < 3; k++)
              {
                h = v[k, i + 1];
                v[k, i + 1] = s * v[k, i] + c * h;
                v[k, i] = c * v[k, i] - s * h;
              }
            }

            p = -s * s2 * c3 * el1 * e[l] / dl1;
            e[l] = s * p;
            d[l] = c * p;
          } while (Math.Abs(e[l]) > eps * tst1);
        }

        d[l] = d[l] + f;
        e[l] = 0.0;
      }

      for (int i = 0; i < 3 - 1; i++)
      {
        int k = i;
        double p = d[i];

        for (int j = i + 1; j < 3; j++)
        {
          if (d[j] < p)
          {
            k = j;
            p = d[j];
          }
        }
        if (k != i)
        {
          d[k] = d[i];
          d[i] = p;

          for (int j = 0; j < 3; j++)
          {
            p = v[j, i];
            v[j, i] = v[j, k];
            v[j, k] = p;
          }
        }
      }
    }

    public void eigen_decomposition(double[,] a, double[,] v, double[] d)
    {
      double[] e = new double[3];
      for (int i = 0; i < 3; i++)
      {
        for (int j = 0; j < 3; j++)
        {
          v[i, j] = a[i, j];
        }
      }
      Tred2(v, d, e);
      Tql2(v, d, e);

      CalcDone = true;
    }
  }
# ---------- end tensorfieldvisualizer ----------
box = Box(tensorfieldvisualizer.A)
