# Grasshopper definition cranfield-ellipsoid-packing.gh (Grasshopper 0.9.76)
# plug-ins: Kangaroo Components, MechanoAdaptiveGeneration

path = FilePath("S:\03_Projects\_ResearchProjects\Z0011_AlessandroPhD\Cranfield-beam\cranfield-beam-adapted2D-ale-fine-positive.csv")
file = ReadFile(File=path, PerLineParse=True)

# ----
# Cantilever
data = Data(["72.99417609789089,574.8147993286013,0,-5.010880730957243E9,-7.914910827007513E8,0,-1.5528093081268744E9,0,0,0.21300159161174193,-0.9770518522426866,0,0,0,1,-0.9770518522426866,-0.21300159161174193,0,-1.3802607786145577E9,-2.166017712897759E9,-5.18342926046956E9", "172.99417609789086,574.8147993286013,0,-4.991556293010517E9,-2.598668404157373E8,0,2.7746088120469236E8,0,0,0.0491409650100418,-0.998791852969317,0,0,0,1,-0.998791852969317,-0.0491409650100418,0,2.902464353461038E8,-1.5556514858959222E9,-5.004341847151929E9", "272.99417609789083,574.8147993286013,0,-5.249346797449422E9,-4.2226772463854706E8,0,-3.77821504426384E7,0,0,0.0802405002440822,-0.9967755324648472,0,0,0,1,-0.9967755324648472,-0.0802405002440822,0,-3789569.0054307133,-1.7447525528043802E9,-5.283339378886629E9", "372.99417609789083,574.8147993286013,0,-5.385821667168079E9,-4.4015733522859937E8,0,-2.2714907043744564E7,0,0,0.08125626523761538,-0.9966932423567615,0,0,0,1,-0.9966932423567615,-0.08125626523761538,0,1.3169294491570909E7,-1.784817069489902E9,-5.421705868703395E9", "472.99417609789083,574.8147993286013,0,-5.486000612731215E9,-4.5706053931175935E8,0,-3.552314273376465E7,0,0,0.08298818519981763,-0.9965505311409155,0,0,0,1,-0.9965505311409155,-0.08298818519981763,0,2538775.351319693,-1.8221028393034432E9,-5.524062530816299E9", "572.9941760978908,574.8147993286013,0,-5.567762631340094E9,-4.568160320884404E8,0,-3.7479966982331276E7,0,0,0.08177183558369128,-0.9966510758060084,0,0,0,1,-0.9966510758060084,-0.08177183558369128,0,236.84699867665768,-1.8497300574464004E9,-5.605242835169424E9"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])
mesh = Mesh(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)

# ----
# Beam
mesh_2 = Mesh(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)
data_2 = Data(["0.010000,0.0055000,0.019000,-33.985,6.1273,-74.866,6.7802,8.6062,-144.88,0.33874,0.93403,-0.11333,-0.82648,0.35295,0.43858,0.44964,-0.054897,0.89152,7.9581,3.1261,-183.17", "0.010000,0.0055000,0.057000,-3.8131,-1.9818,-10.405,-2.0576,-0.16268,-64.954,0.69512,-0.71045,-0.10982,0.70005,0.70370,-0.12138,0.16352,0.0074982,0.98651,-0.14367,-4.0010,-66.680", "0.010000,0.0055000,0.095000,-0.49774,-0.31453,-5.4769,-0.038960,-0.37715,-21.993,0.94613,-0.23498,-0.22277,-0.22422,-0.97182,0.072778,0.23359,0.018907,0.97215,0.86994,-0.083288,-23.317", "0.010000,0.0055000,0.13300,-0.55153,-0.15326,-2.0255,-0.035100,-0.37503,-5.5440,0.93935,-0.10623,-0.32608,-0.078848,-0.99224,0.096119,0.33376,0.064579,0.94044,0.16892,-0.010950,-6.2886", "0.010000,0.0055000,0.17100,-0.21257,-0.069656,0.78323,0.020687,-0.33216,0.38525,0.52255,-0.30061,0.79786,0.31511,0.93762,0.14688,-0.79224,0.17466,0.58468,1.0234,-0.054756,-0.77524", "0.010000,0.016500,0.019000,-38.076,-5.4811,-60.129,15.014,9.2438,-152.67,-0.24276,0.96026,0.13776,-0.88735,-0.27719,0.36847,0.39201,-0.032790,0.91938,17.726,-14.820,-178.64"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])

# ----
# Logo
data_3 = Data(["142.26774076136144,97.9581532943444,2.0461604595184344,NaN,NaN,NaN,NaN,NaN,NaN,NaN,NaN,NaN,NaN,NaN,NaN,NaN,NaN,NaN,NaN,NaN,NaN", "146.71343956924062,97.9581532943444,2.0461604595184344,NaN,NaN,NaN,NaN,NaN,NaN,NaN,NaN,NaN,NaN,NaN,NaN,NaN,NaN,NaN,NaN,NaN,NaN", "151.15913837711983,97.9581532943444,2.0461604595184344,NaN,NaN,NaN,NaN,NaN,NaN,NaN,NaN,NaN,NaN,NaN,NaN,NaN,NaN,NaN,NaN,NaN,NaN", "155.60483718499904,97.9581532943444,2.0461604595184344,NaN,NaN,NaN,NaN,NaN,NaN,NaN,NaN,NaN,NaN,NaN,NaN,NaN,NaN,NaN,NaN,NaN,NaN", "160.05053599287822,97.9581532943444,2.0461604595184344,NaN,NaN,NaN,NaN,NaN,NaN,NaN,NaN,NaN,NaN,NaN,NaN,NaN,NaN,NaN,NaN,NaN,NaN", "164.4962348007574,97.9581532943444,2.0461604595184344,NaN,NaN,NaN,NaN,NaN,NaN,NaN,NaN,NaN,NaN,NaN,NaN,NaN,NaN,NaN,NaN,NaN,NaN"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])
mesh_3 = Mesh(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)

scale_nu = ScaleNU(Geometry=mesh, Plane=PlaneXY(0, 0, 0), ScaleX=1, ScaleY=1, ScaleZ=0.0001)  # -> Geometry, Transform
vec = VectorXYZ(XComponent=20, YComponent=2000, ZComponent=0)  # -> Vector, Length
move = Move(Geometry=scale_nu.Geometry, Motion=vec.Vector)  # -> Geometry, Transform
data_4 = Data(data)
mesh_4 = Mesh(move.Geometry)

# ----
# Isolate required data:
# Pts + Tensor components
split = TextSplit(Text=data_4, Separators=",")
split_2 = SplitList(List=split, Index=9)  # -> simplify(flatten(ListA)), ListB

# ----
# Generate points in BB
# and only use those
# strictly inside the mesh
number_slider = Slider(400, range=1..10000)
mesh_5 = Mesh(mesh_4)
seed = Number(91)
pop3d = Populate3D(Region=mesh_5, Count=number_slider, Seed=seed)
checkinside = CSharpScript(mesh=mesh_5, pts=pop3d)  # -> out, ptsInside; inputs mesh: Mesh, pts: list of Point3d
# ---------- checkinside: C# ----------
    List<Point3d> inside = new List<Point3d>();  
    for(int i = 0;i < pts.Count();i++)
      if(mesh.IsPointInside(pts[i], 0.0, true))
      {
        inside.Add(pts[i]);
      }
    ptsInside = inside;
# ---------- end checkinside ----------
pt = Point(flatten(checkinside.ptsInside))

demesh = DeconstructMesh(Mesh=mesh_4)  # -> Vertices, Faces, Colours, Normals
duppt = RemoveDuplicatePts(Points=demesh.Vertices, Tolerance=0.01)
path_mapper = PathMapper(split_2.ListA, source="{a}(i)", target="{i\9}")
# Augment 2D stress field in both z directions
number_slider_2 = Slider(10, range=-200..200)
number_slider_3 = Slider(2, range=0..10)
panel = Panel("""minLongAxisLength
maxLongAxisLength
minSlenderness
maxRadiusCoefficient
initialScaleEllipsoids
alignStrength
targetPressure
EdgeLengthFactor
plasticDrag""")
entwine = Entwine(Branch00=duppt, Branch01=pt, FlattenInputs=True)  # -> flatten(Result)
corner_indices = Panel("0")
# Beam
panel_2 = Panel("""0.5
1
0.6
1
0.02
0
3000
1
0""")
replace = ReplaceItems(List=path_mapper, Item=Slider(-10, range=-200..200), Indices=number_slider_3, Wrap=False)
replace_2 = ReplaceItems(List=path_mapper, Item=number_slider_2, Indices=number_slider_3, Wrap=False)
merge = Merge(Data1=flatten(replace_2), Data2=flatten(path_mapper), Data3=flatten(replace))
updatescale = BooleanToggle(True)
filter_edges = BooleanToggle(False)
reset = Button()
# Mechano-adaptive space frame generator
run = BooleanToggle(False)
list = ValueList({"Low": 100, "High": 1000000}, selected="High")
data_5 = Data(corner_indices)
# Logo
panel_3 = Panel("""0.5
1
0.5
1
10
0
3000
1
0""")
# Cantilever
panel_4 = Panel(panel_3)

# ---- group: Solver will stop after this many iterations without a decrease in kinetic energy
panel_5 = Panel("1000")

# ----
generate = MechanoAdaptiveGeneration(
    Mesh=mesh_4,
    Points=pt,
    Data=merge,
    Options=panel_4,
    Run=run,
    Reset=reset,
    UpdateScale=updatescale,
    ValenceFilter=filter_edges,
    BoundaryStrength=list,
    FixedPoints=data_5,
    MaxIterations=panel_5,
    VolumeFactor=Slider(10441.509, range=0.5..100000))  # -> PercentVolumePacked, EllipsoidCentres, LongAxes, ShortAxes, Iterations, Lines, Bake, RecentErrors
panel_6 = Panel(generate.RecentErrors)
item = ListItem(List=panel_6, Index=9, Wrap=True)
rec = DataRecorder(generate.PercentVolumePacked, DataLimit=-10, RecordData=True)
rec_2 = DataRecorder(item, DataLimit=-10, RecordData=True)
graph = QuickGraph(rec_2)
panel_7 = Panel(rec)

# ----
# Display ellipsoids
ellipsoid_transforms = CSharpScript(Pts=generate.EllipsoidCentres, longAxes=generate.LongAxes, shortAxes=generate.ShortAxes)  # -> out, A; inputs Pts: list of Point3d, longAxes: list of Vector3d, shortAxes: list of Vector3d
# ---------- ellipsoid_transforms: C# ----------
    int count = Pts.Count();

    List<Transform> transforms = new List<Transform>();

    for(int i = 0; i < count; i++){
      Transform t = new Transform(1.0);

      t.M03 = Pts[i].X;
      t.M13 = Pts[i].Y;
      t.M23 = Pts[i].Z;

      t.M00 = longAxes[i][0];
      t.M10 = longAxes[i][1];
      t.M20 = longAxes[i][2];

      t.M01 = shortAxes[i][0];
      t.M11 = shortAxes[i][1];
      t.M21 = shortAxes[i][2];

      double la = longAxes[i].Length;
      double sa = shortAxes[i].Length;
      Vector3d xprod = Vector3d.CrossProduct(longAxes[i], shortAxes[i]);
      xprod.Unitize();

      t.M02 = sa * xprod[0];
      t.M12 = sa * xprod[1];
      t.M22 = sa * xprod[2];

      transforms.Add(t);
    }
    A = transforms;
# ---------- end ellipsoid_transforms ----------
msphere = MeshSphere(Base=PlaneXY(0, 0, 0), Radius=1, UCount=6, VCount=9)
transform = Transform(Geometry=msphere, Transform=ellipsoid_transforms.A)
colourful = Colourful(geo=transform)

merge_2 = Merge(Data1=transform)
bakeattributes = CSharpScript(objs=merge_2, groupListTgthr=True)  # -> out; inputs objs: list, names: list of String, layers: list of String, colors: list of Color, pWidths: list of Double, wiresEach: list of Int32, materials: list, activate: Boolean, groupListTgthr: Boolean
# ---------- bakeattributes: C# ----------
    //Inserts geometry into the Rhino document, with custom attributes
    //Written by Giulio Piacentino
    //Version written 2011 10 18 - for Grasshopper 0.8.52

    if (activate)
    {
      int groupIndex = -1;
      if(groupListTgthr)
        groupIndex = doc.Groups.Add();

      for(int i = 0; i < objs.Count; i++)
      {
        object obj = objs[i];
        if(obj == null)
        {
          Print("No object to bake");
          return;
        }

        //Make new attribute to set name
        Rhino.DocObjects.ObjectAttributes att = new Rhino.DocObjects.ObjectAttributes();

        string name = names.Count > 0 ? names[i % names.Count] : null;
        //Set object name
        if(!string.IsNullOrEmpty(name))
        {
          att.Name = name;
        }

        Color color = colors.Count > 0 ? colors[i % colors.Count] : new Color();
        //Set color
        if(!color.IsEmpty)
        {
          att.ColorSource = Rhino.DocObjects.ObjectColorSource.ColorFromObject; //Make the color type "by object"
          att.ObjectColor = color;

          att.PlotColorSource = Rhino.DocObjects.ObjectPlotColorSource.PlotColorFromObject; //Make the plot color type "by object"
          att.PlotColor = color;
        }

        string layer = layers.Count > 0 ? layers[i % layers.Count] : null;
        //Set layer
        if(!string.IsNullOrEmpty(layer) && Rhino.DocObjects.Layer.IsValidName(layer))
        {
          //Get the current layer index
          Rhino.DocObjects.Tables.LayerTable layerTable = doc.Layers;
          int layerIndex = layerTable.Find(layer, true);

          if(layerIndex < 0) //This layer does not exist, we add it
          {
            Rhino.DocObjects.Layer onlayer = new Rhino.DocObjects.Layer(); //Make a new layer
            onlayer.Name = layer;

            layerIndex = layerTable.Add(onlayer); //Add the layer to the layer table
            if (layerIndex > -1) //We manged to add layer!
            {
              att.LayerIndex = layerIndex;
              Print("Added new layer to the document at position " + layerIndex + " named " + layer + ". ");
            } else
              Print("Layer did not add. Try cleaning up your layers."); //This never happened to me.
          }
          else
            att.LayerIndex = layerIndex; //We simply add to the existing layer
        }


        double pWidth = pWidths.Count > 0 ? pWidths[i % pWidths.Count] : 0;
        //Set plotweight
        if(pWidth > 0)
        {
          att.PlotWeightSource = Rhino.DocObjects.ObjectPlotWeightSource.PlotWeightFromObject;
          att.PlotWeight = pWidth;
        }


        object material = materials.Count > 0 ? materials[i % materials.Count] : null;
        //Set material
        bool materialByName = !string.IsNullOrEmpty(material as string);
        Rhino.Display.DisplayMaterial inMaterial = material as Rhino.Display.DisplayMaterial;
        if(material is Color)
        {
          inMaterial = new Rhino.Display.DisplayMaterial((Color) material);
        }
        if(material != null && inMaterial == null && !materialByName)
        {
          if(!(material is string))
          {
            try //We also resort to try with IConvertible
            {
              inMaterial = (Rhino.Display.DisplayMaterial) Convert.ChangeType(material, typeof(Rhino.Display.DisplayMaterial));
            }
            catch(InvalidCastException)
            {
            }
          }
        }
        if(inMaterial != null || materialByName)
        {
          string matName;

          if(!materialByName)
          {
            matName = string.Format("A:{0}-D:{1}-E:{2}-S:{3},{4}-T:{5}",
              Format(inMaterial.Ambient),
              Format(inMaterial.Diffuse),
              Format(inMaterial.Emission),
              Format(inMaterial.Specular),
              inMaterial.Shine.ToString(),
              inMaterial.Transparency.ToString()
              );
          }
          else
          {
            matName = (string) material;
          }

          int materialIndex = doc.Materials.Find(matName, true);
          if(materialIndex < 0 && !materialByName) //Material does not exist and we have its specs
          {
            materialIndex = doc.Materials.Add(); //Let's add it
            if(materialIndex > -1)
            {
              Print("Added new material at position " + materialIndex + " named \"" + matName + "\". ");
              Rhino.DocObjects.Material m = doc.Materials[materialIndex];
              m.Name = matName;
              m.AmbientColor = inMaterial.Ambient;
              m.DiffuseColor = inMaterial.Diffuse;
              m.EmissionColor = inMaterial.Emission;
              //m.ReflectionColor = no equivalent
              m.SpecularColor = inMaterial.Specular;
              m.Shine = inMaterial.Shine;
              m.Transparency = inMaterial.Transparency;
              //m.TransparentColor = no equivalent
              m.CommitChanges();

              att.MaterialSource = Rhino.DocObjects.ObjectMaterialSource.MaterialFromObject;
              att.MaterialIndex = materialIndex;
            }
            else
              Print("Material did not add. Try cleaning up your materials."); //This never happened to me.
          }
          else if(materialIndex < 0 && materialByName) //Material does not exist and we do not have its specs. We do nothing
          {
            Print("Warning: material name not found. I cannot set the source to this material name. Add a material with name: " + matName);
          }
          else
          {
            //If this material exists, we do not replace it!
            att.MaterialSource = Rhino.DocObjects.ObjectMaterialSource.MaterialFromObject;
            att.MaterialIndex = materialIndex;
          }
        }


        int wires = wiresEach.Count > 0 ? wiresEach[i % wiresEach.Count] : 0;
        //Set wire density
        if(wires == -1 || wires > 0)
        {
          att.WireDensity = wires;
        }

        Bake(obj, att, groupIndex);
      }
    }
    else
    {
      Print("Inactive");
    }
# ---------- bakeattributes: C# additional code ----------
  void Bake(object obj, Rhino.DocObjects.ObjectAttributes att, int groupIndex)
  {
    if(obj == null)
      return;

    Guid id;

    //Bake to the right type of object
    if(obj is GeometryBase)
    {
      GeometryBase geomObj = obj as GeometryBase;

      switch(geomObj.ObjectType)
      {
        case Rhino.DocObjects.ObjectType.Brep:
          id = doc.Objects.AddBrep(obj as Brep, att);
          break;
        case Rhino.DocObjects.ObjectType.Curve:
          id = doc.Objects.AddCurve(obj as Curve, att);
          break;
        case Rhino.DocObjects.ObjectType.Point:
          id = doc.Objects.AddPoint((obj as Rhino.Geometry.Point).Location, att);
          break;
        case Rhino.DocObjects.ObjectType.Surface:
          id = doc.Objects.AddSurface(obj as Surface, att);
          break;
        case Rhino.DocObjects.ObjectType.Mesh:
          id = doc.Objects.AddMesh(obj as Mesh, att);
          break;
        case (Rhino.DocObjects.ObjectType) 1073741824://Rhino.DocObjects.ObjectType.Extrusion:
          id = (Guid) typeof(Rhino.DocObjects.Tables.ObjectTable).InvokeMember("AddExtrusion", BindingFlags.Instance | BindingFlags.InvokeMethod, null, doc.Objects, new object[]{obj, att});
          break;
        case Rhino.DocObjects.ObjectType.PointSet:
          id = doc.Objects.AddPointCloud(obj as Rhino.Geometry.PointCloud, att); //This is a speculative entry
          break;
        default:
          Print("The script does not know how to handle this type of geometry: " + obj.GetType().FullName);
          return;
      }
    }
    else
    {
      Type objectType = obj.GetType();

      if(objectType == typeof(Arc))
      {
        id = doc.Objects.AddArc((Arc) obj, att);
      }
      else if(objectType == typeof(Box))
      {
        id = doc.Objects.AddBrep(((Box) obj).ToBrep(), att);
      }
      else if(objectType == typeof(Circle))
      {
        id = doc.Objects.AddCircle((Circle) obj, att);
      }
      else if(objectType == typeof(Ellipse))
      {
        id = doc.Objects.AddEllipse((Ellipse) obj, att);
      }
      else if(objectType == typeof(Polyline))
      {
        id = doc.Objects.AddPolyline((Polyline) obj, att);
      }
      else if(objectType == typeof(Sphere))
      {
        id = doc.Objects.AddSphere((Sphere) obj, att);
      }
      else if(objectType == typeof(Point3d))
      {
        id = doc.Objects.AddPoint((Point3d) obj, att);
      }
      else if(objectType == typeof(Line))
      {
        id = doc.Objects.AddLine((Line) obj, att);
      }
      else if(objectType == typeof(Vector3d))
      {
        Print("Impossible to bake vectors");
        return;
      }
      else if(obj is IEnumerable)
      {
        int newGroupIndex;
        if(groupIndex == -1)
          newGroupIndex = doc.Groups.Add();
        else
          newGroupIndex = groupIndex;
        foreach(object o in obj as IEnumerable)
        {
          Bake(o, att, newGroupIndex);
        }
        return;
      }
      else
      {
        Print("Unhandled type: " + objectType.FullName);
        return;
      }
    }

    if(groupIndex != -1)
    {
      doc.Groups.AddToGroup(groupIndex, id);
      Print("Added " + obj.GetType().Name + " to group number " + groupIndex);
    }
    else
      Print("Added " + obj.GetType().Name);
  }

  static string Format(Color c)
  {
    return (new System.Text.StringBuilder("A")).Append(c.A.ToString()).Append("R").Append(c.R.ToString()).Append("G")
      .Append(c.G.ToString()).Append("B").Append(c.B.ToString()).ToString();
  }
# ---------- end bakeattributes ----------

# ----
# Display lines
line = Line()
pipe = Pipe(Curve=line, Radius=0.005, Caps=0)

# ----
# Display Pts
pt_2 = Point()

volume = Volume(Geometry=mesh_4)  # -> Volume, Centroid
volume_2 = Volume(Geometry=transform)  # -> Volume, Centroid
multiplication = Multiplication(A=volume.Volume, B=Slider(1.8, range=1..30000))
ma = MassAddition(Input=volume_2.Volume)  # -> Result, PartialResults
division = Division(A=ma.Result, B=volume.Volume)
panel_8 = Panel(multiplication)
panel_9 = Panel(division)
panel_10 = Panel(ma.Result)

# ==== cluster Colourful: Display objects in bright colours
geo = ClusterInput()
geo_2 = Geometry(geo)
clean = CleanTree(RemoveNulls=True, RemoveInvalid=True, RemoveEmpty=False, Tree=flatten(geo_2))
S = Shader([{ambient=RGB(128, 128, 128), diffuse=RGB(11, 125, 222), emission=RGB(3, 38, 67), shine=0.5, specular=RGB(255, 255, 255), transparency=0}, {ambient=RGB(128, 128, 128), diffuse=RGB(222, 37, 11), emission=RGB(67, 11, 3), shine=0.5, specular=RGB(255, 255, 255), transparency=0}, {ambient=RGB(128, 128, 128), diffuse=RGB(71, 222, 11), emission=RGB(21, 67, 3), shine=0.5, specular=RGB(255, 255, 255), transparency=0}, {ambient=RGB(128, 128, 128), diffuse=RGB(222, 194, 11), emission=RGB(67, 58, 3), shine=0.5, specular=RGB(255, 255, 255), transparency=0}])
lng = ListLength(List=clean)
repeat = RepeatData(Data=S, Length=lng)
preview = CustomPreview(Geometry=clean, Shader=repeat)
