# Grasshopper definition connectFixPts.gh (Grasshopper 0.9.76)

panel = Panel("""1
20""")
pop2d = Populate2D(Region={Plane=PlaneXY(0, 0, 0), Size=Domain2(u=0..20, v=0..10)}, Count=100, Seed=1)
item = ListItem(List=pop2d, Index=panel, Wrap=True)
pt = Point(item)
connectfixpts = CSharpScript(Pts=pop2d, FixPt=pt, Dist=Slider(8.965, range=0..21))  # -> out, L; inputs Pts: list of Point3d, FixPt: Point3d, Dist: Double
# ---------- connectfixpts: C# ----------
    List<Line> Lns = new List<Line>();
    foreach(Point3d P in Pts)
    {
      if(P.DistanceTo(FixPt) < Dist)
      {
        Lns.Add(new Line(P, FixPt));
      }
    }
    L = Lns;
# ---------- end connectfixpts ----------
