# Grasshopper definition postprocessing-magpie-example.gh (Grasshopper 0.9.76)
# plug-ins: Python Interpreter, Sandbox Topology, Kangaroo Components, MechanoAdaptiveGeneration

# ----
# Read your Magpie results for postprocessing
button = Button()
path = FilePath("C:\Users\afelder\Desktop\magpie-example-results\result-of-compiled-magpie.txt")
openmagpieresults = MagpieReader(Read=button, InputFilePath=path)  # -> EllipsoidCentres, LongAxes, ShortAxes, PlasticDragDistance, BoundaryCollideStrength, AlignStrength, FixedPointIndices, MinimumLengthOfShortAxis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
shift_x = ShiftX(G=openmagpieresults.EllipsoidCentres, C=openmagpieresults.InputMesh)
visualiseellipsoids = VisualiseEllipsoids(pts=shift_x, longaxes=openmagpieresults.LongAxes, shortaxes=openmagpieresults.ShortAxes)
colourful = Colourful(geo=visualiseellipsoids)

stressview = StressViewer(Data=openmagpieresults.InputField, Scale=0.0001)
shift_x_2 = ShiftX(G=stressview, C=openmagpieresults.InputMesh)
mesh = Mesh(openmagpieresults.InputMesh)
pt = Point(openmagpieresults.EllipsoidCentres)

# ----
# Project close points to edges and corners
bbox = BoundingBox(Content=mesh, Plane=PlaneXY(0, 0, 0))  # -> Box, Box_2
meshcp = MeshClosestPoint(Point=pt, Mesh=mesh)  # -> Point, Index, Parameter
subtraction = Subtraction(A=pt, B=meshcp.Point)
vlen = VectorLength(Vector=subtraction)
projectiondistance = Slider(0.005, range=0..0.1)
angle = Slider(1.593, range=0..3.141)
mbox = MeshBox(Base=bbox.Box, XCount=10, YCount=10, ZCount=10)
rot3d = Rotate3D(Geometry=mbox, Angle=1.570796327, Center=Point(0, 0, 0), Axis=Vector(0, 0, 1))  # -> Geometry, Transform
mjoin = MeshJoin(Meshes=[rot3d.Geometry, mbox])
gettruemeshborder = CSharpScript(angle=angle, mesh=mbox)  # -> out, trueMeshEdges, trueMeshCorners; inputs angle: Double, mesh: Mesh
# ---------- gettruemeshborder: C# ----------
    Mesh m = mesh;
    m.Unweld(angle, false);
    Mesh[] submeshes = m.ExplodeAtUnweldedEdges();

    List<Curve> meshEdges = new List<Curve>();
    List<Point3d> meshCorners = new List<Point3d>();
    for(int s = 0; s < submeshes.Length; s++)
    {
      Polyline[] edges = submeshes[s].GetNakedEdges();
      for(int e = 0; e < edges.Length; e++){
        Curve curve = edges[e].ToNurbsCurve();
        meshEdges.Add(curve);
        Point3d[] pointsOnEdge = edges[e].ToArray();
        int plen = pointsOnEdge.Length;
        for(int p = 0; p < plen-1; p++){
          Vector3d segment1 = pointsOnEdge[(p + 1) % plen] - pointsOnEdge[p];
          int pm1 = (p - 1) % plen;
          if(pm1 < 0) pm1 += plen;
          Vector3d segment2 = pointsOnEdge[pm1] - pointsOnEdge[p];
          double localAngle = Vector3d.VectorAngle(segment1, segment2);
          if(localAngle < angle)
          {
            meshCorners.Add(pointsOnEdge[p]);
          }
        }
      }
    }

    trueMeshEdges = meshEdges;
    trueMeshCorners = meshCorners;
# ---------- end gettruemeshborder ----------
projectonfaces = CSharpScript(mesh=mesh, points=pt, distance=vlen, tolerance=projectiondistance)  # -> out, projectedPoints; inputs mesh: Mesh, points: list of Point3d, distance: list of Double, tolerance: Double
# ---------- projectonfaces: C# ----------
    List<Point3d> projected = new List<Point3d>();
    projected = points;
    for(int i = 0;i < points.Count;i++){
      if(distance[i] < tolerance || !mesh.IsPointInside(points[i], 1e-12, true))
      {
        projected[i] = mesh.ClosestPoint(points[i]);
      }
    }
    projectedPoints = projected;
# ---------- end projectonfaces ----------
projectonedges = CSharpScript(meshEdges=gettruemeshborder.trueMeshEdges, points=projectonfaces.projectedPoints, tolerance=projectiondistance)  # -> out, simplify(flatten(projectedPoints)); inputs meshEdges: Curve, points: list of Point3d, tolerance: Double
# ---------- projectonedges: C# ----------
    List<Point3d> projected = new List<Point3d>();
    projected = points;
    for(int i = 0;i < points.Count;i++){
      double t;
      meshEdges.ClosestPoint(points[i], out t);
      Point3d closestPoint = meshEdges.PointAt(t);
      if((closestPoint - points[i]).Length < tolerance)
      {
        projected[i] = closestPoint;
      }
    }
    projectedPoints = projected;
# ---------- end projectonedges ----------
duppt = RemoveDuplicatePts(Points=projectonedges.projectedPoints, Tolerance=0.000488)
projectoncorners = CSharpScript(meshCorners=gettruemeshborder.trueMeshCorners, points=duppt, tolerance=Slider(0.005, range=0..1))  # -> out, projectedPoints; inputs meshCorners: list of Point3d, points: list of Point3d, tolerance: Double
# ---------- projectoncorners: C# ----------
    List<Point3d> projected = new List<Point3d>();
    projected = points;
    for(int i = 0;i < points.Count;i++){
      double distance = Double.MaxValue;
      int closestCornerIndex = -1;
      for(int c = 0; c < meshCorners.Count; c++)
      {
        if((meshCorners[c] - points[i]).Length < distance)
        {
          distance = (meshCorners[c] - points[i]).Length;
          closestCornerIndex = c;
        }
      }
      if((meshCorners[closestCornerIndex] - points[i]).Length < tolerance)
      {
        projected[i] = meshCorners[closestCornerIndex];
      }
    }
    projectedPoints = projected;
# ---------- end projectoncorners ----------
duppt_2 = RemoveDuplicatePts(Points=projectoncorners.projectedPoints, Tolerance=Slider(0.005, range=0..1))

# ----
# Tetrahedralize
meshcp_2 = MeshClosestPoint(Point=duppt_2, Mesh=mesh)  # -> Point, Index, Parameter
subtraction_2 = Subtraction(A=duppt_2, B=meshcp_2.Point)
vlen_2 = VectorLength(Vector=subtraction_2)
writenodefilewithbnd = PythonScript(points=duppt_2, surfacePoints=meshcp_2.Point, distancesFromMesh=vlen_2, tol=Slider(0.0001, range=0..0.1))  # -> out, a, Pts, Tets; inputs points: list, surfacePoints: list, distancesFromMesh: list
# ---------- writenodefilewithbnd: Python ----------
import rhinoscriptsyntax as rs
import Rhino.Geometry as rg
import sys
from subprocess import Popen, PIPE

nInputPoints = len(points);

f = open('C:/Projects/0888_SpaceFrame/trunk/anisotropicDelaunay/Test/new3.node','w')
f.write(str(nInputPoints)+" 3 0 1\n")

print(nInputPoints)

bndPoints = [];

for i in range(nInputPoints):
    onBoundary=0;
    if(distancesFromMesh[i]<tol):
        onBoundary=1;
        bndPoints.append(points[i])
        f.write(str(i+1)+" "+str((rs.PointCoordinates(surfacePoints[i])[0]))+" "+str((rs.PointCoordinates(surfacePoints[i])[1]))+" "+str((rs.PointCoordinates(surfacePoints[i])[2]))+" "+str(onBoundary))
    else:
        f.write(str(i+1)+" "+str((rs.PointCoordinates(points[i])[0]))+" "+str((rs.PointCoordinates(points[i])[1]))+" "+str((rs.PointCoordinates(points[i])[2]))+" "+str(onBoundary))
    f.write("\n")
    
a = bndPoints

f.close();
p = Popen(["tetgen -S0O9\\0g C:/Projects/0888_SpaceFrame/trunk/anisotropicDelaunay/Test/new3.node"],shell=True, stdout=PIPE)

while True:
    data = p.stdout.readline()   # Alternatively proc.stdout.read(1024)
    if len(data) == 0:
        break
    sys.stdout.write(data)  
    
f = open('C:/Projects/0888_SpaceFrame/trunk/anisotropicDelaunay/Test/new3.1.mesh','r')
nLines = sum(1 for line in f)
f.seek(0,0)
print(nLines)
rawOutput = f.readlines()
lineNr=0
header=[]
while "Vertices" not in rawOutput[lineNr]:
        lineNr += 1
        header.append(rawOutput[lineNr])
        
print(header)
#output points
nPoints = int(rawOutput[lineNr+1])
lineNr += 1
print(nPoints)
points=rawOutput[lineNr+1:lineNr+nPoints+1]
Pts=[]
for i in range(nPoints):
    Pts.append(points[i][0:-1])
    lineNr+=1
    
#print(Pts)

#skip Tris and Edgs
skipped = []
while "Tetrahedra" not in rawOutput[lineNr]:
        lineNr += 1
        skipped.append(rawOutput[lineNr])
        
        
#print(skipped)
lineNr+=2
import re

#output tets
nCells=int(rawOutput[lineNr])
print(nCells)
lineNr += 1

cells=rawOutput[lineNr:lineNr+nCells]
Tts=[]
for i in range(nCells):
    tet = map(int,re.sub("[^\w]", " ",  cells[i]).split())
    tet = (tet[0],tet[1],tet[2],tet[3])
    Tts.append(tet)

Tets=Tts
print Tets[1:5]
f.close()
# ---------- end writenodefilewithbnd ----------
pt_2 = Point(writenodefilewithbnd.a)
split = TextSplit(Text=writenodefilewithbnd.Tets, Separators="(,)")
split_2 = TextSplit(Text=writenodefilewithbnd.Pts, Separators="  ")
item = ListItem(List=split, Index=[1, 2, 3, 4], Wrap=True)
item_2 = ListItem(List=split_2, Index=0, Wrap=True)
item_3 = ListItem(List=split_2, Index=2, Wrap=True)
item_4 = ListItem(List=split_2, Index=4, Wrap=True)
subtraction_3 = Subtraction(A=item, B=1)
pt_3 = ConstructPoint(XCoordinate=item_2, YCoordinate=item_3, ZCoordinate=item_4)  # -> flatten(Point)
item_5 = ListItem(List=pt_3, Index=subtraction_3, Wrap=True)
conmesh = ConstructMesh(Vertices=item_5, Faces=[{A=2, B=0, C=1, D=1}, {A=3, B=0, C=2, D=2}, {A=1, B=3, C=2, D=2}, {A=1, B=0, C=3, D=3}])
medges = MeshEdges(Mesh=conmesh)  # -> NakedEdges, flatten(InteriorEdges), NonManifoldEdges

# ----
# Filter
dupln = RemoveDuplicateLines(Lines=medges.InteriorEdges, Tolerance=0.0001)
data = Data([-0.058, -0.008, 0.002, -17.154768, -3.942088, -4.328426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])
line_topo = LineTopology(ListOfLines=dupln, Tolerance=0.0001)  # -> ListOfPoints, LinePointStructure, PointPointStructure, PointLineStructure
simple_filter_by_valence = CSharpScript(
    Data=flatten(data),
    Pts=line_topo.ListOfPoints,
    LinesForEachPoint=line_topo.PointLineStructure,
    Reference=["C:\USERS\AFELDER\DESKTOP\MECHANOADAPTIVEGENERATION-MASTER\LIB\KangarooSolver.dll", "C:\Users\afelder\Documents\Test-out-of-the-box\MechanoAdaptiveGeneration-master\src\MechanoAdaptiveGeneration\bin\MechanoAdaptiveGeneration.dll"])  # -> out, F0, F1, F2, F3, F4, F5, EV1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; inputs Data: list of Double, Pts: list of Point3d, LinesForEachPoint: tree of Line
# ---------- simple_filter_by_valence: C# ----------
    //for each point
    //for each of the 6 stress directions at that point
    //get its angle with each of the 6 directions (+/-)
    //keep the line with the smallest angle

    List<Vector3d> Evec1 = new List<Vector3d>();
    List<Vector3d> Evec2 = new List<Vector3d>();
    List<Vector3d> Evec3 = new List<Vector3d>();

    List<double> Eval1 = new List<double>();
    List<double> Eval2 = new List<double>();
    List<double> Eval3 = new List<double>();

    List<Line> KeptLines0 = new List<Line>();
    List<Line> KeptLines1 = new List<Line>();
    List<Line> KeptLines2 = new List<Line>();
    List<Line> KeptLines3 = new List<Line>();
    List<Line> KeptLines4 = new List<Line>();
    List<Line> KeptLines5 = new List<Line>();

    double tol = 0.0001;
    Point3d[] PointArray = Pts.ToArray();

    MechanoAdaptiveGeneration.BackGroundData bgd = new MechanoAdaptiveGeneration.BackGroundData();
    MechanoAdaptiveGeneration.StressTensor[,,] grid = new MechanoAdaptiveGeneration.StressTensor[0, 0, 0];
    MechanoAdaptiveGeneration.HelperFunctions.ProcessData(Data, ref bgd, ref grid);
    MechanoAdaptiveGeneration.HelperFunctions.InterpolateTensor(PointArray, ref Evec1, ref Evec2, ref Evec3, ref Eval1, ref Eval2, ref Eval3, grid, bgd);

    EV1 = Evec1;
    EV2 = Evec2;
    EV3 = Evec3;

    A = PointArray.ToList();

    for (int currentPointIndex = 0; currentPointIndex < LinesForEachPoint.BranchCount; currentPointIndex++)
    {
      List<Line> Lines = LinesForEachPoint.Branch(currentPointIndex);

      int[] BestLineForEachDir = new int[6];
      double[] currentBestAngleForEachDir = new double[6];
      for(int i = 0;i < 6;i++) {currentBestAngleForEachDir[i] = Math.PI;}

      for(int i = 0;i < Lines.Count;i++)
      {

        Line currentLine = new Line();
        currentLine = Lines[i];
        if( (currentLine.To - PointArray[currentPointIndex]).Length > tol)
        {
          currentLine.Flip();
        }

        double AngleWithDir0 = Vector3d.VectorAngle(currentLine.Direction, Evec1[currentPointIndex]);
        if(AngleWithDir0 < currentBestAngleForEachDir[0])
        {
          currentBestAngleForEachDir[0] = AngleWithDir0;
          BestLineForEachDir[0] = i;
        }

        double AngleWithDir1 = Vector3d.VectorAngle(currentLine.Direction, Vector3d.Negate(Evec1[currentPointIndex]));
        if(AngleWithDir1 < currentBestAngleForEachDir[1])
        {
          currentBestAngleForEachDir[1] = AngleWithDir1;
          BestLineForEachDir[1] = i;
        }

        double AngleWithDir2 = Vector3d.VectorAngle(currentLine.Direction, Evec2[currentPointIndex]);
        if(AngleWithDir2 < currentBestAngleForEachDir[2])
        {
          currentBestAngleForEachDir[2] = AngleWithDir2;
          BestLineForEachDir[2] = i;
        }

        double AngleWithDir3 = Vector3d.VectorAngle(currentLine.Direction, -Evec2[currentPointIndex]);
        if(AngleWithDir3 < currentBestAngleForEachDir[3])
        {
          currentBestAngleForEachDir[3] = AngleWithDir3;
          BestLineForEachDir[3] = i;
        }

        double AngleWithDir4 = Vector3d.VectorAngle(currentLine.Direction, Evec3[currentPointIndex]);
        if(AngleWithDir4 < currentBestAngleForEachDir[4])
        {
          currentBestAngleForEachDir[4] = AngleWithDir4;
          BestLineForEachDir[4] = i;
        }

        double AngleWithDir5 = Vector3d.VectorAngle(currentLine.Direction, -Evec3[currentPointIndex]);
        if(AngleWithDir5 < currentBestAngleForEachDir[5])
        {
          currentBestAngleForEachDir[5] = AngleWithDir5;
          BestLineForEachDir[5] = i;
        }

      }

      KeptLines0.Add(Lines[BestLineForEachDir[0]]);
      KeptLines1.Add(Lines[BestLineForEachDir[1]]);
      KeptLines2.Add(Lines[BestLineForEachDir[2]]);
      KeptLines3.Add(Lines[BestLineForEachDir[3]]);
      KeptLines4.Add(Lines[BestLineForEachDir[4]]);
      KeptLines5.Add(Lines[BestLineForEachDir[5]]);
    }

    F0 = KeptLines0;
    F1 = KeptLines1;
    F2 = KeptLines2;
    F3 = KeptLines3;
    F4 = KeptLines4;
    F5 = KeptLines5;
# ---------- simple_filter_by_valence: C# additional code ----------
  public void InterpolateTensor(Point3d[] Pts, List<double> Data, ref List<Vector3d> Evec1, ref List<Vector3d> Evec2, ref List<Vector3d> Evec3, ref List<double> Eval1, ref List<double> Eval2, ref List<double> Eval3)
  {    int nOfPoints = Pts.Count();

    List<Point3d> G = new List<Point3d>();
    List<double> T0 = new List<double>();
    List<double> T1 = new List<double>();
    List<double> T2 = new List<double>();
    List<double> T3 = new List<double>();
    List<double> T4 = new List<double>();
    List<double> T5 = new List<double>();

    while(Data.Any())
    {
      List <double> localDataList = Data.Take(9).ToList();

      G.Add(new Point3d(localDataList[0], localDataList[1], localDataList[2]));

      T0.Add(localDataList[3]);
      T1.Add(localDataList[4]);
      T2.Add(localDataList[5]);
      T3.Add(localDataList[6]);
      T4.Add(localDataList[7]);
      T5.Add(localDataList[8]);

      Data = Data.Skip(9).ToList();
    }

    var EigenVectors = new Vector3d[nOfPoints][];
    var EigenValues = new Double[nOfPoints][];

    var EVA = new Vector3d[nOfPoints];
    var EVB = new Vector3d[nOfPoints];
    var EVC = new Vector3d[nOfPoints];
    var EigenValuesA = new double[nOfPoints];
    var EigenValuesB = new double[nOfPoints];
    var EigenValuesC = new double[nOfPoints];

    //find grid count and size
    int xCount, yCount, zCount;
    xCount = yCount = zCount = 0;
    double xSize, ySize, zSize;
    xSize = ySize = zSize = 0;

    var Tensors = new StressTensor[G.Count];
    for(int i = 0;i < G.Count;i++)
    {
      Tensors[i] = new StressTensor(new List<double>{T0[i],T1[i],T2[i],T1[i],T3[i],T4[i],T2[i],T4[i],T5[i]});
    }
    Array.Sort(G.ToArray(), Tensors);

    G.Sort();

    zSize = G[1].Z - G[0].Z;

    for(int i = 1;i < G.Count;i++)
    {
      if(G[i].Y > G[0].Y)
      {
        ySize = G[i].Y - G[0].Y;
        zCount = i;
        break;
      }
    }

    for(int i = 1;i < G.Count;i++)
    {
      if(G[i].X > G[0].X)
      {
        xSize = G[i].X - G[0].X;
        yCount = i / zCount;
        break;
      }
    }

    xCount = G.Count / (zCount * yCount);

    var Grid = new StressTensor[xCount, yCount, zCount];

    for(int i = 0; i < xCount;i++)
    {
      for(int j = 0; j < yCount; j++)
      {
        for(int k = 0; k < zCount; k++)
        {
          Grid[i, j, k] = Tensors[k + j * zCount + i * zCount * yCount];
        }
      }
    }
    // for each point in P, find its coordinates in the grid
    // output the 8 points/indices of the corners
    // and the point coordinates of the position within that cell

    var arrayOfCellCoords = new Point3d[nOfPoints]; // always in [0,1]^3
    var arrayOfTensors0 = new double[nOfPoints][];
    var arrayOfTensors1 = new double[nOfPoints][];
    var arrayOfTensors2 = new double[nOfPoints][];
    var arrayOfTensors3 = new double[nOfPoints][];
    var arrayOfTensors4 = new double[nOfPoints][];
    var arrayOfTensors5 = new double[nOfPoints][];
    var arrayOfTensors6 = new double[nOfPoints][];
    var arrayOfTensors7 = new double[nOfPoints][];

    System.Threading.Tasks.Parallel.For(0, nOfPoints,
      j => {
      var PVec = Pts[j] - G[0];  //position vector of the current point relative to grid origin

      var PX = PVec.X / xSize;
      var PY = PVec.Y / ySize;
      var PZ = PVec.Z / zSize;

      int PXF,PXC,PYF,PYC,PZF,PZC;

      var CoordsInCell = new Point3d();

      if(PX < 0)
      {
        PXF = 0; PXC = 1; CoordsInCell.X = 0;
      }
      else if(PX > xCount - 1)
      {
        PXF = xCount - 2; PXC = xCount - 1; CoordsInCell.X = 1;
      }
      else
      {
        PXF = (int) Math.Floor(PX); PXC = (int) Math.Ceiling(PX); CoordsInCell.X = PX - PXF;
      }


      if(PY < 0)
      {
        PYF = 0; PYC = 1; CoordsInCell.Y = 0;
      }
      else if(PY > yCount - 1)
      {
        PYF = yCount - 2; PYC = yCount - 1; CoordsInCell.Y = 1;
      }
      else
      {
        PYF = (int) Math.Floor(PY); PYC = (int) Math.Ceiling(PY); CoordsInCell.Y = PY - PYF;
      }


      if(PZ < 0)
      {
        PZF = 0; PZC = 1; CoordsInCell.Z = 0;
      }
      else if(PZ > zCount - 1)
      {
        PZF = zCount - 2; PZC = zCount - 1; CoordsInCell.Z = 1;
      }
      else
      {
        PZF = (int) Math.Floor(PZ); PZC = (int) Math.Ceiling(PZ); CoordsInCell.Z = PZ - PZF;
      }


      //
      //      int PXF = Math.Max(Math.Min((int) Math.Floor(PX), xCount - 1), 0);
      //      int PYF = Math.Max(Math.Min((int) Math.Floor(PY), yCount - 1), 0);
      //      int PZF = Math.Max(Math.Min((int) Math.Floor(PZ), zCount - 1), 0);
      //
      //      int PXC = Math.Max(Math.Min((int) Math.Ceiling(PX), xCount - 1), 0);
      //      int PYC = Math.Max(Math.Min((int) Math.Ceiling(PY), yCount - 1), 0);
      //      int PZC = Math.Max(Math.Min((int) Math.Ceiling(PZ), zCount - 1), 0);

      //     arrayOfCellCoords[j] = new Point3d(Math.Min(Math.Max(PX - PXF, 0), 1), Math.Min(Math.Max(PY - PYF, 0), 1), Math.Min(Math.Max(PZ - PZF, 0), 1));

      arrayOfCellCoords[j] = CoordsInCell;

      arrayOfTensors0[j] = Grid[PXF, PYF, PZF].Values;
      arrayOfTensors1[j] = Grid[PXF, PYF, PZC].Values;
      arrayOfTensors2[j] = Grid[PXF, PYC, PZF].Values;
      arrayOfTensors3[j] = Grid[PXF, PYC, PZC].Values;
      arrayOfTensors4[j] = Grid[PXC, PYF, PZF].Values;
      arrayOfTensors5[j] = Grid[PXC, PYF, PZC].Values;
      arrayOfTensors6[j] = Grid[PXC, PYC, PZF].Values;
      arrayOfTensors7[j] = Grid[PXC, PYC, PZC].Values;

      var Corners = new StressTensor[8];

      Corners[0] = new StressTensor();
      Corners[1] = new StressTensor();
      Corners[2] = new StressTensor();
      Corners[3] = new StressTensor();
      Corners[4] = new StressTensor();
      Corners[5] = new StressTensor();
      Corners[6] = new StressTensor();
      Corners[7] = new StressTensor();

      Corners[0].Values = (double[]) arrayOfTensors0[j];
      Corners[1].Values = (double[]) arrayOfTensors1[j];
      Corners[2].Values = (double[]) arrayOfTensors2[j];
      Corners[3].Values = (double[]) arrayOfTensors3[j];
      Corners[4].Values = (double[]) arrayOfTensors4[j];
      Corners[5].Values = (double[]) arrayOfTensors5[j];
      Corners[6].Values = (double[]) arrayOfTensors6[j];
      Corners[7].Values = (double[]) arrayOfTensors7[j];

      var EVec = new Vector3d[3];
      var EVal = new Double[3];

      var T = new Double[3]{arrayOfCellCoords[j].X,arrayOfCellCoords[j].Y,arrayOfCellCoords[j].Z};
      //var T = new Double[3]{0.5,0.5,0.5};

      StressTensor tensorAtPoint = TriLinearInterpolate(Corners, T);
      EigenSolve(tensorAtPoint.Values, out EVal, out EVec);

      int[] ott = new int[3]; // o ne, t wo, t hree
      ott[0] = 0;
      ott[1] = 1;
      ott[2] = 2;
      double[] ev = new double[]{Math.Abs(EVal[0]),Math.Abs(EVal[1]),Math.Abs(EVal[2])};
      //sort according to maximum absolute value of Eval
      Array.Sort(ev, ott);

      EVA[j] = EVec[ott[2]];
      EVB[j] = EVec[ott[1]];
      EVC[j] = EVec[ott[0]];

      EigenValuesA[j] = Math.Abs(EVal[ott[2]]);
      EigenValuesB[j] = Math.Abs(EVal[ott[1]]);
      EigenValuesC[j] = Math.Abs(EVal[ott[0]]);
      });

    Evec1 = EVA.ToList();
    Evec2 = EVB.ToList();
    Evec3 = EVC.ToList();
    Eval1 = EigenValuesA.ToList();
    Eval2 = EigenValuesB.ToList();
    Eval3 = EigenValuesC.ToList();
  }

  //public void SweepAndPrune(List < Ellipsoid > Ellipsoids, Point3d[] Positions, ref List<int> CollideRef0, ref List<int> CollideRef1)
  //{
  //  List <AABB> boxes = new List<AABB>();
  //
  //  //use the points to create AABB objects
  //  for (int i = 0; i < Ellipsoids.Count; i++)
  //  {
  //    Ellipsoids[i].position = Positions[i];
  //    Ellipsoids[i].calculateBoundingBox();
  //
  //    boxes.Add(new AABB(Ellipsoids[i].boundingBoxMin, Ellipsoids[i].boundingBoxMax, i));
  //  }
  //
  //  List <EndPoint> sortedInX = new List<EndPoint>();
  //
  //  //add the endpoints in x
  //  foreach (AABB boxForPoint in boxes) {
  //    sortedInX.Add(boxForPoint.min[0]);//change this 0 to 1 or 2 to sort in Y or Z - will also need to change the second half of the test function
  //    sortedInX.Add(boxForPoint.max[0]);//change this 0 to 1 or 2 to sort in Y or Z
  //  }
  //
  //  //sort by the num value of each EndPoint
  //  sortedInX.Sort(EndPoint.compareEndPoints);
  //
  //  List <int> openBoxes = new List<int>();
  //
  //  foreach (EndPoint endPoint in sortedInX)
  //  {
  //    if (endPoint.isMin)
  //    {
  //      AABB thisPointOwner = endPoint.owner;
  //      //check against all in openBoxes
  //      foreach(int openBoxRef in openBoxes) {
  //        //if it collides output the integers of the branches than collide
  //        //do they collide in y?
  //        if(thisPointOwner.max[1].num > boxes[openBoxRef].min[1].num && thisPointOwner.min[1].num < boxes[openBoxRef].max[1].num) {
  //          //they collide in y, do they collide in z?
  //          if(thisPointOwner.max[2].num > boxes[openBoxRef].min[2].num && thisPointOwner.min[2].num < boxes[openBoxRef].max[2].num) {
  //            //they collide in z
  //            //therefore they collide! Add to the list of collide refs
  //            CollideRef0.Add(endPoint.owner.branchRef);
  //            CollideRef1.Add(boxes[openBoxRef].branchRef);
  //          }
  //        }
  //      }
  //      //add corresponding box to openBoxes
  //      openBoxes.Add(thisPointOwner.branchRef);
  //
  //    } else
  //    {
  //      //it must be an max point
  //      //remove corresponding box from openBoxes
  //      openBoxes.Remove(endPoint.owner.branchRef);
  //    }
  //  }
  //
  //}
  //
  //public class EllipsoidCollide // No longer a Goal object itself. This can detect collision and output info then used for the actual goal
  //{
  //
  //  Ellipsoid e1;
  //  Ellipsoid e2;
  //
  //  public double overlap;
  //  public double extension;
  //
  //  public EllipsoidCollide(Ellipsoid _e1, Ellipsoid _e2)
  //  {
  //    e1 = _e1;
  //    e2 = _e2;
  //  }
  //
  //  public double CalculateCollision()
  //  {
  //
  //    e1.calculateAxesAndScales();
  //    e2.calculateAxesAndScales();
  //
  //    //calculate distance vectors back and forth, and the length of the distance
  //    //this will become part of the narrow phase check
  //    Vector3d pjk = new Vector3d(e2.position - e1.position);
  //    double pjkLength = pjk.Length;
  //    Vector3d pkj = new Vector3d(-pjk);
  //
  //    //store direction before transforming distance vectors
  //    Vector3d pushVector = new Vector3d(pjk);
  //
  //    //Transform connection vector onto "sphere" coordinates of either ellipsoid
  //    e1.calculateInverse();
  //    e2.calculateInverse();
  //    //find length of vector inside each ellipsoid
  //    double jDistance = e1.findDistanceInside(pjk);
  //    double kDistance = e2.findDistanceInside(pkj);
  //
  //    double touchingDistance = jDistance + kDistance;
  //    if(pjkLength - (touchingDistance) < 0)
  //    {
  //      return touchingDistance;
  //    }
  //    else
  //    {
  //      return -1;
  //    }
  //
  //    //      //longest overlap is:
  //    //      extension = pjkLength - (jDistance + kDistance);
  //    //
  //    //      //scalar w quantifying overlap in ]0,1]. w = 1 means no overlap, w close to 0 means a lot of overlap
  //    //      double overlap = pjkLength / (jDistance + kDistance);
  //    //
  //    //      if(overlap <= 1.0 && overlap > 0)
  //    //      {
  //    //        pushVector.Unitize();
  //    //        return extension * pushVector;
  //    //      } else
  //    //      {
  //    //        return Vector3d.Zero;
  //    //      }
  //
  //  }
  //
  //}
  //
  //public class Ellipsoid {
  //
  //  //centre point of the ellipsoid
  //  public Point3d position;
  //  //transform matrix that defines the scale and rotation make 3x3 (but really a 1x9)
  //  double[] transform;
  //  //the inverse transform this is calculated once and then referenced..
  //  double[] inverse;
  //
  //  //unitized vectors for the axis
  //  //perhaps store the squared values as they are
  //  public Vector3d unitXAxis;
  //  double scaleX;
  //  public Vector3d unitYAxis;
  //  double scaleY;
  //  public Vector3d unitZAxis;
  //  double scaleZ;
  //
  //  //points defining the bounding box
  //  public Point3d boundingBoxMin;
  //  public Point3d boundingBoxMax;
  //
  //  //constructor
  //  public Ellipsoid(Point3d tPos) {
  //    //set the values use Vector3d.Axis and caluate bounding box function
  //    position = tPos;
  //
  //    //set the transfrom as an identity matrix
  //    transform = new double[]{1,0,0,0,1,0,0,0,1};
  //    inverse = new double[]{1,0,0,0,1,0,0,0,1};
  //
  //    //could use calculateAxes but a waste of three unitize calls!
  //    unitXAxis = Vector3d.XAxis;
  //    scaleX = 1.0;
  //    unitYAxis = Vector3d.YAxis;
  //    scaleY = 1.0;
  //    unitZAxis = Vector3d.ZAxis;
  //    scaleZ = 1.0;
  //
  //    calculateBoundingBox();
  //  }
  //
  //  //takes an set of vectors and updates the transform - taken from the eigenvectors of the interpolated field
  //  public void updateTransform(Vector3d xAxis, Vector3d yAxis, Vector3d zAxis) {
  //    transform[0] = xAxis[0];
  //    transform[3] = xAxis[1];
  //    transform[6] = xAxis[2];
  //
  //    transform[1] = yAxis[0];
  //    transform[4] = yAxis[1];
  //    transform[7] = yAxis[2];
  //
  //    transform[2] = zAxis[0];
  //    transform[5] = zAxis[1];
  //    transform[8] = zAxis[2];
  //  }
  //
  //  public void scale(double s)
  //  {
  //    for(int i = 0; i < 9;i++)
  //    {
  //      transform[i] = s * transform[i];
  //    }
  //  }
  //
  //  public void calculateInverse() {
  //    inverse[0] = transform[0] / (scaleX * scaleX);
  //    inverse[1] = transform[3] / (scaleX * scaleX);
  //    inverse[2] = transform[6] / (scaleX * scaleX);
  //
  //    inverse[3] = transform[1] / (scaleY * scaleY);
  //    inverse[4] = transform[4] / (scaleY * scaleY);
  //    inverse[5] = transform[7] / (scaleY * scaleY);
  //
  //    inverse[6] = transform[2] / (scaleZ * scaleZ);
  //    inverse[7] = transform[5] / (scaleZ * scaleZ);
  //    inverse[8] = transform[8] / (scaleZ * scaleZ);
  //  }
  //
  //  //calculate and return boundingBox
  //  public void calculateBoundingBox() {
  //    //takes a transform matrix representation of an ellipsoid and returns two points defining the min x,y,z and max x,y,x
  //    double[] minAndMaxX = getMinAndMax(position.X, 0);
  //    double[] minAndMaxY = getMinAndMax(position.Y, 3);
  //    double[] minAndMaxZ = getMinAndMax(position.Z, 6);
  //
  //    boundingBoxMin = new Point3d(minAndMaxX[0], minAndMaxY[0], minAndMaxZ[0]);
  //    boundingBoxMax = new Point3d(minAndMaxX[1], minAndMaxY[1], minAndMaxZ[1]);
  //
  //
  //  }
  //
  //  //method used by the calculate bounding box method
  //  private double[] getMinAndMax(double position, int adder) {
  //    double m11 = transform[adder];
  //    double m12 = transform[adder + 1];
  //    double m13 = transform[adder + 2];
  //    double d = Math.Sqrt(m11 * m11 + m12 * m12 + m13 * m13);
  //    double[] minMax = { position - d, position + d };
  //    return minMax;
  //  }
  //
  //  //set updated unit vectors for
  //  public void calculateAxesAndScales() {
  //    unitXAxis = new Vector3d(transform[0], transform[3], transform[6]);
  //    scaleX = unitXAxis.Length;
  //    unitXAxis.Unitize();
  //    unitYAxis = new Vector3d(transform[1], transform[4], transform[7]);
  //    scaleY = unitYAxis.Length;
  //    unitYAxis.Unitize();
  //    unitZAxis = new Vector3d(transform[2], transform[5], transform[8]);
  //    scaleZ = unitZAxis.Length;
  //    unitZAxis.Unitize();
  //  }
  //
  //  //combines the postion and the transform to create an Affine transform
  //  public double[] createAffineTransform() {
  //    return new double[]{transform[0],transform[1],transform[2],position[0],transform[3],transform[4],transform[5],position[1],transform[6],transform[7],transform[8],position[2],0,0,0,1};
  //  }
  //
  //  //using similarity ratios: 1/transformedLength = distanceInside/inputlegth
  //  public double findDistanceInside(Vector3d inputVector) {
  //    Vector3d transformed = transformVector(inputVector);
  //    return inputVector.Length / transformed.Length;
  //  }
  //
  //  //method used by findDistanceInside method
  //  private Vector3d transformVector(Vector3d toTransform) {
  //    Vector3d transformedVector = new Vector3d();
  //    transformedVector[0] = inverse[0] * toTransform[0] + inverse[1] * toTransform[1] + inverse[2] * toTransform[2];
  //    transformedVector[1] = inverse[3] * toTransform[0] + inverse[4] * toTransform[1] + inverse[5] * toTransform[2];
  //    transformedVector[2] = inverse[6] * toTransform[0] + inverse[7] * toTransform[1] + inverse[8] * toTransform[2];
  //    return transformedVector;
  //  }
  //}
  //
  //public class AABB {
  //  public EndPoint[] min;//an array of size 3 with the x,y,z value for the AABB min
  //  public EndPoint[] max;//an array of size 3 with the x,y,z value for the AABB max
  //  public int branchRef;
  //
  //  //constructor
  //  public AABB(Point3d tMin, Point3d tMax, int tBranchRef) {
  //    min = new EndPoint[] {new EndPoint(tMin.X, true, this), new EndPoint(tMin.Y, true, this), new EndPoint(tMin.Z, true, this)};
  //    max = new EndPoint[] {new EndPoint(tMax.X, false, this), new EndPoint(tMax.Y, false, this), new EndPoint(tMax.Z, false, this)};
  //    branchRef = tBranchRef;
  //  }
  //}
  //
  //public class EndPoint {
  //  public AABB owner;
  //  public double num;//its actual value - corresponds to the x,y or z value
  //  public bool isMin;//is this a min point or a max point?
  //
  //  //constructor
  //  public EndPoint(double tNum, bool tIsMin, AABB tOwner) {
  //    num = tNum;
  //    isMin = tIsMin;
  //    owner = tOwner;
  //  }
  //
  //  //used as a comparison to sort the endpoints
  //  public static int compareEndPoints(EndPoint x, EndPoint y)
  //  {
  //    return x.num.CompareTo(y.num);
  //  }
  //}
  public class StressTensor
  {
    public double[] Values;

    public StressTensor()
    {
      Values = new Double[9]{0,0,0,0,0,0,0,0,0};
    }

    public StressTensor(List < double > Vals)
    {
      Values = Vals.ToArray();
    }
  }
  //
  //
  //
  //
  public StressTensor LinearInterpolate(StressTensor TensorA, StressTensor TensorB, double T)
  {
    var Interp = new StressTensor();
    int NaNorZeroCount = 0;
    for(int i = 0;i < 9;i++)
    {
      Interp.Values[i] = 0;
      if(!Double.IsNaN(TensorA.Values[i]) )
      {
        Interp.Values[i] += (1 - T) * TensorA.Values[i];
      }
      else{
        Interp.Values[i] += (1 - T) * TensorB.Values[i];
        NaNorZeroCount++;
      }
      if(!Double.IsNaN(TensorB.Values[i]))
      {
        Interp.Values[i] += T * TensorB.Values[i];
      }
      else{
        Interp.Values[i] += T * TensorA.Values[i];
        NaNorZeroCount++;
      }

      if(NaNorZeroCount == 2)
      {
        Interp.Values[i] = double.NaN;
      }
    }

    return Interp;

  }


  /// <summary>
  /// given stress tensors at the 8 corners of a cube, and coordinates of a point within that cube
  /// perform a trilinear interpolation
  /// </summary>
  /// <param name="CornerTensors">Tensor values at the corners, ordered 000,001,010,011,100,101,110,111</param>
  /// <param name="T">3 numbers in the range 0 to 1</param>
  /// <returns>the interpolated stress tensor at the given coordinates</returns>
  ///
  public StressTensor TriLinearInterpolate(StressTensor[] CornerTensors, double[] T)
  {
    //first get the 4 values along the edges in the x direction
    StressTensor SX0 = LinearInterpolate(CornerTensors[0], CornerTensors[4], T[0]);
    StressTensor SX1 = LinearInterpolate(CornerTensors[1], CornerTensors[5], T[0]);
    StressTensor SX2 = LinearInterpolate(CornerTensors[2], CornerTensors[6], T[0]);
    StressTensor SX3 = LinearInterpolate(CornerTensors[3], CornerTensors[7], T[0]);

    //interpolate along Y
    StressTensor SY0 = LinearInterpolate(SX0, SX2, T[1]);
    StressTensor SY1 = LinearInterpolate(SX1, SX3, T[1]);

    //and finally along Z
    var ST = LinearInterpolate(SY0, SY1, T[2]);
    bool HasNaN = false;
    for(int i = 0;i < 9;i++)
    {
      if(Double.IsNaN(ST.Values[i])){HasNaN = true;}
    }
    if(!HasNaN)
    {
      return LinearInterpolate(SY0, SY1, T[2]);
    }
    else
    {
      var Mx = double.MaxValue;
      //var Mx = ev1max;

      return new StressTensor(new List<double>{Mx,0,0,0,Mx,0,0,0,Mx});
    }

  }

  public class DescendingAbsoluteVals : Comparer < double > {
    public override int Compare(double x, double y)
    {
      return (y * y).CompareTo(x * x);
    }
  }

  public static void EigenSolve(double[] x, out double[] EigenValues, out Vector3d[] EigenVectors)
  {
    double[,] matValues = new double[3, 3]{{x[0],x[1],x[2]},{x[3],x[4],x[5]},{x[6],x[7],x[8]}};
    double[,] OutMatValues = new double[3, 3];
    double[] OutVecValues = new double[3];
    Eigen eigenCalculate = new Eigen();

    eigenCalculate.eigen_decomposition(matValues, OutMatValues, OutVecValues);

    var EigenVectorsUnsorted = new Vector3d[3];

    if (eigenCalculate.calcDone)
    {
      EigenVectorsUnsorted[0] = new Vector3d(OutMatValues[0, 0], OutMatValues[1, 0], OutMatValues[2, 0]);
      EigenVectorsUnsorted[1] = new Vector3d(OutMatValues[0, 1], OutMatValues[1, 1], OutMatValues[2, 1]);
      EigenVectorsUnsorted[2] = new Vector3d(OutMatValues[0, 2], OutMatValues[1, 2], OutMatValues[2, 2]);
    }

    Array.Sort(OutVecValues, EigenVectorsUnsorted, new DescendingAbsoluteVals());
    EigenValues = OutVecValues;
    EigenVectors = EigenVectorsUnsorted;
  }


  public class Eigen
  {
    public bool startCalc = false;
    public bool calcDone = false;

    ///////////////////////////////
    //Eigen solver implementation
    ///////////////////////////////
    private static double hypot2(double x, double y)
    {
      return Math.Sqrt(x * x + y * y);
    }

    private static void tred2(double[,] V, double[] d, double[] e)
    {
      for (int j = 0; j < 3; j++)
      {
        d[j] = V[3 - 1, j];
      }

      for (int i = 3 - 1; i > 0; i--)
      {
        double scale = 0.0;
        double h = 0.0;

        for (int k = 0; k < i; k++)
        {
          scale = scale + Math.Abs(d[k]);
        }

        if (scale == 0.0)
        {
          e[i] = d[i - 1];
          for (int j = 0; j < i; j++)
          {
            d[j] = V[i - 1, j];
            V[i, j] = 0.0;
            V[j, i] = 0.0;
          }
        }
        else
        {
          for (int k = 0; k < i; k++)
          {
            d[k] /= scale;
            h += d[k] * d[k];
          }

          double f = d[i - 1];
          double g = Math.Sqrt(h);

          if (f > 0)
          {
            g = -g;
          }

          e[i] = scale * g;
          h = h - f * g;
          d[i - 1] = f - g;

          for (int j = 0; j < i; j++)
          {
            e[j] = 0.0;
          }

          for (int j = 0; j < i; j++)
          {
            f = d[j];
            V[j, i] = f;
            g = e[j] + V[j, j] * f;

            for (int k = j + 1; k <= i - 1; k++)
            {
              g += V[k, j] * d[k];
              e[k] += V[k, j] * f;
            }

            e[j] = g;
          }

          f = 0.0;

          for (int j = 0; j < i; j++)
          {
            e[j] /= h;
            f += e[j] * d[j];
          }

          double hh = f / (h + h);

          for (int j = 0; j < i; j++)
          {
            e[j] -= hh * d[j];
          }

          for (int j = 0; j < i; j++)
          {
            f = d[j];
            g = e[j];

            for (int k = j; k <= i - 1; k++)
            {
              V[k, j] -= (f * e[k] + g * d[k]);
            }

            d[j] = V[i - 1, j];
            V[i, j] = 0.0;
          }
        }
        d[i] = h;
      }

      for (int i = 0; i < 3 - 1; i++)
      {
        V[3 - 1, i] = V[i, i];
        V[i, i] = 1.0;

        double h = d[i + 1];

        if (h != 0.0)
        {
          for (int k = 0; k <= i; k++)
          {
            d[k] = V[k, i + 1] / h;
          }
          for (int j = 0; j <= i; j++)
          {
            double g = 0.0;

            for (int k = 0; k <= i; k++)
            {
              g += V[k, i + 1] * V[k, j];
            }
            for (int k = 0; k <= i; k++)
            {
              V[k, j] -= g * d[k];
            }
          }
        }
        for (int k = 0; k <= i; k++)
        {
          V[k, i + 1] = 0.0;
        }
      }
      for (int j = 0; j < 3; j++)
      {
        d[j] = V[3 - 1, j];
        V[3 - 1, j] = 0.0;
      }

      V[3 - 1, 3 - 1] = 1.0;
      e[0] = 0.0;
    }

    static void tql2(double[,] V, double[] d, double[] e)
    {
      for (int i = 1; i < 3; i++)
      {
        e[i - 1] = e[i];
      }
      e[3 - 1] = 0.0;

      double f = 0.0;
      double tst1 = 0.0;
      double eps = Math.Pow(2.0, -52.0);
      for (int l = 0; l < 3; l++)
      {
        tst1 = Math.Max(tst1, Math.Abs(d[l]) + Math.Abs(e[l]));
        int m = l;

        while (m < 3)//not in original code, was m < 3!!!
        {
          if (Math.Abs(e[m]) <= eps * tst1)
          {
            break;
          }
          m++;
        }

        if (m > l)
        {
          int iter = 0;
          do
          {
            iter = iter + 1;

            double g = d[l];
            double p = (d[l + 1] - g) / (2.0 * e[l]);
            double r = hypot2(p, 1.0);

            if (p < 0)
            {
              r = -r;
            }

            d[l] = e[l] / (p + r);
            d[l + 1] = e[l] * (p + r);

            double dl1 = d[l + 1];
            double h = g - d[l];

            for (int i = l + 2; i < 3; i++)
            {
              d[i] -= h;
            }

            f = f + h;
            p = d[m];

            double c = 1.0;
            double c2 = c;
            double c3 = c;
            double el1 = e[l + 1];
            double s = 0.0;
            double s2 = 0.0;

            for (int i = m - 1; i >= l; i--)
            {
              c3 = c2;
              c2 = c;
              s2 = s;
              g = c * e[i];
              h = c * p;
              r = hypot2(p, e[i]);
              e[i + 1] = s * r;
              s = e[i] / r;
              c = p / r;
              p = c * d[i] - s * g;
              d[i + 1] = h + s * (c * g + s * d[i]);

              for (int k = 0; k < 3; k++)
              {
                h = V[k, i + 1];
                V[k, i + 1] = s * V[k, i] + c * h;
                V[k, i] = c * V[k, i] - s * h;
              }
            }

            p = -s * s2 * c3 * el1 * e[l] / dl1;
            e[l] = s * p;
            d[l] = c * p;
          } while (Math.Abs(e[l]) > eps * tst1);
        }

        d[l] = d[l] + f;
        e[l] = 0.0;
      }

      for (int i = 0; i < 3 - 1; i++)
      {
        int k = i;
        double p = d[i];

        for (int j = i + 1; j < 3; j++)
        {
          if (d[j] < p)
          {
            k = j;
            p = d[j];
          }
        }
        if (k != i)
        {
          d[k] = d[i];
          d[i] = p;

          for (int j = 0; j < 3; j++)
          {
            p = V[j, i];
            V[j, i] = V[j, k];
            V[j, k] = p;
          }
        }
      }
    }

    public void eigen_decomposition(double[,] A, double[,] V, double[] d)
    {
      double[] e = new double[3];
      for (int i = 0; i < 3; i++)
      {
        for (int j = 0; j < 3; j++)
        {
          V[i, j] = A[i, j];
        }
      }
      tred2(V, d, e);
      tql2(V, d, e);

      calcDone = true;
    }

  }

  //public static Color ColorAt(Mesh mesh, int faceIndex, double t0, double t1, double t2, double t3)
  //{
  //  // int rc = -1;
  //  var color = Rhino.Display.Color4f.Black;
  //
  //  if( mesh.VertexColors.Count != 0)
  //  {
  //    // test to see if face exists
  //    if( faceIndex >= 0 && faceIndex < mesh.Faces.Count )
  //    {
  //      /// Barycentric quad coordinates for the point on the mesh
  //      /// face mesh.Faces[FaceIndex].
  //
  //      /// If the face is a triangle
  //      /// disregard T[3] (it should be set to 0.0).
  //
  //      /// If the face is
  //      /// a quad and is split between vertexes 0 and 2, then T[3]
  //      /// will be 0.0 when point is on the triangle defined by vi[0],
  //      /// vi[1], vi[2]
  //
  //      /// T[1] will be 0.0 when point is on the
  //      /// triangle defined by vi[0], vi[2], vi[3].
  //
  //      /// If the face is a
  //      /// quad and is split between vertexes 1 and 3, then T[2] will
  //      /// be -1 when point is on the triangle defined by vi[0],
  //      /// vi[1], vi[3]
  //
  //      /// and m_t[0] will be -1 when point is on the
  //      /// triangle defined by vi[1], vi[2], vi[3].
  //
  //      MeshFace face = mesh.Faces[faceIndex];
  //
  //      // Collect data for barycentric evaluation.
  //      Color p0, p1, p2;
  //
  //      if(face.IsTriangle)
  //      {
  //        p0 = mesh.VertexColors[face.A];
  //        p1 = mesh.VertexColors[face.B];
  //        p2 = mesh.VertexColors[face.C];
  //      }
  //      else
  //      {
  //        if( t3 == 0 )
  //        { // point is on subtriangle {0,1,2}
  //          p0 = mesh.VertexColors[face.A];
  //          p1 = mesh.VertexColors[face.B];
  //          p2 = mesh.VertexColors[face.C];
  //        }
  //        else if( t1 == 0 )
  //        { // point is on subtriangle {0,2,3}
  //          p0 = mesh.VertexColors[face.A];
  //          p1 = mesh.VertexColors[face.C];
  //          p2 = mesh.VertexColors[face.D];
  //          //t0 = t0;
  //          t1 = t2;
  //          t2 = t3;
  //        }
  //        else if( t2 == -1 )
  //        { // point is on subtriangle {0,1,3}
  //          p0 = mesh.VertexColors[face.A];
  //          p1 = mesh.VertexColors[face.B];
  //          p2 = mesh.VertexColors[face.D];
  //          //t0 = t0;
  //          //t1 = t1;
  //          t2 = t3;
  //        }
  //        else
  //        { // point must be on remaining subtriangle {1,2,3}
  //          p0 = mesh.VertexColors[face.B];
  //          p1 = mesh.VertexColors[face.C];
  //          p2 = mesh.VertexColors[face.D];
  //          t0 = t1;
  //          t1 = t2;
  //          t2 = t3;
  //        }
  //      }
  //
  ///**
  //        double r = t0 * p0.FractionRed() + t1 * p1.FractionRed() + t2 * p2.FractionRed();
  //        double g = t0 * p0.FractionGreen() + t1 * p1.FractionGreen() + t2 * p2.FractionGreen();
  //       double b = t0 * p0.FractionBlue() + t1 * p1.FractionBlue() + t2 * p2.FractionBlue();
  //
  //        ON_Color color;
  //        color.SetFractionalRGB(r, g, b);
  //
  //        unsigned int abgr = (unsigned int)color;
  //        rc = (int) ABGR_to_ARGB(abgr);
  //
  //    var c0 = new Rhino.Display.Color4f(p0);
  //    var c1 = new Rhino.Display.Color4f(p1);
  //    var c2 = new Rhino.Display.Color4f(p2);
  //    float s0 = (float) t0;
  //    float s1 = (float) t1;
  //    float s2 = (float) t2;
  //
  //    float R = s0 * c0.R + s1 * c1.R + s2 * c2.R;
  //    float G = s0 * c0.G + s1 * c1.G + s2 * c2.G;
  //    float B = s0 * c0.B + s1 * c1.B + s2 * c2.B;
  //    color = new Rhino.Display.Color4f(R, G, B, 1);
  //  }
  //}
  //  return color.AsSystemColor();
  //}
  //
  //public static Color ColorAt(Mesh mesh, MeshPoint meshPoint)
  //{
  //  return ColorAt(mesh, meshPoint.FaceIndex, meshPoint.T[0], meshPoint.T[1], meshPoint.T[2], meshPoint.T[3]);
  //}
  //
  //public class Align : GoalObject
  //{
  //  public double Strength;
  //  public List<Vector3d> Vec;
  //
  //  public Align(int ea, int eb, Vector3d[] _Vec, double k)
  //  {
  //    PIndex = new int[2]{ea,eb};
  //    Move = new Vector3d[2];
  //    Weighting = new double[2]{k,k};
  //    Vec = _Vec.ToList();
  //    Strength = k;
  //  }
  //
  //  public override void Calculate(List<KangarooSolver.Particle> p)
  //  {
  //    Point3d p0 = p[PIndex[0]].Position;
  //    Point3d p1 = p[PIndex[1]].Position;
  //    var EdgeVec = new Vector3d();
  //    EdgeVec = p1 - p0;
  //
  //    double AngleX = Vector3d.VectorAngle(Vec[0], EdgeVec);
  //    double AngleY = Vector3d.VectorAngle(Vec[1], EdgeVec);
  //    double AngleZ = Vector3d.VectorAngle(Vec[2], EdgeVec);
  //    double AngleNX = Vector3d.VectorAngle(-Vec[0], EdgeVec);
  //    double AngleNY = Vector3d.VectorAngle(-Vec[1], EdgeVec);
  //    double AngleNZ = Vector3d.VectorAngle(-Vec[2], EdgeVec);
  //
  //    double lowest = AngleX;
  //    Vector3d TargetDir = Vec[0];
  //
  //    if (AngleY < lowest)
  //    {
  //      TargetDir = Vec[1];
  //      lowest = AngleY;
  //    }
  //
  //    if (AngleZ < lowest)
  //    {
  //      TargetDir = Vec[2];
  //      lowest = AngleZ;
  //    }
  //
  //    if (AngleNX < lowest)
  //    {
  //      TargetDir = -Vec[0];
  //      lowest = AngleNX;
  //    }
  //    if (AngleNY < lowest)
  //    {
  //      TargetDir = -Vec[1];
  //      lowest = AngleNY;
  //    }
  //    if (AngleNZ < lowest)
  //    {
  //      TargetDir = -Vec[2];
  //    }
  //
  //    Vector3d V = EdgeVec;
  //    Vector3d Dir = TargetDir;
  //
  //    Vector3d To = (V - (V * Dir) * Dir) * 0.5;
  //
  //    Move[0] = To;
  //    Move[1] = -To;
  //
  //    if(!Dir.IsZero && lowest < Math.PI / 9)
  //    {
  //      Weighting[0] = Strength;
  //      Weighting[1] = Strength;
  //    }
  //    else
  //    {
  //      Weighting[0] = 0;
  //      Weighting[1] = 0;
  //    }
  //  }
  //}
  //
  //
  //public class NonLinearRepel : GoalObject
  //{
  //  public int Exponent;
  //  public double Length;
  //  public double Multiplier;
  //  public double Stiffness;
  //
  //  public NonLinearRepel(int Pt0, int Pt1, double Len, double Mult, double k, int q)
  //  {
  //
  //    PIndex = new int[2]{Pt0,Pt1};
  //    Move = new Vector3d[2];
  //    Weighting = new double[2]{k,k};
  //    Exponent = q;
  //    Length = Len;
  //    Multiplier = Mult;
  //    Stiffness = k;
  //  }
  //
  //  public override void Calculate(List<KangarooSolver.Particle> p)
  //  {
  //    Vector3d Current = p[PIndex[1]].Position - p[PIndex[0]].Position;
  //
  //    double CurrentLength = Current.Length;
  //    double Overlap = Length - CurrentLength;
  //    Current.Unitize();
  //
  //    if(Overlap > 0)
  //    {
  //      Move[0] = -0.5 * Current * Overlap;
  //      Move[1] = 0.5 * Current * Overlap;
  //
  //      Weighting[0] = Weighting[1] =
  //        //  Stiffness * (Math.Pow(CurrentLength * Multiplier, Exponent) - Math.Pow(Length * Multiplier, Exponent));
  //        Stiffness * Math.Pow((Length - Overlap) * Multiplier, Exponent);
  //    }
  //    else
  //    {
  //      Weighting[0] = Weighting[1] = 0;
  //    }
  //
  //  }
  //
  //  public override object Output(List<KangarooSolver.Particle> p)
  //  {
  //    Line L = new Line(p[PIndex[0]].Position, p[PIndex[1]].Position);
  //    return L;
  //  }
  //}
  //  */
  //
# ---------- end simple_filter_by_valence ----------
crv = Curve(simple_filter_by_valence.F1)
crv_2 = Curve(simple_filter_by_valence.F3)
crv_3 = Curve(simple_filter_by_valence.F4)
crv_4 = Curve(simple_filter_by_valence.F0)
crv_5 = Curve(simple_filter_by_valence.F2)
crv_6 = Curve(simple_filter_by_valence.F5)

crv_7 = Curve([crv_6, crv_3, crv_2, crv_5, crv_4, crv])

# ==== cluster Colourful: Display objects in bright colours
geo = ClusterInput()
geo_2 = Geometry(geo)
clean = CleanTree(RemoveNulls=True, RemoveInvalid=True, RemoveEmpty=False, Tree=flatten(geo_2))
S = Shader([{ambient=RGB(128, 128, 128), diffuse=RGB(11, 125, 222), emission=RGB(3, 38, 67), shine=0.5, specular=RGB(255, 255, 255), transparency=0}, {ambient=RGB(128, 128, 128), diffuse=RGB(222, 37, 11), emission=RGB(67, 11, 3), shine=0.5, specular=RGB(255, 255, 255), transparency=0}, {ambient=RGB(128, 128, 128), diffuse=RGB(71, 222, 11), emission=RGB(21, 67, 3), shine=0.5, specular=RGB(255, 255, 255), transparency=0}, {ambient=RGB(128, 128, 128), diffuse=RGB(222, 194, 11), emission=RGB(67, 58, 3), shine=0.5, specular=RGB(255, 255, 255), transparency=0}])
lng = ListLength(List=clean)
repeat = RepeatData(Data=S, Length=lng)
preview = CustomPreview(Geometry=clean, Shader=repeat)

# ==== cluster VisualiseEllipsoids
pts = ClusterInput()
longaxes = ClusterInput()
shortaxes = ClusterInput()
ellipsoid_transforms = CSharpScript(Pts=pts, longAxes=longaxes, shortAxes=shortaxes)  # -> out, A; inputs Pts: list of Point3d, longAxes: list of Vector3d, shortAxes: list of Vector3d
# ---------- ellipsoid_transforms: C# ----------
    int count = Pts.Count();

    List<Transform> transforms = new List<Transform>();

    for(int i = 0; i < count; i++){
      Transform t = new Transform(1.0);

      t.M03 = Pts[i].X;
      t.M13 = Pts[i].Y;
      t.M23 = Pts[i].Z;

      t.M00 = longAxes[i][0];
      t.M10 = longAxes[i][1];
      t.M20 = longAxes[i][2];

      t.M01 = shortAxes[i][0];
      t.M11 = shortAxes[i][1];
      t.M21 = shortAxes[i][2];

      double la = longAxes[i].Length;
      double sa = shortAxes[i].Length;
      Vector3d xprod = Vector3d.CrossProduct(longAxes[i], shortAxes[i]);
      xprod.Unitize();

      t.M02 = sa * xprod[0];
      t.M12 = sa * xprod[1];
      t.M22 = sa * xprod[2];

      transforms.Add(t);
    }
    A = transforms;
# ---------- end ellipsoid_transforms ----------
msphere = MeshSphere(Base=PlaneXY(0, 0, 0), Radius=1, UCount=9, VCount=12)
transform = Transform(Geometry=msphere, Transform=ellipsoid_transforms.A)
G = ClusterOutput(transform)

# ==== cluster ShiftX
C = ClusterInput()
bbox = BoundingBox(Content=C, Plane=PlaneXY(0, 0, 0))  # -> Box, Box_2
boxprop = BoxProperties(Box=bbox.Box)  # -> Center, Diagonal, Area, Volume, Degeneracy
devec = DeconstructVector(Vector=boxprop.Diagonal)  # -> XComponent, YComponent, ZComponent
multiplication = Multiplication(A=devec.XComponent, B=2)
vec = VectorXYZ(XComponent=multiplication, YComponent=0, ZComponent=0)  # -> Vector, Length
G = ClusterInput()
move = Move(Geometry=G, Motion=vec.Vector)  # -> Geometry, Transform
G_2 = ClusterOutput(move.Geometry)
