# Grasshopper definition some-examples.gh (Grasshopper 0.9.76)
# plug-ins: MechanoAdaptiveGeneration

panel = Panel("""0
1
2
3
4
5
6
7
8""")  # disabled
file = ReadFile(File="S:\03_Projects\_ResearchProjects\Z0011_AlessandroPhD\Mars-space-frames\mars-dome.csv", PerLineParse=True)  # disabled
split = TextSplit(Text=file, Separators=",")  # disabled
item = ListItem(List=split, Index=panel, Wrap=True)  # disabled
panel_2 = Panel(file)  # disabled
c_script = CSharpScript(x=item)  # -> out, A; inputs x: Double; disabled
# ---------- c_script: C# ----------
    if (x > 1E100 || x < -1E100){A = double.NaN;}
    else
    {A = x;}
# ---------- end c_script ----------
item_2 = ListItem(List=file, Index=0, Wrap=True)  # -> Item, Item1, Item2, Item3, Item4; disabled
item_3 = ListItem(List=item, Index=0, Wrap=True)  # -> Item, Item1, Item2; disabled
item_4 = ListItem(List=flatten(item_2.Item4), Index=1000, Wrap=True)  # disabled
pt = ConstructPoint(XCoordinate=item_3.Item, YCoordinate=item_3.Item1, ZCoordinate=item_3.Item2)  # disabled

# ----
# Mars Dome
mesh = Mesh(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)  # disabled
data = Data(["-0.1450038821588526", "0.0025000009782820114", "-0.14500796234398244", "NaN", "NaN", "NaN"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])  # disabled

# ----
# ThickBeamTopSideLoaded
mesh_2 = Mesh(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)  # disabled
data_2 = Data(["0.010000,0.0055000,0.019000,-38.881,-2.2329,-76.967,-4.7933,8.8266,-171.33,-0.65989,0.67596,0.32806,0.62580,0.73610,-0.25793,0.41584,-0.035095,0.90876,1.6703,-9.7846,-206.89", "0.010000,0.0055000,0.057000,-1.9799,-0.40025,-14.752,-0.10203,0.91814,-63.887,-0.91767,0.33637,0.21154,0.33061,0.94165,-0.063107,0.22042,-0.012025,0.97533,1.5673,-0.30409,-67.232", "0.010000,0.0055000,0.095000,-0.37133,-0.12015,-6.2695,0.15665,0.14786,-32.498,-0.96104,0.20834,0.18166,0.20541,0.97805,-0.035041,0.18497,-0.0036378,0.98274,0.83978,0.12612,-33.679", "0.010000,0.0055000,0.13300,-0.46533,-0.076190,-2.7145,-4.6075E-4,-0.065387,-16.801,0.62629,-0.77342,-0.097871,0.76305,0.63387,-0.12635,0.15976,0.0044500,0.98715,0.052961,-0.079144,-17.241", "0.010000,0.0055000,0.17100,-0.26802,0.030497,0.081334,-0.011776,-0.16561,-10.392,0.11096,0.99371,-0.014976,0.99379,-0.11082,0.0097995,-0.0080782,0.015971,0.99984,-0.0058750,-0.27062,-10.395", "0.010000,0.016500,0.019000,-27.663,2.1162,-76.177,-0.54210,4.6626,-146.78,-0.89862,0.014266,0.43850,0.025044,0.99951,0.018804,0.43802,-0.027879,0.89853,9.4755,-0.40136,-184.06"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])  # disabled

scale = Scale(Geometry=mesh, Center=Point(0, 0, 0), Factor=0.0002)  # -> Geometry, Transform; disabled

# ----
# sphere in axial tension
data_3 = Data(["-0.9333333333333333,-0.9333333333333333,-0.9333333333333333,NaN,NaN,NaN,NaN,NaN,NaN,NaN,NaN,NaN,NaN,NaN,NaN,NaN,NaN,NaN,NaN,NaN,NaN", "-0.9333333333333333,-0.9333333333333333,-0.8,NaN,NaN,NaN,NaN,NaN,NaN,NaN,NaN,NaN,NaN,NaN,NaN,NaN,NaN,NaN,NaN,NaN,NaN", "-0.9333333333333333,-0.9333333333333333,-0.6666666666666667,NaN,NaN,NaN,NaN,NaN,NaN,NaN,NaN,NaN,NaN,NaN,NaN,NaN,NaN,NaN,NaN,NaN,NaN", "-0.9333333333333333,-0.9333333333333333,-0.5333333333333332,NaN,NaN,NaN,NaN,NaN,NaN,NaN,NaN,NaN,NaN,NaN,NaN,NaN,NaN,NaN,NaN,NaN,NaN", "-0.9333333333333333,-0.9333333333333333,-0.39999999999999997,NaN,NaN,NaN,NaN,NaN,NaN,NaN,NaN,NaN,NaN,NaN,NaN,NaN,NaN,NaN,NaN,NaN,NaN", "-0.9333333333333333,-0.9333333333333333,-0.26666666666666666,NaN,NaN,NaN,NaN,NaN,NaN,NaN,NaN,NaN,NaN,NaN,NaN,NaN,NaN,NaN,NaN,NaN,NaN"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])
mesh_3 = Mesh(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)

# ----
# Wind load from small side
mesh_4 = Mesh(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)  # disabled
data_4 = Data(["0,0,0,-0.05504522241871722,-0.019803007812178298,-0.042038389061928735,-0.047706874302755865,-0.05002531941308158,-0.20605539245675047,0.44862316300270333,-0.8821814450701903,0.14315430692550302,0.8578102534187177,0.38008798377881614,-0.345969209203175,0.25079638503607965,0.27800903323601894,0.9272605624591228,-0.029518520851616766,-0.04686497173987779,-0.232423996586729", "0.030976999999999998,0,0,-0.10965109179996732,0,-0.01330082139262112,-0.10965109179996732,-0.08590944078290423,-0.2558525475332571,0.1386997124710768,0.8958555553381257,-0.4221435937335289,0.9882260556440794,-0.1530008592987143,0,0.06458833258867726,0.41717329855070184,0.9065289770711917,-0.06916898522415335,-0.10965109179996732,-0.296334654109071", "0.06195300000000001,0,0,-0.10232918006728604,0,-7.425327721913527E-4,-0.10232918006728604,-0.0780926227846123,-0.23876808682366743,0.00865659848606746,0.9104197221831186,-0.41359520398895416,0.9999547986098166,-0.00950793022697783,0,0.003932434341739639,0.41357650891076075,0.9104608762804339,-0.06685242856064665,-0.10232918006728604,-0.27424483833030683", "0.09293000000000001,0,0,-0.10926628636207196,0,0.013237045509938124,-0.10926628636207196,-0.0806597099254104,-0.2549546681781679,-0.1477738113587423,0.9004571865995031,-0.40907182227308003,0.9868000294540836,0.1619435144407448,0,-0.06624652855758233,0.403672086267911,0.9125021886122694,-0.07262310663710275,-0.10926628636207196,-0.29159784790313703", "0.123907,0,0,-0.07987221113158625,0,0.03519201244522081,-0.07987221113158625,-0.047803003761634176,-0.18636849264036795,-0.5413777620507927,0.7353794624863419,-0.4075870028719928,0.8053072032465344,0.5928577471866627,0,-0.24164111230525348,0.32823274936248165,0.913166378646206,-0.05337720545709078,-0.07987221113158625,-0.21286349831486343", "0,0.031303,0,-0.0500710008514603,0,-0.031282106665178964,-0.0500710008514603,-0.03472609244347776,-0.11683233532007405,0.5951142192279052,0.6606329814206615,-0.45760586745802173,0.7429895512528564,-0.6693030156282572,0,0.30627698705883855,0.3399963781133095,0.8891551439810668,-0.02601700399854432,-0.0500710008514603,-0.14088633217299001"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])  # disabled

# ----
# Generate points in BB
# and only use those
# strictly inside the mesh
number_slider = Slider(5000, range=1..100000)
mesh_5 = Mesh(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)
seed = Number(17)
pop3d = Populate3D(Region=mesh_5, Count=number_slider, Seed=seed)
checkinside = CSharpScript(mesh=mesh_5, pts=pop3d)  # -> out, ptsInside; inputs mesh: Mesh, pts: list of Point3d
# ---------- checkinside: C# ----------
    List<Point3d> inside = new List<Point3d>();  
    for(int i = 0;i < pts.Count();i++)
      if(mesh.IsPointInside(pts[i], 0.0, true))
      {
        inside.Add(pts[i]);
      }
    ptsInside = inside;
# ---------- end checkinside ----------
pt_2 = Point(flatten(checkinside.ptsInside))

demesh = DeconstructMesh(Mesh=mesh_5)  # -> Vertices, Faces, Colours, Normals

# ----
# Isolate required data:
# Pts + Tensor components
split_2 = TextSplit(Text=data_3, Separators=",")  # disabled
split_3 = SplitList(List=split_2, Index=9)  # -> simplify(flatten(ListA)), ListB; disabled

panel_3 = Panel("""minLongAxisLength
maxLongAxisLength
minSlenderness
maxRadiusCoefficient
initialScaleEllipsoids
alignStrength
targetPressure
EdgeLengthFactor
plasticDrag""")  # disabled
item_5 = ListItem(List=demesh.Vertices, Index=[0, 1, 2, 3, 4, 5, 6, 7], Wrap=True)
num = Number(split_3.ListA)  # disabled
panel_4 = Panel("""1
2
1
2
10
0
3000
1
0""")  # disabled
entwine = Entwine(Branch00=item_5, Branch01=pt_2, FlattenInputs=True)  # -> flatten(Result)
# Mechano-adaptive space frame generator
mesh_6 = Mesh(mesh_5)
pl_offset = PlaneOffset(BasePlane=PlaneXY(0, 0, 0), Offset=0.75)
panel_5 = Panel("""minLongAxisLength
maxLongAxisLength
minSlenderness
alignStrength
plasticDrag""")
rectangle = Rectangle(Plane=pl_offset, XSize=Domain(0, 50), YSize=Domain(0, 50), Radius=0)  # -> Rectangle, Length
number_slider_2 = Slider(1, range=0..1)
stress_field_input_data = Data(simplify(flatten([-0.9333333333, -0.9333333333, -0.9333333333, nan, nan, nan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])))
button = Button()
toggle = BooleanToggle(True)
int = Integer(1)
mplane = MeshPlane(Boundary=rectangle.Rectangle, WidthCount=10, HeightCount=10)  # -> Mesh, Area
volumefactor = Slider(5, range=1..20)
panel_6 = Panel("""0.2
1
0.6
0
0.01""")
sphere_fixed_point_indices = Integer([0, 871])
box_fixed_point_indices = Integer([0, 1, 2, 3, 4, 5, 6, 7, 8])
generatescriptable = CSharpScript(
    RESET=button,
    STEP=toggle,
    M=mesh_6,
    P=entwine,
    D=stress_field_input_data,
    FP=int,
    Reference="C:\USERS\AFELDER\DESKTOP\MECHANOADAPTIVEGENERATION-MASTER\src\MechanoAdaptiveGeneration\bin\MechanoAdaptiveGeneration.dll")  # -> out, A, B, C, L; inputs RESET: Boolean, STEP: Boolean, M: Mesh, S: Mesh, P: list of Point3d, D: list of Double, FP: list of Int32; disabled
# ---------- generatescriptable: C# ----------
    MechanoAdaptiveGeneration.InputGeometryParameters IGP = new MechanoAdaptiveGeneration.InputGeometryParameters(M, S, P, D);

    double plasticDragDist = 0.001;
    double volumeFactor = 2.0;
    double alignStrength = 10.0;
    double boundaryCollideStrength = 10000;
    MechanoAdaptiveGeneration.KangarooGoalParameters KGP = new MechanoAdaptiveGeneration.KangarooGoalParameters(plasticDragDist, boundaryCollideStrength, alignStrength, FP);

    double minLA = 0.5;
    double maxLA = 1.0;
    double minSlender = 0.75;
    MechanoAdaptiveGeneration.EllipsoidParameters EP = new MechanoAdaptiveGeneration.EllipsoidParameters(minLA, maxLA, minSlender);

    int maxIterations = 1000;
    bool updateScale = true;
    MechanoAdaptiveGeneration.AlgorithmConvergenceParameters ACP = new MechanoAdaptiveGeneration.AlgorithmConvergenceParameters(volumeFactor, maxIterations, updateScale);
    
    if(RESET)
    {
      Gen = new MechanoAdaptiveGeneration.Generator();
      Gen.Initialize(IGP, KGP, EP, ACP);
    }

    if(STEP)
    {
      Gen.Step(KGP, EP, ACP);
    }

    A = Gen.GetCentres();
    B = Gen.GetLongAxes();
    C = Gen.GetShortAxes();

    L = Gen.GetLines();
# ---------- generatescriptable: C# additional code ----------
  MechanoAdaptiveGeneration.Generator Gen = new MechanoAdaptiveGeneration.Generator();
# ---------- end generatescriptable ----------
panel_7 = Panel(generatescriptable.out)
generate = MechanoAdaptiveGeneration(Rst=button, R=toggle, M=mesh_6, P=pt_2, D=stress_field_input_data, FP=int, O=panel_6, VF=volumefactor)  # -> EllipsoidCentres, LongAxes, ShortAxes, PercentVolumePacked, Iterations, Lines, Bake, RecentErrors
timer = Timer(TimerInterval=50, Target=generate)  # disabled
timer_2 = Timer(TimerInterval=50, Target=generatescriptable)  # disabled
pt_3 = Point(generate.EllipsoidCentres)
line = Line(generatescriptable.L)
line_2 = Line(generate.Lines)
pt_4 = Point(generatescriptable.A)
pipe = Pipe(Curve=line, Radius=0.001, Caps=0)  # disabled
pipe_2 = Pipe(Curve=line_2, Radius=0.001, Caps=0)  # disabled
mesh_7 = Mesh(pipe)  # disabled
mesh_8 = Mesh(pipe_2)  # disabled
visualiseellipsoids = VisualiseEllipsoids(pts=generate.EllipsoidCentres, longaxes=generate.LongAxes, shortaxes=generate.ShortAxes)
visualiseellipsoids_2 = VisualiseEllipsoids(pts=generatescriptable.A, longaxes=generatescriptable.B, shortaxes=generatescriptable.C)
preview = CustomPreview(
    Geometry=visualiseellipsoids,
    Shader={ambient=RGB(128, 128, 128), diffuse=RGB(255, 105, 180), emission=RGB(76, 32, 54), shine=0.5, specular=RGB(255, 255, 255), transparency=0.8})
colourful = Colourful(geo=visualiseellipsoids_2)
light_grey = LightGrey(geo=visualiseellipsoids_2)  # disabled
colourful_2 = Colourful(geo=visualiseellipsoids)
light_grey_2 = LightGrey(geo=visualiseellipsoids)

# ==== cluster Colourful: Display objects in bright colours
geo = ClusterInput()
geo_2 = Geometry(geo)
clean = CleanTree(RemoveNulls=True, RemoveInvalid=True, RemoveEmpty=False, Tree=flatten(geo_2))
S = Shader([{ambient=RGB(128, 128, 128), diffuse=RGB(11, 125, 222), emission=RGB(3, 38, 67), shine=0.5, specular=RGB(255, 255, 255), transparency=0}, {ambient=RGB(128, 128, 128), diffuse=RGB(222, 37, 11), emission=RGB(67, 11, 3), shine=0.5, specular=RGB(255, 255, 255), transparency=0}, {ambient=RGB(128, 128, 128), diffuse=RGB(71, 222, 11), emission=RGB(21, 67, 3), shine=0.5, specular=RGB(255, 255, 255), transparency=0}, {ambient=RGB(128, 128, 128), diffuse=RGB(222, 194, 11), emission=RGB(67, 58, 3), shine=0.5, specular=RGB(255, 255, 255), transparency=0}])
lng = ListLength(List=clean)
repeat = RepeatData(Data=S, Length=lng)
preview = CustomPreview(Geometry=clean, Shader=repeat)

# ==== cluster LightGrey
geo = ClusterInput()
geo_2 = Geometry(geo)
clean = CleanTree(RemoveNulls=True, RemoveInvalid=True, RemoveEmpty=False, Tree=flatten(geo_2))
S = Shader({ambient=RGB(128, 128, 128), diffuse=RGB(224, 224, 224), emission=RGB(0, 0, 0), shine=0.5, specular=RGB(255, 255, 255), transparency=0})
preview = CustomPreview(Geometry=clean, Shader=S)

# ==== cluster VisualiseEllipsoids
pts = ClusterInput()
longaxes = ClusterInput()
shortaxes = ClusterInput()
ellipsoid_transforms = CSharpScript(Pts=pts, longAxes=longaxes, shortAxes=shortaxes)  # -> out, A; inputs Pts: list of Point3d, longAxes: list of Vector3d, shortAxes: list of Vector3d
# ---------- ellipsoid_transforms: C# ----------
    int count = Pts.Count();

    List<Transform> transforms = new List<Transform>();

    for(int i = 0; i < count; i++){
      Transform t = new Transform(1.0);

      t.M03 = Pts[i].X;
      t.M13 = Pts[i].Y;
      t.M23 = Pts[i].Z;

      t.M00 = longAxes[i][0];
      t.M10 = longAxes[i][1];
      t.M20 = longAxes[i][2];

      t.M01 = shortAxes[i][0];
      t.M11 = shortAxes[i][1];
      t.M21 = shortAxes[i][2];

      double la = longAxes[i].Length;
      double sa = shortAxes[i].Length;
      Vector3d xprod = Vector3d.CrossProduct(longAxes[i], shortAxes[i]);
      xprod.Unitize();

      t.M02 = sa * xprod[0];
      t.M12 = sa * xprod[1];
      t.M22 = sa * xprod[2];

      transforms.Add(t);
    }
    A = transforms;
# ---------- end ellipsoid_transforms ----------
msphere = MeshSphere(Base=PlaneXY(0, 0, 0), Radius=1, UCount=9, VCount=12)
transform = Transform(Geometry=msphere, Transform=ellipsoid_transforms.A)
G = ClusterOutput(transform)
