# Grasshopper definition testCompiledEqualsScriptable.gh (Grasshopper 0.9.76)
# plug-ins: Python Interpreter, Kangaroo Components, MechanoAdaptiveGeneration

panel = Panel("""0
1
2
3
4
5
7
8
11""")
file = ReadFile(File="S:\03_Projects\2567_OlympicSkating\Grasshopper\StressTensors_test01.txt", PerLineParse=True)
data = Data(["0.010000,0.0055000,0.019000,-33.985,6.1273,-74.866,6.7802,8.6062,-144.88,0.33874,0.93403,-0.11333,-0.82648,0.35295,0.43858,0.44964,-0.054897,0.89152,7.9581,3.1261,-183.17", "0.010000,0.0055000,0.057000,-3.8131,-1.9818,-10.405,-2.0576,-0.16268,-64.954,0.69512,-0.71045,-0.10982,0.70005,0.70370,-0.12138,0.16352,0.0074982,0.98651,-0.14367,-4.0010,-66.680", "0.010000,0.0055000,0.095000,-0.49774,-0.31453,-5.4769,-0.038960,-0.37715,-21.993,0.94613,-0.23498,-0.22277,-0.22422,-0.97182,0.072778,0.23359,0.018907,0.97215,0.86994,-0.083288,-23.317", "0.010000,0.0055000,0.13300,-0.55153,-0.15326,-2.0255,-0.035100,-0.37503,-5.5440,0.93935,-0.10623,-0.32608,-0.078848,-0.99224,0.096119,0.33376,0.064579,0.94044,0.16892,-0.010950,-6.2886", "0.010000,0.0055000,0.17100,-0.21257,-0.069656,0.78323,0.020687,-0.33216,0.38525,0.52255,-0.30061,0.79786,0.31511,0.93762,0.14688,-0.79224,0.17466,0.58468,1.0234,-0.054756,-0.77524", "0.010000,0.016500,0.019000,-38.076,-5.4811,-60.129,15.014,9.2438,-152.67,-0.24276,0.96026,0.13776,-0.88735,-0.27719,0.36847,0.39201,-0.032790,0.91938,17.726,-14.820,-178.64"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])
split = TextSplit(Text=file, Separators=",")

# ----
# Isolate required data:
# Pts + Tensor components
split_2 = TextSplit(Text=data, Separators=",")
split_3 = SplitList(List=split_2, Index=9)  # -> simplify(flatten(ListA)), ListB

item = ListItem(List=split, Index=panel, Wrap=True)
c_script = CSharpScript(x=item)  # -> out, A; inputs x: Double
# ---------- c_script: C# ----------
    if (x > 1E100 || x < -1E100){A = double.NaN;}
    else
    {A = x;}
# ---------- end c_script ----------
panel_2 = Panel(c_script.A)
item_2 = ListItem(List=c_script.A, Index=0, Wrap=True)  # -> Item, Item1, Item2, Item3, Item4
item_3 = ListItem(List=item, Index=0, Wrap=True)  # -> Item, Item1, Item2
item_4 = ListItem(List=flatten(item_2.Item4), Index=1000, Wrap=True)
pt = ConstructPoint(XCoordinate=item_3.Item, YCoordinate=item_3.Item1, ZCoordinate=item_3.Item2)
brep = Brep(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)

# ----
# Generate points in BB
# and only use those
# strictly inside the mesh
number_slider = Slider(200, range=1..10000)
mesh = Mesh(brep)
seed = Number(91)
pop3d = Populate3D(Region=mesh, Count=number_slider, Seed=seed)
checkinside = CSharpScript(mesh=mesh, pts=pop3d)  # -> out, ptsInside; inputs mesh: Mesh, pts: list of Point3d
# ---------- checkinside: C# ----------
    List<Point3d> inside = new List<Point3d>();  
    for(int i = 0;i < pts.Count();i++)
      if(mesh.IsPointInside(pts[i], 0.0, true))
      {
        inside.Add(pts[i]);
      }
    ptsInside = inside;
# ---------- end checkinside ----------
pt_2 = Point(flatten(checkinside.ptsInside))

panel_3 = Panel("""minLongAxisLength
maxLongAxisLength
minSlenderness
maxRadiusCoefficient
initialScaleEllipsoids
alignStrength
targetPressure
EdgeLengthFactor
plasticDrag""")
debrep = DeconstructBrep(Brep=brep)  # -> Faces, Edges, Vertices
lng = ListLength(List=debrep.Vertices)
panel_4 = Panel("""1
2
1
2
10
0
3000
1
0""")
series = Series(Start=0, Step=1, Count=lng)
entwine = Entwine(Branch00=debrep.Vertices, Branch01=pt_2, FlattenInputs=True)  # -> flatten(Result)
# Mechano-adaptive space frame generator
mesh_2 = Mesh(mesh)
data_2 = Data(series)
pl_offset = PlaneOffset(BasePlane=PlaneXY(0, 0, 0), Offset=0.75)
panel_5 = Panel("""minLongAxisLength
maxLongAxisLength
minSlenderness
alignStrength
plasticDrag""")
stress_field_input_data = Data(flatten(Tree({0;0;0}: [5.70710659, 10, 0, nan, nan, nan, nan, nan, nan], {0;0;1}: [6.20710659, 10, 0, -0.5654352541, -0.2588453169, 0.07978683269, -0.3496998542, 0.03548188617, -0.1245808704], {0;0;2}: [6.70710659, 10, 0, -0.2543207983, -0.07641002075, 0.0728532782, -0.05619087366, 0.01211136635, -0.04174689283], {0;0;3}: [7.20710659, 10, 0, -0.1410592635, -0.03959135264, 0.002779218648, -0.01215333103, 0.003894805079, -0.01518218431], {0;0;4}: [7.70710659, 10, 0, -0.09352793923, -0.02451854164, 0.008340972355, -0.004472041849, 0.002535711167, -0.008642909501], {0;0;5}: [8.20710659, 10, 0, -0.06561894537, -0.01691374695, 0.009797485049, -0.006940847291, 0.001645872532, -0.009526879487]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)))
rectangle = Rectangle(Plane=pl_offset, XSize=Domain(0, 50), YSize=Domain(0, 50), Radius=0)  # -> Rectangle, Length
int = Integer(data_2)
button = Button()
toggle = BooleanToggle(False)
volumefactor = Slider(5, range=0..5)
panel_6 = Panel("""0.2
1
0.4
0
0.001""")
mplane = MeshPlane(Boundary=rectangle.Rectangle, WidthCount=10, HeightCount=10)  # -> Mesh, Area
generatescriptable = CSharpScript(
    RESET=button,
    STEP=toggle,
    M=mesh_2,
    P=entwine,
    D=stress_field_input_data,
    FP=int,
    Reference="C:\Users\dpiker\Desktop\MechanoAdaptiveGeneration-master (1)\MechanoAdaptiveGeneration-master\src\MechanoAdaptiveGeneration\bin\MechanoAdaptiveGeneration.dll")  # -> out, A, B, C; inputs RESET: Boolean, STEP: Boolean, M: Mesh, S: Mesh, P: list of Point3d, D: list of Double, FP: list of Int32
# ---------- generatescriptable: C# ----------
    double minLA = 0.4;
    double maxLA = 1.0;
    double minSlender = 0.4;
    double plasticDragDist = 0.001;
    double volumeFactor = 5.0;
    double alignStrength = 0.0;

    if(RESET)
    {
      Gen = new MechanoAdaptiveGeneration.Generator();


      Gen.Initialize(M, S, P, D, 10000, true, plasticDragDist, 1000, alignStrength, FP, minLA, maxLA, minSlender, volumeFactor);

    }

    if(STEP)
    {
      //parameters: plasticDragDist, Boundarycollidestrength, minLA, maxLA, minSlender, maxRad, alignStrength, edgeLengthFactor, valenceFilter, updateScale
      Gen.Step(true, plasticDragDist, 100, alignStrength, minLA, maxLA, minSlender);
    }

    A = Gen.GetCentres();
    B = Gen.GetLongAxes();
    C = Gen.GetShortAxes();
# ---------- generatescriptable: C# additional code ----------
  MechanoAdaptiveGeneration.Generator Gen = new MechanoAdaptiveGeneration.Generator();
# ---------- end generatescriptable ----------
generate = MechanoAdaptiveGeneration(
    Rst=button,
    R=toggle,
    M=mesh_2,
    S=mplane.Mesh,
    P=entwine,
    D=stress_field_input_data,
    FP=data_2,
    O=panel_6,
    VF=volumefactor)  # -> EllipsoidCentres, LongAxes, ShortAxes, PercentVolumePacked, Iterations, Lines, Bake, RecentErrors; disabled
timer = Timer(TimerInterval=50, Target=generatescriptable)  # disabled
timer_2 = Timer(TimerInterval=50, Target=generate)  # disabled
shift_1_5_along_x = Shift15AlongX(G=generate.EllipsoidCentres, C=mesh_2)
visualiseellipsoids = VisualiseEllipsoids(pts=shift_1_5_along_x, longaxes=generate.LongAxes, shortaxes=generate.ShortAxes)
visualiseellipsoids_2 = VisualiseEllipsoids(pts=generatescriptable.A, longaxes=generatescriptable.B, shortaxes=generatescriptable.C)
colourful = Colourful(geo=visualiseellipsoids_2)
light_grey = LightGrey(geo=visualiseellipsoids_2)
colourful_2 = Colourful(geo=visualiseellipsoids)
light_grey_2 = LightGrey(geo=visualiseellipsoids)
mesh_3 = Mesh(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)  # disabled
pt_3 = Point([Point(6, 10, 0), Point(29, 10, 0), Point(29.00000121, 9.999998863, 1.000000005), Point(5.99999934, 9.99999974, 1.00000061), Point(30.00000118, 10.99999612, -8.252819678e-08), Point(30, 11, 1)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])  # disabled
meshcp = MeshClosestPoint(Point=pt_3, Mesh=mesh_3)  # -> Point, Index, Parameter; disabled
number_slider_2 = Slider(0.020316, range=0..0.1)  # disabled
subtraction = Subtraction(A=pt_3, B=meshcp.Point)  # disabled
# Needs Tetgen installed and in the path
vlen = VectorLength(Vector=subtraction)  # disabled
writenodefilewithbnd = PythonScript(points=pt_3, surfacePoints=meshcp.Point, distancesFromMesh=vlen, tol=number_slider_2)  # -> out, a, Pts, Tets; inputs points: list, surfacePoints: list, distancesFromMesh: list; disabled
# ---------- writenodefilewithbnd: Python ----------
import rhinoscriptsyntax as rs
import Rhino.Geometry as rg
import sys
from subprocess import Popen, PIPE

nInputPoints = len(points);

f = open('C:/Projects/0888_SpaceFrame/trunk/anisotropicDelaunay/Test/new3.node','w')
f.write(str(nInputPoints)+" 3 0 1\n")

print(nInputPoints)

bndPoints = [];

for i in range(nInputPoints):
    onBoundary=0;
    if(distancesFromMesh[i]<tol):
        onBoundary=1;
        bndPoints.append(points[i])
        f.write(str(i+1)+" "+str((rs.PointCoordinates(surfacePoints[i])[0]))+" "+str((rs.PointCoordinates(surfacePoints[i])[1]))+" "+str((rs.PointCoordinates(surfacePoints[i])[2]))+" "+str(onBoundary))
    else:
        f.write(str(i+1)+" "+str((rs.PointCoordinates(points[i])[0]))+" "+str((rs.PointCoordinates(points[i])[1]))+" "+str((rs.PointCoordinates(points[i])[2]))+" "+str(onBoundary))
    f.write("\n")
    
a = bndPoints

f.close();
p = Popen(["tetgen -S0O9\\0g C:/Projects/0888_SpaceFrame/trunk/anisotropicDelaunay/Test/new3.node"],shell=True, stdout=PIPE)

while True:
    data = p.stdout.readline()   # Alternatively proc.stdout.read(1024)
    if len(data) == 0:
        break
    sys.stdout.write(data)  
    
f = open('C:/Projects/0888_SpaceFrame/trunk/anisotropicDelaunay/Test/new3.1.mesh','r')
nLines = sum(1 for line in f)
f.seek(0,0)
print(nLines)
rawOutput = f.readlines()
lineNr=0
header=[]
while "Vertices" not in rawOutput[lineNr]:
        lineNr += 1
        header.append(rawOutput[lineNr])
        
print(header)
#output points
nPoints = int(rawOutput[lineNr+1])
lineNr += 1
print(nPoints)
points=rawOutput[lineNr+1:lineNr+nPoints+1]
Pts=[]
for i in range(nPoints):
    Pts.append(points[i][0:-1])
    lineNr+=1
    
#print(Pts)

#skip Tris and Edgs
skipped = []
while "Tetrahedra" not in rawOutput[lineNr]:
        lineNr += 1
        skipped.append(rawOutput[lineNr])
        
        
#print(skipped)
lineNr+=2
import re

#output tets
nCells=int(rawOutput[lineNr])
print(nCells)
lineNr += 1

cells=rawOutput[lineNr:lineNr+nCells]
Tts=[]
for i in range(nCells):
    tet = map(int,re.sub("[^\w]", " ",  cells[i]).split())
    tet = (tet[0],tet[1],tet[2],tet[3])
    Tts.append(tet)

Tets=Tts
print Tets[1:5]
f.close()
# ---------- end writenodefilewithbnd ----------
demesh = DeconstructMesh(Mesh=mesh_3)  # -> Vertices, Faces, Colours, Normals; disabled
duppt = RemoveDuplicatePts(Points=demesh.Vertices, Tolerance=0.01)  # disabled
pt_4 = Point(writenodefilewithbnd.a)  # disabled
data_3 = Data(["0,0,0,-0.05504522241871722,-0.019803007812178298,-0.042038389061928735,-0.047706874302755865,-0.05002531941308158,-0.20605539245675047,0.44862316300270333,-0.8821814450701903,0.14315430692550302,0.8578102534187177,0.38008798377881614,-0.345969209203175,0.25079638503607965,0.27800903323601894,0.9272605624591228,-0.029518520851616766,-0.04686497173987779,-0.232423996586729", "0.030976999999999998,0,0,-0.10965109179996732,0,-0.01330082139262112,-0.10965109179996732,-0.08590944078290423,-0.2558525475332571,0.1386997124710768,0.8958555553381257,-0.4221435937335289,0.9882260556440794,-0.1530008592987143,0,0.06458833258867726,0.41717329855070184,0.9065289770711917,-0.06916898522415335,-0.10965109179996732,-0.296334654109071", "0.06195300000000001,0,0,-0.10232918006728604,0,-7.425327721913527E-4,-0.10232918006728604,-0.0780926227846123,-0.23876808682366743,0.00865659848606746,0.9104197221831186,-0.41359520398895416,0.9999547986098166,-0.00950793022697783,0,0.003932434341739639,0.41357650891076075,0.9104608762804339,-0.06685242856064665,-0.10232918006728604,-0.27424483833030683", "0.09293000000000001,0,0,-0.10926628636207196,0,0.013237045509938124,-0.10926628636207196,-0.0806597099254104,-0.2549546681781679,-0.1477738113587423,0.9004571865995031,-0.40907182227308003,0.9868000294540836,0.1619435144407448,0,-0.06624652855758233,0.403672086267911,0.9125021886122694,-0.07262310663710275,-0.10926628636207196,-0.29159784790313703", "0.123907,0,0,-0.07987221113158625,0,0.03519201244522081,-0.07987221113158625,-0.047803003761634176,-0.18636849264036795,-0.5413777620507927,0.7353794624863419,-0.4075870028719928,0.8053072032465344,0.5928577471866627,0,-0.24164111230525348,0.32823274936248165,0.913166378646206,-0.05337720545709078,-0.07987221113158625,-0.21286349831486343", "0,0.031303,0,-0.0500710008514603,0,-0.031282106665178964,-0.0500710008514603,-0.03472609244347776,-0.11683233532007405,0.5951142192279052,0.6606329814206615,-0.45760586745802173,0.7429895512528564,-0.6693030156282572,0,0.30627698705883855,0.3399963781133095,0.8891551439810668,-0.02601700399854432,-0.0500710008514603,-0.14088633217299001"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])  # disabled
pt_5 = Point(duppt)  # disabled
split_4 = TextSplit(Text=writenodefilewithbnd.Tets, Separators="(,)")  # disabled
split_5 = TextSplit(Text=writenodefilewithbnd.Pts, Separators="  ")  # disabled
item_5 = ListItem(List=split_4, Index=[1, 2, 3, 4], Wrap=True)  # disabled
split_6 = TextSplit(Text=data_3, Separators=",")  # disabled
item_6 = ListItem(List=split_5, Index=2, Wrap=True)  # disabled
item_7 = ListItem(List=split_5, Index=4, Wrap=True)  # disabled
subtraction_2 = Subtraction(A=item_5, B=1)  # disabled
split_7 = SplitList(List=split_6, Index=9)  # -> simplify(flatten(ListA)), ListB; disabled
countconnections = CSharpScript()  # -> out, A; inputs LinesForEachPoint: tree of Line; disabled
# ---------- countconnections: C# ----------
    List<int> counts = new List<int>();
    for (int currentPointIndex = 0; currentPointIndex < LinesForEachPoint.BranchCount; currentPointIndex++)
    {
      List<Line> Lines = LinesForEachPoint.Branch(currentPointIndex);
      counts.Add(Lines.Count());
    }
    
    A = counts;
# ---------- end countconnections ----------
pt_6 = ConstructPoint(XCoordinate=0, YCoordinate=item_6, ZCoordinate=item_7)  # -> flatten(Point); disabled
number_slider_3 = Slider(0.388, range=0..1)  # disabled
number_slider_4 = Slider(0.01, range=0..1)  # disabled
item_8 = ListItem(List=pt_6, Index=subtraction_2, Wrap=True)  # disabled
bar_graph = BarGraph(countconnections.A, BarColor=RGB(255, 0, 90))  # disabled
conmesh = ConstructMesh(Vertices=item_8, Faces=[{A=2, B=0, C=1, D=1}, {A=3, B=0, C=2, D=2}, {A=1, B=3, C=2, D=2}, {A=1, B=0, C=3, D=3}])  # disabled
simple_filter_by_valence = CSharpScript(
    Data=flatten(split_7.ListA),
    Reference="C:\USERS\DPIKER\DESKTOP\MECHANOADAPTIVEGENERATION-MASTER (1)\MECHANOADAPTIVEGENERATION-MASTER\LIB\KangarooSolver.dll")  # -> out, F0, F1, F2, F3, F4, F5, EV1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; inputs Data: list of Double, Pts: list of Point3d, LinesForEachPoint: tree of Line; disabled
# ---------- simple_filter_by_valence: C# ----------
    //for each point
    //for each of the 6 stress directions at that point
    //get its angle with each of the 6 directions (+/-)
    //keep the line with the smallest angle

    const int DIRECTION_COUNT = 6;

    List<Vector3d> Evec1 = new List<Vector3d>();
    List<Vector3d> Evec2 = new List<Vector3d>();
    List<Vector3d> Evec3 = new List<Vector3d>();

    List<double> Eval1 = new List<double>();
    List<double> Eval2 = new List<double>();
    List<double> Eval3 = new List<double>();

    List<Line> KeptLines0 = new List<Line>();
    List<Line> KeptLines1 = new List<Line>();
    List<Line> KeptLines2 = new List<Line>();
    List<Line> KeptLines3 = new List<Line>();
    List<Line> KeptLines4 = new List<Line>();
    List<Line> KeptLines5 = new List<Line>();

    double tol = 0.00001;
    Point3d[] PointArray = Pts.ToArray();
    InterpolateTensor(PointArray, Data, ref Evec1, ref Evec2, ref Evec3, ref Eval1, ref Eval2, ref Eval3);

    EV1 = Evec1;
    EV2 = Evec2;
    EV3 = Evec3;
    int test = 0;

    for (int currentPointIndex = 0; currentPointIndex < LinesForEachPoint.BranchCount; currentPointIndex++)
    {
      List<Line> Lines = LinesForEachPoint.Branch(currentPointIndex);

      int[] bestLineIndexForEachDir = new int[DIRECTION_COUNT];
      double[] currentBestAngleForEachDir = new double[DIRECTION_COUNT];
      for(int i = 0;i < DIRECTION_COUNT;i++)
      {
        currentBestAngleForEachDir[i] = Math.PI;
      }

      for(int i = 0;i < Lines.Count;i++)
      {

        Line currentLine = new Line();
        currentLine = Lines[i];
        if( (currentLine.To - PointArray[currentPointIndex]).Length > tol)
        {
          currentLine.Flip();
        }

        double AngleWithDir0 = Vector3d.VectorAngle(currentLine.Direction, Evec1[currentPointIndex]);
        if(AngleWithDir0 < currentBestAngleForEachDir[0])
        {
          currentBestAngleForEachDir[0] = AngleWithDir0;
          bestLineIndexForEachDir[0] = i;
        }

        double AngleWithDir1 = Vector3d.VectorAngle(currentLine.Direction, -Evec1[currentPointIndex]);
        if(AngleWithDir1 < currentBestAngleForEachDir[1])
        {
          currentBestAngleForEachDir[1] = AngleWithDir1;
          bestLineIndexForEachDir[1] = i;
        }

        double AngleWithDir2 = Vector3d.VectorAngle(currentLine.Direction, Evec2[currentPointIndex]);
        if(AngleWithDir2 < currentBestAngleForEachDir[2])
        {
          currentBestAngleForEachDir[2] = AngleWithDir2;
          bestLineIndexForEachDir[2] = i;
        }

        double AngleWithDir3 = Vector3d.VectorAngle(currentLine.Direction, -Evec2[currentPointIndex]);
        if(AngleWithDir3 < currentBestAngleForEachDir[3])
        {
          currentBestAngleForEachDir[3] = AngleWithDir3;
          bestLineIndexForEachDir[3] = i;
        }

        double AngleWithDir4 = Vector3d.VectorAngle(currentLine.Direction, Evec3[currentPointIndex]);
        if(AngleWithDir4 < currentBestAngleForEachDir[4])
        {
          currentBestAngleForEachDir[4] = AngleWithDir4;
          bestLineIndexForEachDir[4] = i;
        }

        Print("Point Index %d", currentPointIndex);
        double AngleWithDir5 = Vector3d.VectorAngle(currentLine.Direction, -Evec3[currentPointIndex]);
        if(AngleWithDir5 < currentBestAngleForEachDir[5])
        {
          currentBestAngleForEachDir[5] = AngleWithDir5;
          bestLineIndexForEachDir[5] = i;
        }

      }

      KeptLines0.Add(Lines[bestLineIndexForEachDir[0]]);
      KeptLines1.Add(Lines[bestLineIndexForEachDir[1]]);
      KeptLines2.Add(Lines[bestLineIndexForEachDir[2]]);
      KeptLines3.Add(Lines[bestLineIndexForEachDir[3]]);
      KeptLines4.Add(Lines[bestLineIndexForEachDir[4]]);
      KeptLines5.Add(Lines[bestLineIndexForEachDir[5]]);
    }

    F0 = KeptLines0;
    F1 = KeptLines1;
    F2 = KeptLines2;
    F3 = KeptLines3;
    F4 = KeptLines4;
    F5 = KeptLines5;

    A = test;
# ---------- simple_filter_by_valence: C# additional code ----------
  public void InterpolateTensor(Point3d[] Pts, List<double> Data, ref List<Vector3d> Evec1, ref List<Vector3d> Evec2, ref List<Vector3d> Evec3, ref List<double> Eval1, ref List<double> Eval2, ref List<double> Eval3)
  {    int nOfPoints = Pts.Count();

    List<Point3d> G = new List<Point3d>();
    List<double> T0 = new List<double>();
    List<double> T1 = new List<double>();
    List<double> T2 = new List<double>();
    List<double> T3 = new List<double>();
    List<double> T4 = new List<double>();
    List<double> T5 = new List<double>();

    while(Data.Any())
    {
      List <double> localDataList = Data.Take(9).ToList();

      G.Add(new Point3d(localDataList[0], localDataList[1], localDataList[2]));

      T0.Add(localDataList[3]);
      T1.Add(localDataList[4]);
      T2.Add(localDataList[5]);
      T3.Add(localDataList[6]);
      T4.Add(localDataList[7]);
      T5.Add(localDataList[8]);

      Data = Data.Skip(9).ToList();
    }

    var EigenVectors = new Vector3d[nOfPoints][];
    var EigenValues = new Double[nOfPoints][];

    var EVA = new Vector3d[nOfPoints];
    var EVB = new Vector3d[nOfPoints];
    var EVC = new Vector3d[nOfPoints];
    var EigenValuesA = new double[nOfPoints];
    var EigenValuesB = new double[nOfPoints];
    var EigenValuesC = new double[nOfPoints];

    //find grid count and size
    int xCount, yCount, zCount;
    xCount = yCount = zCount = 0;
    double xSize, ySize, zSize;
    xSize = ySize = zSize = 0;

    var Tensors = new StressTensor[G.Count];
    for(int i = 0;i < G.Count;i++)
    {
      Tensors[i] = new StressTensor(new List<double>{T0[i],T1[i],T2[i],T1[i],T3[i],T4[i],T2[i],T4[i],T5[i]});
    }
    Array.Sort(G.ToArray(), Tensors);

    G.Sort();

    zSize = G[1].Z - G[0].Z;

    for(int i = 1;i < G.Count;i++)
    {
      if(G[i].Y > G[0].Y)
      {
        ySize = G[i].Y - G[0].Y;
        zCount = i;
        break;
      }
    }

    for(int i = 1;i < G.Count;i++)
    {
      if(G[i].X > G[0].X)
      {
        xSize = G[i].X - G[0].X;
        yCount = i / zCount;
        break;
      }
    }

    xCount = G.Count / (zCount * yCount);

    var Grid = new StressTensor[xCount, yCount, zCount];

    for(int i = 0; i < xCount;i++)
    {
      for(int j = 0; j < yCount; j++)
      {
        for(int k = 0; k < zCount; k++)
        {
          Grid[i, j, k] = Tensors[k + j * zCount + i * zCount * yCount];
        }
      }
    }
    // for each point in P, find its coordinates in the grid
    // output the 8 points/indices of the corners
    // and the point coordinates of the position within that cell

    var arrayOfCellCoords = new Point3d[nOfPoints]; // always in [0,1]^3
    var arrayOfTensors0 = new double[nOfPoints][];
    var arrayOfTensors1 = new double[nOfPoints][];
    var arrayOfTensors2 = new double[nOfPoints][];
    var arrayOfTensors3 = new double[nOfPoints][];
    var arrayOfTensors4 = new double[nOfPoints][];
    var arrayOfTensors5 = new double[nOfPoints][];
    var arrayOfTensors6 = new double[nOfPoints][];
    var arrayOfTensors7 = new double[nOfPoints][];

    System.Threading.Tasks.Parallel.For(0, nOfPoints,
      j => {
      var PVec = Pts[j] - G[0];  //position vector of the current point relative to grid origin

      var PX = PVec.X / xSize;
      var PY = PVec.Y / ySize;
      var PZ = PVec.Z / zSize;

      int PXF,PXC,PYF,PYC,PZF,PZC;

      var CoordsInCell = new Point3d();

      if(PX < 0)
      {
        PXF = 0; PXC = 1; CoordsInCell.X = 0;
      }
      else if(PX > xCount - 1)
      {
        PXF = xCount - 2; PXC = xCount - 1; CoordsInCell.X = 1;
      }
      else
      {
        PXF = (int) Math.Floor(PX); PXC = (int) Math.Ceiling(PX); CoordsInCell.X = PX - PXF;
      }


      if(PY < 0)
      {
        PYF = 0; PYC = 1; CoordsInCell.Y = 0;
      }
      else if(PY > yCount - 1)
      {
        PYF = yCount - 2; PYC = yCount - 1; CoordsInCell.Y = 1;
      }
      else
      {
        PYF = (int) Math.Floor(PY); PYC = (int) Math.Ceiling(PY); CoordsInCell.Y = PY - PYF;
      }


      if(PZ < 0)
      {
        PZF = 0; PZC = 1; CoordsInCell.Z = 0;
      }
      else if(PZ > zCount - 1)
      {
        PZF = zCount - 2; PZC = zCount - 1; CoordsInCell.Z = 1;
      }
      else
      {
        PZF = (int) Math.Floor(PZ); PZC = (int) Math.Ceiling(PZ); CoordsInCell.Z = PZ - PZF;
      }


      //
      //      int PXF = Math.Max(Math.Min((int) Math.Floor(PX), xCount - 1), 0);
      //      int PYF = Math.Max(Math.Min((int) Math.Floor(PY), yCount - 1), 0);
      //      int PZF = Math.Max(Math.Min((int) Math.Floor(PZ), zCount - 1), 0);
      //
      //      int PXC = Math.Max(Math.Min((int) Math.Ceiling(PX), xCount - 1), 0);
      //      int PYC = Math.Max(Math.Min((int) Math.Ceiling(PY), yCount - 1), 0);
      //      int PZC = Math.Max(Math.Min((int) Math.Ceiling(PZ), zCount - 1), 0);

      //     arrayOfCellCoords[j] = new Point3d(Math.Min(Math.Max(PX - PXF, 0), 1), Math.Min(Math.Max(PY - PYF, 0), 1), Math.Min(Math.Max(PZ - PZF, 0), 1));

      arrayOfCellCoords[j] = CoordsInCell;

      arrayOfTensors0[j] = Grid[PXF, PYF, PZF].Values;
      arrayOfTensors1[j] = Grid[PXF, PYF, PZC].Values;
      arrayOfTensors2[j] = Grid[PXF, PYC, PZF].Values;
      arrayOfTensors3[j] = Grid[PXF, PYC, PZC].Values;
      arrayOfTensors4[j] = Grid[PXC, PYF, PZF].Values;
      arrayOfTensors5[j] = Grid[PXC, PYF, PZC].Values;
      arrayOfTensors6[j] = Grid[PXC, PYC, PZF].Values;
      arrayOfTensors7[j] = Grid[PXC, PYC, PZC].Values;

      var Corners = new StressTensor[8];

      Corners[0] = new StressTensor();
      Corners[1] = new StressTensor();
      Corners[2] = new StressTensor();
      Corners[3] = new StressTensor();
      Corners[4] = new StressTensor();
      Corners[5] = new StressTensor();
      Corners[6] = new StressTensor();
      Corners[7] = new StressTensor();

      Corners[0].Values = (double[]) arrayOfTensors0[j];
      Corners[1].Values = (double[]) arrayOfTensors1[j];
      Corners[2].Values = (double[]) arrayOfTensors2[j];
      Corners[3].Values = (double[]) arrayOfTensors3[j];
      Corners[4].Values = (double[]) arrayOfTensors4[j];
      Corners[5].Values = (double[]) arrayOfTensors5[j];
      Corners[6].Values = (double[]) arrayOfTensors6[j];
      Corners[7].Values = (double[]) arrayOfTensors7[j];

      var EVec = new Vector3d[3];
      var EVal = new Double[3];

      var T = new Double[3]{arrayOfCellCoords[j].X,arrayOfCellCoords[j].Y,arrayOfCellCoords[j].Z};
      //var T = new Double[3]{0.5,0.5,0.5};

      StressTensor tensorAtPoint = TriLinearInterpolate(Corners, T);
      EigenSolve(tensorAtPoint.Values, out EVal, out EVec);

      int[] ott = new int[3]; // o ne, t wo, t hree
      ott[0] = 0;
      ott[1] = 1;
      ott[2] = 2;
      double[] ev = new double[]{Math.Abs(EVal[0]),Math.Abs(EVal[1]),Math.Abs(EVal[2])};
      //sort according to maximum absolute value of Eval
      Array.Sort(ev, ott);

      EVA[j] = EVec[ott[2]];
      EVB[j] = EVec[ott[1]];
      EVC[j] = EVec[ott[0]];

      EigenValuesA[j] = Math.Abs(EVal[ott[2]]);
      EigenValuesB[j] = Math.Abs(EVal[ott[1]]);
      EigenValuesC[j] = Math.Abs(EVal[ott[0]]);
      });

    Evec1 = EVA.ToList();
    Evec2 = EVB.ToList();
    Evec3 = EVC.ToList();
    Eval1 = EigenValuesA.ToList();
    Eval2 = EigenValuesB.ToList();
    Eval3 = EigenValuesC.ToList();
  }

  //public void SweepAndPrune(List < Ellipsoid > Ellipsoids, Point3d[] Positions, ref List<int> CollideRef0, ref List<int> CollideRef1)
  //{
  //  List <AABB> boxes = new List<AABB>();
  //
  //  //use the points to create AABB objects
  //  for (int i = 0; i < Ellipsoids.Count; i++)
  //  {
  //    Ellipsoids[i].position = Positions[i];
  //    Ellipsoids[i].calculateBoundingBox();
  //
  //    boxes.Add(new AABB(Ellipsoids[i].boundingBoxMin, Ellipsoids[i].boundingBoxMax, i));
  //  }
  //
  //  List <EndPoint> sortedInX = new List<EndPoint>();
  //
  //  //add the endpoints in x
  //  foreach (AABB boxForPoint in boxes) {
  //    sortedInX.Add(boxForPoint.min[0]);//change this 0 to 1 or 2 to sort in Y or Z - will also need to change the second half of the test function
  //    sortedInX.Add(boxForPoint.max[0]);//change this 0 to 1 or 2 to sort in Y or Z
  //  }
  //
  //  //sort by the num value of each EndPoint
  //  sortedInX.Sort(EndPoint.compareEndPoints);
  //
  //  List <int> openBoxes = new List<int>();
  //
  //  foreach (EndPoint endPoint in sortedInX)
  //  {
  //    if (endPoint.isMin)
  //    {
  //      AABB thisPointOwner = endPoint.owner;
  //      //check against all in openBoxes
  //      foreach(int openBoxRef in openBoxes) {
  //        //if it collides output the integers of the branches than collide
  //        //do they collide in y?
  //        if(thisPointOwner.max[1].num > boxes[openBoxRef].min[1].num && thisPointOwner.min[1].num < boxes[openBoxRef].max[1].num) {
  //          //they collide in y, do they collide in z?
  //          if(thisPointOwner.max[2].num > boxes[openBoxRef].min[2].num && thisPointOwner.min[2].num < boxes[openBoxRef].max[2].num) {
  //            //they collide in z
  //            //therefore they collide! Add to the list of collide refs
  //            CollideRef0.Add(endPoint.owner.branchRef);
  //            CollideRef1.Add(boxes[openBoxRef].branchRef);
  //          }
  //        }
  //      }
  //      //add corresponding box to openBoxes
  //      openBoxes.Add(thisPointOwner.branchRef);
  //
  //    } else
  //    {
  //      //it must be an max point
  //      //remove corresponding box from openBoxes
  //      openBoxes.Remove(endPoint.owner.branchRef);
  //    }
  //  }
  //
  //}
  //
  //public class EllipsoidCollide // No longer a Goal object itself. This can detect collision and output info then used for the actual goal
  //{
  //
  //  Ellipsoid e1;
  //  Ellipsoid e2;
  //
  //  public double overlap;
  //  public double extension;
  //
  //  public EllipsoidCollide(Ellipsoid _e1, Ellipsoid _e2)
  //  {
  //    e1 = _e1;
  //    e2 = _e2;
  //  }
  //
  //  public double CalculateCollision()
  //  {
  //
  //    e1.calculateAxesAndScales();
  //    e2.calculateAxesAndScales();
  //
  //    //calculate distance vectors back and forth, and the length of the distance
  //    //this will become part of the narrow phase check
  //    Vector3d pjk = new Vector3d(e2.position - e1.position);
  //    double pjkLength = pjk.Length;
  //    Vector3d pkj = new Vector3d(-pjk);
  //
  //    //store direction before transforming distance vectors
  //    Vector3d pushVector = new Vector3d(pjk);
  //
  //    //Transform connection vector onto "sphere" coordinates of either ellipsoid
  //    e1.calculateInverse();
  //    e2.calculateInverse();
  //    //find length of vector inside each ellipsoid
  //    double jDistance = e1.findDistanceInside(pjk);
  //    double kDistance = e2.findDistanceInside(pkj);
  //
  //    double touchingDistance = jDistance + kDistance;
  //    if(pjkLength - (touchingDistance) < 0)
  //    {
  //      return touchingDistance;
  //    }
  //    else
  //    {
  //      return -1;
  //    }
  //
  //    //      //longest overlap is:
  //    //      extension = pjkLength - (jDistance + kDistance);
  //    //
  //    //      //scalar w quantifying overlap in ]0,1]. w = 1 means no overlap, w close to 0 means a lot of overlap
  //    //      double overlap = pjkLength / (jDistance + kDistance);
  //    //
  //    //      if(overlap <= 1.0 && overlap > 0)
  //    //      {
  //    //        pushVector.Unitize();
  //    //        return extension * pushVector;
  //    //      } else
  //    //      {
  //    //        return Vector3d.Zero;
  //    //      }
  //
  //  }
  //
  //}
  //
  //public class Ellipsoid {
  //
  //  //centre point of the ellipsoid
  //  public Point3d position;
  //  //transform matrix that defines the scale and rotation make 3x3 (but really a 1x9)
  //  double[] transform;
  //  //the inverse transform this is calculated once and then referenced..
  //  double[] inverse;
  //
  //  //unitized vectors for the axis
  //  //perhaps store the squared values as they are
  //  public Vector3d unitXAxis;
  //  double scaleX;
  //  public Vector3d unitYAxis;
  //  double scaleY;
  //  public Vector3d unitZAxis;
  //  double scaleZ;
  //
  //  //points defining the bounding box
  //  public Point3d boundingBoxMin;
  //  public Point3d boundingBoxMax;
  //
  //  //constructor
  //  public Ellipsoid(Point3d tPos) {
  //    //set the values use Vector3d.Axis and caluate bounding box function
  //    position = tPos;
  //
  //    //set the transfrom as an identity matrix
  //    transform = new double[]{1,0,0,0,1,0,0,0,1};
  //    inverse = new double[]{1,0,0,0,1,0,0,0,1};
  //
  //    //could use calculateAxes but a waste of three unitize calls!
  //    unitXAxis = Vector3d.XAxis;
  //    scaleX = 1.0;
  //    unitYAxis = Vector3d.YAxis;
  //    scaleY = 1.0;
  //    unitZAxis = Vector3d.ZAxis;
  //    scaleZ = 1.0;
  //
  //    calculateBoundingBox();
  //  }
  //
  //  //takes an set of vectors and updates the transform - taken from the eigenvectors of the interpolated field
  //  public void updateTransform(Vector3d xAxis, Vector3d yAxis, Vector3d zAxis) {
  //    transform[0] = xAxis[0];
  //    transform[3] = xAxis[1];
  //    transform[6] = xAxis[2];
  //
  //    transform[1] = yAxis[0];
  //    transform[4] = yAxis[1];
  //    transform[7] = yAxis[2];
  //
  //    transform[2] = zAxis[0];
  //    transform[5] = zAxis[1];
  //    transform[8] = zAxis[2];
  //  }
  //
  //  public void scale(double s)
  //  {
  //    for(int i = 0; i < 9;i++)
  //    {
  //      transform[i] = s * transform[i];
  //    }
  //  }
  //
  //  public void calculateInverse() {
  //    inverse[0] = transform[0] / (scaleX * scaleX);
  //    inverse[1] = transform[3] / (scaleX * scaleX);
  //    inverse[2] = transform[6] / (scaleX * scaleX);
  //
  //    inverse[3] = transform[1] / (scaleY * scaleY);
  //    inverse[4] = transform[4] / (scaleY * scaleY);
  //    inverse[5] = transform[7] / (scaleY * scaleY);
  //
  //    inverse[6] = transform[2] / (scaleZ * scaleZ);
  //    inverse[7] = transform[5] / (scaleZ * scaleZ);
  //    inverse[8] = transform[8] / (scaleZ * scaleZ);
  //  }
  //
  //  //calculate and return boundingBox
  //  public void calculateBoundingBox() {
  //    //takes a transform matrix representation of an ellipsoid and returns two points defining the min x,y,z and max x,y,x
  //    double[] minAndMaxX = getMinAndMax(position.X, 0);
  //    double[] minAndMaxY = getMinAndMax(position.Y, 3);
  //    double[] minAndMaxZ = getMinAndMax(position.Z, 6);
  //
  //    boundingBoxMin = new Point3d(minAndMaxX[0], minAndMaxY[0], minAndMaxZ[0]);
  //    boundingBoxMax = new Point3d(minAndMaxX[1], minAndMaxY[1], minAndMaxZ[1]);
  //
  //
  //  }
  //
  //  //method used by the calculate bounding box method
  //  private double[] getMinAndMax(double position, int adder) {
  //    double m11 = transform[adder];
  //    double m12 = transform[adder + 1];
  //    double m13 = transform[adder + 2];
  //    double d = Math.Sqrt(m11 * m11 + m12 * m12 + m13 * m13);
  //    double[] minMax = { position - d, position + d };
  //    return minMax;
  //  }
  //
  //  //set updated unit vectors for
  //  public void calculateAxesAndScales() {
  //    unitXAxis = new Vector3d(transform[0], transform[3], transform[6]);
  //    scaleX = unitXAxis.Length;
  //    unitXAxis.Unitize();
  //    unitYAxis = new Vector3d(transform[1], transform[4], transform[7]);
  //    scaleY = unitYAxis.Length;
  //    unitYAxis.Unitize();
  //    unitZAxis = new Vector3d(transform[2], transform[5], transform[8]);
  //    scaleZ = unitZAxis.Length;
  //    unitZAxis.Unitize();
  //  }
  //
  //  //combines the postion and the transform to create an Affine transform
  //  public double[] createAffineTransform() {
  //    return new double[]{transform[0],transform[1],transform[2],position[0],transform[3],transform[4],transform[5],position[1],transform[6],transform[7],transform[8],position[2],0,0,0,1};
  //  }
  //
  //  //using similarity ratios: 1/transformedLength = distanceInside/inputlegth
  //  public double findDistanceInside(Vector3d inputVector) {
  //    Vector3d transformed = transformVector(inputVector);
  //    return inputVector.Length / transformed.Length;
  //  }
  //
  //  //method used by findDistanceInside method
  //  private Vector3d transformVector(Vector3d toTransform) {
  //    Vector3d transformedVector = new Vector3d();
  //    transformedVector[0] = inverse[0] * toTransform[0] + inverse[1] * toTransform[1] + inverse[2] * toTransform[2];
  //    transformedVector[1] = inverse[3] * toTransform[0] + inverse[4] * toTransform[1] + inverse[5] * toTransform[2];
  //    transformedVector[2] = inverse[6] * toTransform[0] + inverse[7] * toTransform[1] + inverse[8] * toTransform[2];
  //    return transformedVector;
  //  }
  //}
  //
  //public class AABB {
  //  public EndPoint[] min;//an array of size 3 with the x,y,z value for the AABB min
  //  public EndPoint[] max;//an array of size 3 with the x,y,z value for the AABB max
  //  public int branchRef;
  //
  //  //constructor
  //  public AABB(Point3d tMin, Point3d tMax, int tBranchRef) {
  //    min = new EndPoint[] {new EndPoint(tMin.X, true, this), new EndPoint(tMin.Y, true, this), new EndPoint(tMin.Z, true, this)};
  //    max = new EndPoint[] {new EndPoint(tMax.X, false, this), new EndPoint(tMax.Y, false, this), new EndPoint(tMax.Z, false, this)};
  //    branchRef = tBranchRef;
  //  }
  //}
  //
  //public class EndPoint {
  //  public AABB owner;
  //  public double num;//its actual value - corresponds to the x,y or z value
  //  public bool isMin;//is this a min point or a max point?
  //
  //  //constructor
  //  public EndPoint(double tNum, bool tIsMin, AABB tOwner) {
  //    num = tNum;
  //    isMin = tIsMin;
  //    owner = tOwner;
  //  }
  //
  //  //used as a comparison to sort the endpoints
  //  public static int compareEndPoints(EndPoint x, EndPoint y)
  //  {
  //    return x.num.CompareTo(y.num);
  //  }
  //}
  public class StressTensor
  {
    public double[] Values;

    public StressTensor()
    {
      Values = new Double[9]{0,0,0,0,0,0,0,0,0};
    }

    public StressTensor(List < double > Vals)
    {
      Values = Vals.ToArray();
    }
  }
  //
  //
  //
  //
  public StressTensor LinearInterpolate(StressTensor TensorA, StressTensor TensorB, double T)
  {
    var Interp = new StressTensor();
    int NaNorZeroCount = 0;
    for(int i = 0;i < 9;i++)
    {
      Interp.Values[i] = 0;
      if(!Double.IsNaN(TensorA.Values[i]) )
      {
        Interp.Values[i] += (1 - T) * TensorA.Values[i];
      }
      else{
        Interp.Values[i] += (1 - T) * TensorB.Values[i];
        NaNorZeroCount++;
      }
      if(!Double.IsNaN(TensorB.Values[i]))
      {
        Interp.Values[i] += T * TensorB.Values[i];
      }
      else{
        Interp.Values[i] += T * TensorA.Values[i];
        NaNorZeroCount++;
      }

      if(NaNorZeroCount == 2)
      {
        Interp.Values[i] = double.NaN;
      }
    }

    return Interp;

  }


  /// <summary>
  /// given stress tensors at the 8 corners of a cube, and coordinates of a point within that cube
  /// perform a trilinear interpolation
  /// </summary>
  /// <param name="CornerTensors">Tensor values at the corners, ordered 000,001,010,011,100,101,110,111</param>
  /// <param name="T">3 numbers in the range 0 to 1</param>
  /// <returns>the interpolated stress tensor at the given coordinates</returns>
  ///
  public StressTensor TriLinearInterpolate(StressTensor[] CornerTensors, double[] T)
  {
    //first get the 4 values along the edges in the x direction
    StressTensor SX0 = LinearInterpolate(CornerTensors[0], CornerTensors[4], T[0]);
    StressTensor SX1 = LinearInterpolate(CornerTensors[1], CornerTensors[5], T[0]);
    StressTensor SX2 = LinearInterpolate(CornerTensors[2], CornerTensors[6], T[0]);
    StressTensor SX3 = LinearInterpolate(CornerTensors[3], CornerTensors[7], T[0]);

    //interpolate along Y
    StressTensor SY0 = LinearInterpolate(SX0, SX2, T[1]);
    StressTensor SY1 = LinearInterpolate(SX1, SX3, T[1]);

    //and finally along Z
    var ST = LinearInterpolate(SY0, SY1, T[2]);
    bool HasNaN = false;
    for(int i = 0;i < 9;i++)
    {
      if(Double.IsNaN(ST.Values[i])){HasNaN = true;}
    }
    if(!HasNaN)
    {
      return LinearInterpolate(SY0, SY1, T[2]);
    }
    else
    {
      var Mx = double.MaxValue;
      //var Mx = ev1max;

      return new StressTensor(new List<double>{Mx,0,0,0,Mx,0,0,0,Mx});
    }

  }

  public class DescendingAbsoluteVals : Comparer < double > {
    public override int Compare(double x, double y)
    {
      return (y * y).CompareTo(x * x);
    }
  }

  public static void EigenSolve(double[] x, out double[] EigenValues, out Vector3d[] EigenVectors)
  {
    double[,] matValues = new double[3, 3]{{x[0],x[1],x[2]},{x[3],x[4],x[5]},{x[6],x[7],x[8]}};
    double[,] OutMatValues = new double[3, 3];
    double[] OutVecValues = new double[3];
    Eigen eigenCalculate = new Eigen();

    eigenCalculate.eigen_decomposition(matValues, OutMatValues, OutVecValues);

    var EigenVectorsUnsorted = new Vector3d[3];

    if (eigenCalculate.calcDone)
    {
      EigenVectorsUnsorted[0] = new Vector3d(OutMatValues[0, 0], OutMatValues[1, 0], OutMatValues[2, 0]);
      EigenVectorsUnsorted[1] = new Vector3d(OutMatValues[0, 1], OutMatValues[1, 1], OutMatValues[2, 1]);
      EigenVectorsUnsorted[2] = new Vector3d(OutMatValues[0, 2], OutMatValues[1, 2], OutMatValues[2, 2]);
    }

    Array.Sort(OutVecValues, EigenVectorsUnsorted, new DescendingAbsoluteVals());
    EigenValues = OutVecValues;
    EigenVectors = EigenVectorsUnsorted;
  }


  public class Eigen
  {
    public bool startCalc = false;
    public bool calcDone = false;

    ///////////////////////////////
    //Eigen solver implementation
    ///////////////////////////////
    private static double hypot2(double x, double y)
    {
      return Math.Sqrt(x * x + y * y);
    }

    private static void tred2(double[,] V, double[] d, double[] e)
    {
      for (int j = 0; j < 3; j++)
      {
        d[j] = V[3 - 1, j];
      }

      for (int i = 3 - 1; i > 0; i--)
      {
        double scale = 0.0;
        double h = 0.0;

        for (int k = 0; k < i; k++)
        {
          scale = scale + Math.Abs(d[k]);
        }

        if (scale == 0.0)
        {
          e[i] = d[i - 1];
          for (int j = 0; j < i; j++)
          {
            d[j] = V[i - 1, j];
            V[i, j] = 0.0;
            V[j, i] = 0.0;
          }
        }
        else
        {
          for (int k = 0; k < i; k++)
          {
            d[k] /= scale;
            h += d[k] * d[k];
          }

          double f = d[i - 1];
          double g = Math.Sqrt(h);

          if (f > 0)
          {
            g = -g;
          }

          e[i] = scale * g;
          h = h - f * g;
          d[i - 1] = f - g;

          for (int j = 0; j < i; j++)
          {
            e[j] = 0.0;
          }

          for (int j = 0; j < i; j++)
          {
            f = d[j];
            V[j, i] = f;
            g = e[j] + V[j, j] * f;

            for (int k = j + 1; k <= i - 1; k++)
            {
              g += V[k, j] * d[k];
              e[k] += V[k, j] * f;
            }

            e[j] = g;
          }

          f = 0.0;

          for (int j = 0; j < i; j++)
          {
            e[j] /= h;
            f += e[j] * d[j];
          }

          double hh = f / (h + h);

          for (int j = 0; j < i; j++)
          {
            e[j] -= hh * d[j];
          }

          for (int j = 0; j < i; j++)
          {
            f = d[j];
            g = e[j];

            for (int k = j; k <= i - 1; k++)
            {
              V[k, j] -= (f * e[k] + g * d[k]);
            }

            d[j] = V[i - 1, j];
            V[i, j] = 0.0;
          }
        }
        d[i] = h;
      }

      for (int i = 0; i < 3 - 1; i++)
      {
        V[3 - 1, i] = V[i, i];
        V[i, i] = 1.0;

        double h = d[i + 1];

        if (h != 0.0)
        {
          for (int k = 0; k <= i; k++)
          {
            d[k] = V[k, i + 1] / h;
          }
          for (int j = 0; j <= i; j++)
          {
            double g = 0.0;

            for (int k = 0; k <= i; k++)
            {
              g += V[k, i + 1] * V[k, j];
            }
            for (int k = 0; k <= i; k++)
            {
              V[k, j] -= g * d[k];
            }
          }
        }
        for (int k = 0; k <= i; k++)
        {
          V[k, i + 1] = 0.0;
        }
      }
      for (int j = 0; j < 3; j++)
      {
        d[j] = V[3 - 1, j];
        V[3 - 1, j] = 0.0;
      }

      V[3 - 1, 3 - 1] = 1.0;
      e[0] = 0.0;
    }

    static void tql2(double[,] V, double[] d, double[] e)
    {
      for (int i = 1; i < 3; i++)
      {
        e[i - 1] = e[i];
      }
      e[3 - 1] = 0.0;

      double f = 0.0;
      double tst1 = 0.0;
      double eps = Math.Pow(2.0, -52.0);
      for (int l = 0; l < 3; l++)
      {
        tst1 = Math.Max(tst1, Math.Abs(d[l]) + Math.Abs(e[l]));
        int m = l;

        while (m < 3)//not in original code, was m < 3!!!
        {
          if (Math.Abs(e[m]) <= eps * tst1)
          {
            break;
          }
          m++;
        }

        if (m > l)
        {
          int iter = 0;
          do
          {
            iter = iter + 1;

            double g = d[l];
            double p = (d[l + 1] - g) / (2.0 * e[l]);
            double r = hypot2(p, 1.0);

            if (p < 0)
            {
              r = -r;
            }

            d[l] = e[l] / (p + r);
            d[l + 1] = e[l] * (p + r);

            double dl1 = d[l + 1];
            double h = g - d[l];

            for (int i = l + 2; i < 3; i++)
            {
              d[i] -= h;
            }

            f = f + h;
            p = d[m];

            double c = 1.0;
            double c2 = c;
            double c3 = c;
            double el1 = e[l + 1];
            double s = 0.0;
            double s2 = 0.0;

            for (int i = m - 1; i >= l; i--)
            {
              c3 = c2;
              c2 = c;
              s2 = s;
              g = c * e[i];
              h = c * p;
              r = hypot2(p, e[i]);
              e[i + 1] = s * r;
              s = e[i] / r;
              c = p / r;
              p = c * d[i] - s * g;
              d[i + 1] = h + s * (c * g + s * d[i]);

              for (int k = 0; k < 3; k++)
              {
                h = V[k, i + 1];
                V[k, i + 1] = s * V[k, i] + c * h;
                V[k, i] = c * V[k, i] - s * h;
              }
            }

            p = -s * s2 * c3 * el1 * e[l] / dl1;
            e[l] = s * p;
            d[l] = c * p;
          } while (Math.Abs(e[l]) > eps * tst1);
        }

        d[l] = d[l] + f;
        e[l] = 0.0;
      }

      for (int i = 0; i < 3 - 1; i++)
      {
        int k = i;
        double p = d[i];

        for (int j = i + 1; j < 3; j++)
        {
          if (d[j] < p)
          {
            k = j;
            p = d[j];
          }
        }
        if (k != i)
        {
          d[k] = d[i];
          d[i] = p;

          for (int j = 0; j < 3; j++)
          {
            p = V[j, i];
            V[j, i] = V[j, k];
            V[j, k] = p;
          }
        }
      }
    }

    public void eigen_decomposition(double[,] A, double[,] V, double[] d)
    {
      double[] e = new double[3];
      for (int i = 0; i < 3; i++)
      {
        for (int j = 0; j < 3; j++)
        {
          V[i, j] = A[i, j];
        }
      }
      tred2(V, d, e);
      tql2(V, d, e);

      calcDone = true;
    }

  }

  //public static Color ColorAt(Mesh mesh, int faceIndex, double t0, double t1, double t2, double t3)
  //{
  //  // int rc = -1;
  //  var color = Rhino.Display.Color4f.Black;
  //
  //  if( mesh.VertexColors.Count != 0)
  //  {
  //    // test to see if face exists
  //    if( faceIndex >= 0 && faceIndex < mesh.Faces.Count )
  //    {
  //      /// Barycentric quad coordinates for the point on the mesh
  //      /// face mesh.Faces[FaceIndex].
  //
  //      /// If the face is a triangle
  //      /// disregard T[3] (it should be set to 0.0).
  //
  //      /// If the face is
  //      /// a quad and is split between vertexes 0 and 2, then T[3]
  //      /// will be 0.0 when point is on the triangle defined by vi[0],
  //      /// vi[1], vi[2]
  //
  //      /// T[1] will be 0.0 when point is on the
  //      /// triangle defined by vi[0], vi[2], vi[3].
  //
  //      /// If the face is a
  //      /// quad and is split between vertexes 1 and 3, then T[2] will
  //      /// be -1 when point is on the triangle defined by vi[0],
  //      /// vi[1], vi[3]
  //
  //      /// and m_t[0] will be -1 when point is on the
  //      /// triangle defined by vi[1], vi[2], vi[3].
  //
  //      MeshFace face = mesh.Faces[faceIndex];
  //
  //      // Collect data for barycentric evaluation.
  //      Color p0, p1, p2;
  //
  //      if(face.IsTriangle)
  //      {
  //        p0 = mesh.VertexColors[face.A];
  //        p1 = mesh.VertexColors[face.B];
  //        p2 = mesh.VertexColors[face.C];
  //      }
  //      else
  //      {
  //        if( t3 == 0 )
  //        { // point is on subtriangle {0,1,2}
  //          p0 = mesh.VertexColors[face.A];
  //          p1 = mesh.VertexColors[face.B];
  //          p2 = mesh.VertexColors[face.C];
  //        }
  //        else if( t1 == 0 )
  //        { // point is on subtriangle {0,2,3}
  //          p0 = mesh.VertexColors[face.A];
  //          p1 = mesh.VertexColors[face.C];
  //          p2 = mesh.VertexColors[face.D];
  //          //t0 = t0;
  //          t1 = t2;
  //          t2 = t3;
  //        }
  //        else if( t2 == -1 )
  //        { // point is on subtriangle {0,1,3}
  //          p0 = mesh.VertexColors[face.A];
  //          p1 = mesh.VertexColors[face.B];
  //          p2 = mesh.VertexColors[face.D];
  //          //t0 = t0;
  //          //t1 = t1;
  //          t2 = t3;
  //        }
  //        else
  //        { // point must be on remaining subtriangle {1,2,3}
  //          p0 = mesh.VertexColors[face.B];
  //          p1 = mesh.VertexColors[face.C];
  //          p2 = mesh.VertexColors[face.D];
  //          t0 = t1;
  //          t1 = t2;
  //          t2 = t3;
  //        }
  //      }
  //
  ///**
  //        double r = t0 * p0.FractionRed() + t1 * p1.FractionRed() + t2 * p2.FractionRed();
  //        double g = t0 * p0.FractionGreen() + t1 * p1.FractionGreen() + t2 * p2.FractionGreen();
  //       double b = t0 * p0.FractionBlue() + t1 * p1.FractionBlue() + t2 * p2.FractionBlue();
  //
  //        ON_Color color;
  //        color.SetFractionalRGB(r, g, b);
  //
  //        unsigned int abgr = (unsigned int)color;
  //        rc = (int) ABGR_to_ARGB(abgr);
  //
  //    var c0 = new Rhino.Display.Color4f(p0);
  //    var c1 = new Rhino.Display.Color4f(p1);
  //    var c2 = new Rhino.Display.Color4f(p2);
  //    float s0 = (float) t0;
  //    float s1 = (float) t1;
  //    float s2 = (float) t2;
  //
  //    float R = s0 * c0.R + s1 * c1.R + s2 * c2.R;
  //    float G = s0 * c0.G + s1 * c1.G + s2 * c2.G;
  //    float B = s0 * c0.B + s1 * c1.B + s2 * c2.B;
  //    color = new Rhino.Display.Color4f(R, G, B, 1);
  //  }
  //}
  //  return color.AsSystemColor();
  //}
  //
  //public static Color ColorAt(Mesh mesh, MeshPoint meshPoint)
  //{
  //  return ColorAt(mesh, meshPoint.FaceIndex, meshPoint.T[0], meshPoint.T[1], meshPoint.T[2], meshPoint.T[3]);
  //}
  //
  //public class Align : GoalObject
  //{
  //  public double Strength;
  //  public List<Vector3d> Vec;
  //
  //  public Align(int ea, int eb, Vector3d[] _Vec, double k)
  //  {
  //    PIndex = new int[2]{ea,eb};
  //    Move = new Vector3d[2];
  //    Weighting = new double[2]{k,k};
  //    Vec = _Vec.ToList();
  //    Strength = k;
  //  }
  //
  //  public override void Calculate(List<KangarooSolver.Particle> p)
  //  {
  //    Point3d p0 = p[PIndex[0]].Position;
  //    Point3d p1 = p[PIndex[1]].Position;
  //    var EdgeVec = new Vector3d();
  //    EdgeVec = p1 - p0;
  //
  //    double AngleX = Vector3d.VectorAngle(Vec[0], EdgeVec);
  //    double AngleY = Vector3d.VectorAngle(Vec[1], EdgeVec);
  //    double AngleZ = Vector3d.VectorAngle(Vec[2], EdgeVec);
  //    double AngleNX = Vector3d.VectorAngle(-Vec[0], EdgeVec);
  //    double AngleNY = Vector3d.VectorAngle(-Vec[1], EdgeVec);
  //    double AngleNZ = Vector3d.VectorAngle(-Vec[2], EdgeVec);
  //
  //    double lowest = AngleX;
  //    Vector3d TargetDir = Vec[0];
  //
  //    if (AngleY < lowest)
  //    {
  //      TargetDir = Vec[1];
  //      lowest = AngleY;
  //    }
  //
  //    if (AngleZ < lowest)
  //    {
  //      TargetDir = Vec[2];
  //      lowest = AngleZ;
  //    }
  //
  //    if (AngleNX < lowest)
  //    {
  //      TargetDir = -Vec[0];
  //      lowest = AngleNX;
  //    }
  //    if (AngleNY < lowest)
  //    {
  //      TargetDir = -Vec[1];
  //      lowest = AngleNY;
  //    }
  //    if (AngleNZ < lowest)
  //    {
  //      TargetDir = -Vec[2];
  //    }
  //
  //    Vector3d V = EdgeVec;
  //    Vector3d Dir = TargetDir;
  //
  //    Vector3d To = (V - (V * Dir) * Dir) * 0.5;
  //
  //    Move[0] = To;
  //    Move[1] = -To;
  //
  //    if(!Dir.IsZero && lowest < Math.PI / 9)
  //    {
  //      Weighting[0] = Strength;
  //      Weighting[1] = Strength;
  //    }
  //    else
  //    {
  //      Weighting[0] = 0;
  //      Weighting[1] = 0;
  //    }
  //  }
  //}
  //
  //
  //public class NonLinearRepel : GoalObject
  //{
  //  public int Exponent;
  //  public double Length;
  //  public double Multiplier;
  //  public double Stiffness;
  //
  //  public NonLinearRepel(int Pt0, int Pt1, double Len, double Mult, double k, int q)
  //  {
  //
  //    PIndex = new int[2]{Pt0,Pt1};
  //    Move = new Vector3d[2];
  //    Weighting = new double[2]{k,k};
  //    Exponent = q;
  //    Length = Len;
  //    Multiplier = Mult;
  //    Stiffness = k;
  //  }
  //
  //  public override void Calculate(List<KangarooSolver.Particle> p)
  //  {
  //    Vector3d Current = p[PIndex[1]].Position - p[PIndex[0]].Position;
  //
  //    double CurrentLength = Current.Length;
  //    double Overlap = Length - CurrentLength;
  //    Current.Unitize();
  //
  //    if(Overlap > 0)
  //    {
  //      Move[0] = -0.5 * Current * Overlap;
  //      Move[1] = 0.5 * Current * Overlap;
  //
  //      Weighting[0] = Weighting[1] =
  //        //  Stiffness * (Math.Pow(CurrentLength * Multiplier, Exponent) - Math.Pow(Length * Multiplier, Exponent));
  //        Stiffness * Math.Pow((Length - Overlap) * Multiplier, Exponent);
  //    }
  //    else
  //    {
  //      Weighting[0] = Weighting[1] = 0;
  //    }
  //
  //  }
  //
  //  public override object Output(List<KangarooSolver.Particle> p)
  //  {
  //    Line L = new Line(p[PIndex[0]].Position, p[PIndex[1]].Position);
  //    return L;
  //  }
  //}
  //  */
  //
# ---------- end simple_filter_by_valence ----------
filter_by_valence = CSharpScript(
    Data=flatten(split_7.ListA),
    Reference="C:\USERS\DPIKER\DESKTOP\MECHANOADAPTIVEGENERATION-MASTER (1)\MECHANOADAPTIVEGENERATION-MASTER\LIB\KangarooSolver.dll")  # -> out, F0, F1, F2, F3, F4, F5, EV1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; inputs Data: list of Double, Pts: list of Point3d, LinesForEachPoint: tree of Line; disabled
# ---------- filter_by_valence: C# ----------
    //for each point
    //for each of the 6 stress directions at that point
    //get its angle with each of the 6 directions (+/-)
    //keep the line with the smallest angle

    List<Vector3d> Evec1 = new List<Vector3d>();
    List<Vector3d> Evec2 = new List<Vector3d>();
    List<Vector3d> Evec3 = new List<Vector3d>();

    List<double> Eval1 = new List<double>();
    List<double> Eval2 = new List<double>();
    List<double> Eval3 = new List<double>();

    List<Line> KeptLines0 = new List<Line>();
    List<Line> KeptLines1 = new List<Line>();
    List<Line> KeptLines2 = new List<Line>();
    List<Line> KeptLines3 = new List<Line>();
    List<Line> KeptLines4 = new List<Line>();
    List<Line> KeptLines5 = new List<Line>();

    int test = 0;
    double tol = 0.00001;
    Point3d[] PointArray = Pts.ToArray();
    InterpolateTensor(PointArray, Data, ref Evec1, ref Evec2, ref Evec3, ref Eval1, ref Eval2, ref Eval3);

    EV1 = Evec1;
    EV2 = Evec2;
    EV3 = Evec3;

    for (int currentPointIndex = 0; currentPointIndex < LinesForEachPoint.BranchCount; currentPointIndex++)
    {
      List<Line> Lines = LinesForEachPoint.Branch(currentPointIndex);

      double[] AnglesWithDir0 = new double[Lines.Count];
      double[] AnglesWithDir1 = new double[Lines.Count];
      double[] AnglesWithDir2 = new double[Lines.Count];
      double[] AnglesWithDir3 = new double[Lines.Count];
      double[] AnglesWithDir4 = new double[Lines.Count];
      double[] AnglesWithDir5 = new double[Lines.Count];

      int[] AngleIndicesWithDir0 = new int[Lines.Count];
      int[] AngleIndicesWithDir1 = new int[Lines.Count];
      int[] AngleIndicesWithDir2 = new int[Lines.Count];
      int[] AngleIndicesWithDir3 = new int[Lines.Count];
      int[] AngleIndicesWithDir4 = new int[Lines.Count];
      int[] AngleIndicesWithDir5 = new int[Lines.Count];

      bool[] foundLineForDirection = new bool[6];
      for(int i = 0;i < Lines.Count;i++)
      {
        if( (Lines[i].From - PointArray[currentPointIndex]).Length > tol)
        {
          Lines[i].Flip();
        }

        AngleIndicesWithDir0[i] = i;
        AngleIndicesWithDir1[i] = i;
        AngleIndicesWithDir2[i] = i;
        AngleIndicesWithDir3[i] = i;
        AngleIndicesWithDir4[i] = i;
        AngleIndicesWithDir5[i] = i;

        AnglesWithDir0[i] = Vector3d.VectorAngle(Lines[i].Direction, Evec1[currentPointIndex]);
        AnglesWithDir1[i] = Vector3d.VectorAngle(Lines[i].Direction, Evec2[currentPointIndex]);
        AnglesWithDir2[i] = Vector3d.VectorAngle(Lines[i].Direction, Evec3[currentPointIndex]);
        AnglesWithDir3[i] = Vector3d.VectorAngle(Lines[i].Direction, -Evec1[currentPointIndex]);
        AnglesWithDir4[i] = Vector3d.VectorAngle(Lines[i].Direction, -Evec2[currentPointIndex]);
        AnglesWithDir5[i] = Vector3d.VectorAngle(Lines[i].Direction, -Evec3[currentPointIndex]);

      }

      Array.Sort(AnglesWithDir0, AngleIndicesWithDir0);
      Array.Sort(AnglesWithDir1, AngleIndicesWithDir1);
      Array.Sort(AnglesWithDir2, AngleIndicesWithDir2);
      Array.Sort(AnglesWithDir3, AngleIndicesWithDir3);
      Array.Sort(AnglesWithDir4, AngleIndicesWithDir4);
      Array.Sort(AnglesWithDir5, AngleIndicesWithDir5);

      int index0 = 0;
      int index1 = 0;
      int index2 = 0;
      int index3 = 0;
      int index4 = 0;
      int index5 = 0;
      for(int j = 0; j < Lines.Count; j++)
      {
        //if the minimum angle line is the same for another direction and that angle is smaller, index0++
        if((AngleIndicesWithDir0[index0] == AngleIndicesWithDir1[0]) && (AnglesWithDir1[0] < AnglesWithDir0[index0])){index0++;}
        if((AngleIndicesWithDir0[index0] == AngleIndicesWithDir2[0]) && (AnglesWithDir2[0] < AnglesWithDir0[index0])){index0++;}
        if((AngleIndicesWithDir0[index0] == AngleIndicesWithDir3[0]) && (AnglesWithDir3[0] < AnglesWithDir0[index0])){index0++;}
        if((AngleIndicesWithDir0[index0] == AngleIndicesWithDir4[0]) && (AnglesWithDir4[0] < AnglesWithDir0[index0])){index0++;}
        if((AngleIndicesWithDir0[index0] == AngleIndicesWithDir5[0]) && (AnglesWithDir5[0] < AnglesWithDir0[index0])){index0++;}

        //if the minimum angle line is the same for another direction and that angle is smaller, index1++
        if((AngleIndicesWithDir1[index1] == AngleIndicesWithDir0[0]) && (AnglesWithDir0[0] < AnglesWithDir1[index1])){index1++;}
        if((AngleIndicesWithDir1[index1] == AngleIndicesWithDir2[0]) && (AnglesWithDir2[0] < AnglesWithDir1[index1])){index1++;}
        if((AngleIndicesWithDir1[index1] == AngleIndicesWithDir3[0]) && (AnglesWithDir3[0] < AnglesWithDir1[index1])){index1++;}
        if((AngleIndicesWithDir1[index1] == AngleIndicesWithDir4[0]) && (AnglesWithDir4[0] < AnglesWithDir1[index1])){index1++;}
        if((AngleIndicesWithDir1[index1] == AngleIndicesWithDir5[0]) && (AnglesWithDir5[0] < AnglesWithDir1[index1])){index1++;}

        //if the minimum angle line is the same for another direction and that angle is smaller, index2++
        if((AngleIndicesWithDir2[index2] == AngleIndicesWithDir0[0]) && (AnglesWithDir0[0] < AnglesWithDir2[index2])){index2++;}
        if((AngleIndicesWithDir2[index2] == AngleIndicesWithDir1[0]) && (AnglesWithDir1[0] < AnglesWithDir2[index2])){index2++;}
        if((AngleIndicesWithDir2[index2] == AngleIndicesWithDir3[0]) && (AnglesWithDir3[0] < AnglesWithDir2[index2])){index2++;}
        if((AngleIndicesWithDir2[index2] == AngleIndicesWithDir4[0]) && (AnglesWithDir4[0] < AnglesWithDir2[index2])){index2++;}
        if((AngleIndicesWithDir2[index2] == AngleIndicesWithDir5[0]) && (AnglesWithDir5[0] < AnglesWithDir2[index2])){index2++;}

        //if the minimum angle line is the same for another direction and that angle is smaller, index3++
        if((AngleIndicesWithDir3[index3] == AngleIndicesWithDir0[0]) && (AnglesWithDir0[0] < AnglesWithDir3[index3])){index3++;}
        if((AngleIndicesWithDir3[index3] == AngleIndicesWithDir1[0]) && (AnglesWithDir1[0] < AnglesWithDir3[index3])){index3++;}
        if((AngleIndicesWithDir3[index3] == AngleIndicesWithDir2[0]) && (AnglesWithDir2[0] < AnglesWithDir3[index3])){index3++;}
        if((AngleIndicesWithDir3[index3] == AngleIndicesWithDir4[0]) && (AnglesWithDir4[0] < AnglesWithDir3[index3])){index3++;}
        if((AngleIndicesWithDir3[index3] == AngleIndicesWithDir5[0]) && (AnglesWithDir5[0] < AnglesWithDir3[index3])){index3++;}

        //if the minimum angle line is the same for another direction and that angle is smaller, index4++
        if((AngleIndicesWithDir4[index4] == AngleIndicesWithDir0[0]) && (AnglesWithDir0[0] < AnglesWithDir4[index4])){index4++;}
        if((AngleIndicesWithDir4[index4] == AngleIndicesWithDir1[0]) && (AnglesWithDir1[0] < AnglesWithDir4[index4])){index4++;}
        if((AngleIndicesWithDir4[index4] == AngleIndicesWithDir2[0]) && (AnglesWithDir2[0] < AnglesWithDir4[index4])){index4++;}
        if((AngleIndicesWithDir4[index4] == AngleIndicesWithDir3[0]) && (AnglesWithDir3[0] < AnglesWithDir4[index4])){index4++;}
        if((AngleIndicesWithDir4[index4] == AngleIndicesWithDir5[0]) && (AnglesWithDir5[0] < AnglesWithDir4[index4])){index4++;}

        //if the minimum angle line is the same for another direction and that angle is smaller, index5++
        if((AngleIndicesWithDir5[index5] == AngleIndicesWithDir0[0]) && (AnglesWithDir0[0] < AnglesWithDir5[index5])){index5++;}
        if((AngleIndicesWithDir5[index5] == AngleIndicesWithDir1[0]) && (AnglesWithDir1[0] < AnglesWithDir5[index5])){index5++;}
        if((AngleIndicesWithDir5[index5] == AngleIndicesWithDir2[0]) && (AnglesWithDir2[0] < AnglesWithDir5[index5])){index5++;}
        if((AngleIndicesWithDir5[index5] == AngleIndicesWithDir3[0]) && (AnglesWithDir3[0] < AnglesWithDir5[index5])){index5++;}
        if((AngleIndicesWithDir5[index5] == AngleIndicesWithDir4[0]) && (AnglesWithDir4[0] < AnglesWithDir5[index5])){index5++;}
      }

      if(index0 < Lines.Count)
      {
        KeptLines0.Add(Lines[AngleIndicesWithDir0[index0]]);
      }

      if(index1 < Lines.Count)
      {
        KeptLines1.Add(Lines[AngleIndicesWithDir1[index1]]);
      }

      if(index2 < Lines.Count)
      {
        KeptLines2.Add(Lines[AngleIndicesWithDir2[index2]]);
      }

      if(index3 < Lines.Count)
      {
        KeptLines3.Add(Lines[AngleIndicesWithDir3[index3]]);
      }

      if(index4 < Lines.Count)
      {
        KeptLines4.Add(Lines[AngleIndicesWithDir0[index4]]);
      }

      if(index5 < Lines.Count)
      {
        KeptLines5.Add(Lines[AngleIndicesWithDir5[index5]]);
      }


    }

    F0 = KeptLines0;
    F1 = KeptLines1;
    F2 = KeptLines2;
    F3 = KeptLines3;
    F4 = KeptLines4;
    F5 = KeptLines5;

    A = test;


    //    /*
    //
    //    InterpolateTensor(Pts.ToArray(), localData, ref Evec1, ref Evec2, ref Evec3, ref Eval1, ref Eval2, ref Eval3);
    //
    //
    //
    //    var ix = new List<int>();
    //
    //    if(Evec1 != null && Evec2 != null && Evec3 != null || true){
    //      for(int i = 0; i < Pts.Count;i++)
    //      {
    //        PS.AddParticle(Pts[i], 1); //add a particle for every point
    //        ix.Add(i);
    //        Ellipsoids.Add(new Ellipsoid(Pts[i]));
    //
    //        //translate these values to rs and rl
    //
    //        double ClampEval = Math.Max(Eval1[i], ev1min);
    //        ClampEval = Math.Min(ClampEval, ev1max);
    //
    //        double evParam = (ClampEval - ev1min) / (ev1max - ev1min);
    //
    //        double effectiveLongAxisLength = minLongAxisLength + (1 - evParam) * (maxLongAxisLength - minLongAxisLength);
    //
    //        // double effectiveLongAxisLength = minLongAxisLength + (Eval1[i] - ev1max) / (ev1min - ev1max) * (maxLongAxisLength - minLongAxisLength);
    //
    //        //   effectiveLongAxisLength = Math.Max(Math.Min(Math.Abs(effectiveLongAxisLength), maxLongAxisLength / scaleEllipsoids), minLongAxisLength / scaleEllipsoids);
    //        La.Add(scaleEllipsoids * effectiveLongAxisLength * Evec1[i]);
    //
    //        //double ratio = Math.Max(Math.Min(Math.Abs(Eval2[i]), maxLongAxisLength / scaleEllipsoids) / effectiveLongAxisLength, minSlenderness);
    //        double ratio = Math.Max(minSlenderness, Eval2[i] / Eval1[i]);
    //
    //        Sa.Add(scaleEllipsoids * ratio * effectiveLongAxisLength * Evec2[i]);
    //
    //        //if this ellipsoid is a sphere, it can have maximally a radius of maxRadiusCofficient*maxLongAxisLength; This is to restrict the volume.
    //        double maxRadiusCoefficient = 0.75;
    //        double volumeRatio = maxRadiusCoefficient * maxLongAxisLength / (Math.Pow(ratio * ratio, 0.33333333) * effectiveLongAxisLength);
    //        if( volumeRatio < 1)
    //        {
    //          Sa[i] *= volumeRatio;
    //          La[i] *= volumeRatio;
    //          effectiveLongAxisLength *= volumeRatio;
    //        }
    //
    //        Ellipsoids[i].updateTransform(scaleEllipsoids * effectiveLongAxisLength * Evec1[i], scaleEllipsoids * ratio * effectiveLongAxisLength * Evec2[i], scaleEllipsoids * ratio * effectiveLongAxisLength * Evec3[i]);
    //      }
    //    }
    //
    //    GoalList.Add(new KangarooSolver.Goals.SolidPoint(ix, M, true, boundaryCollideStrength));
    //
    //    for(int i = 0;i < FixedPointIndices.Count();i++)
    //    {
    //      GoalList.Add(new KangarooSolver.Goals.Anchor(FixedPointIndices[i], Pts[FixedPointIndices[i]], 10000));
    //    }
    //    count = 0;
    //    EnergySum = double.MaxValue;
    //
    //    isInitialized = true;
    //    A = Pts[FixedPointIndices[FixedPointIndices.Count() - 1]];
    //  }
    //  else
    //  {
    //  double totalOverlap = 0.0;
    //  Running = Run;
    //
    //  int GoalsToKeep = 1 + FixedPointIndices.Count(); //Note that if more goals are added in the in the initialization, this number should be increased accordingly
    //  GoalList.RemoveRange(GoalsToKeep, GoalList.Count - GoalsToKeep); //clear everything apart from the SolidPoint Goal.
    //
    //  (GoalList[0] as KangarooSolver.Goals.SolidPoint).Strength = boundaryCollideStrength;
    //
    //  var Positions = PS.GetPositionArray();
    //
    //  //update the ellipsoid transformations from field
    //  InterpolateTensor(Positions, localData, ref Evec1, ref Evec2, ref Evec3, ref Eval1, ref Eval2, ref Eval3);
    //
    //
    //  for(int i = 0; i < Positions.Count();i++)
    //  if(Evec1 != null && Evec2 != null && Evec3 != null || true){
    //  {
    //
    //  double ClampEval = Math.Max(Eval1[i], ev1min);
    //  ClampEval = Math.Min(ClampEval, ev1max);
    //  double evParam = (ClampEval - ev1min) / (ev1max - ev1min);
    //  double effectiveLongAxisLength = minLongAxisLength + (1 - evParam) * (maxLongAxisLength - minLongAxisLength);
    //
    //
    //  // double effectiveLongAxisLength = minLongAxisLength + (Eval1[i] - ev1max) / (ev1min - ev1max) * (maxLongAxisLength - minLongAxisLength);
    //  //   effectiveLongAxisLength = Math.Max(Math.Min(Math.Abs(effectiveLongAxisLength), maxLongAxisLength / scaleEllipsoids), minLongAxisLength / scaleEllipsoids);
    //  La[i] = scaleEllipsoids * effectiveLongAxisLength * Evec1[i];
    //
    //  //double ratio = Math.Max(Math.Min(Math.Abs(Eval2[i]), maxLongAxisLength / scaleEllipsoids) / effectiveLongAxisLength, minSlenderness);
    //  double ratio = Math.Max(minSlenderness, Eval2[i] / Eval1[i]);
    //
    //  Sa[i] = scaleEllipsoids * ratio * effectiveLongAxisLength * Evec2[i];
    //
    //  //if this ellipsoid is a sphere, it can have maximally a radius of maxRadiusCofficient*maxLongAxisLength; This is to restrict the volume.
    //  double maxRadiusCoefficient = 0.5;
    //  double volumeRatio = maxRadiusCoefficient * maxLongAxisLength / (Math.Pow(ratio * ratio, 0.33333333) * effectiveLongAxisLength);
    //  if( volumeRatio < 1)
    //  {
    //  Sa[i] *= volumeRatio;
    //  La[i] *= volumeRatio;
    //  effectiveLongAxisLength *= volumeRatio;
    //}
    //
    //            Ellipsoids[i].updateTransform(scaleEllipsoids * effectiveLongAxisLength * Evec1[i], scaleEllipsoids * ratio * effectiveLongAxisLength * Evec2[i], scaleEllipsoids * ratio * effectiveLongAxisLength * Evec3[i]);
    //
    //          }
    //        }
    //
    //      //A pair of matching lists to contain the collisions
    //List<int> CollideRef0 = new List<int>();
    //List<int> CollideRef1 = new List<int>();
    //
    //      //use SAP to find AABB collisions
    //
    //      SweepAndPrune(Ellipsoids, Positions, ref CollideRef0, ref CollideRef1);
    //
    //      //narrow phase collision
    //
    //      var ConnectedEdges = new List<int>[Positions.Length];
    //for(int i = 0;i < Positions.Length;i++)
    //      {
    //        ConnectedEdges[i] = new List<int>();
    //      }
    //
    //      LineList.Clear();
    //for(int i = 0;i < CollideRef0.Count();i++)
    //      {
    //int ea = CollideRef0[i];
    //int eb = CollideRef1[i];
    //        var Collision = new EllipsoidCollide(Ellipsoids[ea], Ellipsoids[eb]);
    //double PushDistance = Collision.CalculateCollision();
    //
    //        if(PushDistance != -1 )
    //        {
    //          //GoalList.Add(new KangarooSolver.Goals.Spring(eb, ea, PushDistance, 1));
    //
    //          GoalList.Add(new NonLinearRepel(eb, ea, PushDistance, 1, 0.01, -2));
    //
    //Line L = new Line(Positions[ea], Positions[eb]);
    //
    //          GoalList.Add(new Align(eb, ea, new Vector3d[3]
    //            {
    //            0.5 * (Ellipsoids[ea].unitXAxis + Ellipsoids[eb].unitXAxis),
    //            0.5 * (Ellipsoids[ea].unitYAxis + Ellipsoids[eb].unitYAxis),
    //            0.5 * (Ellipsoids[ea].unitZAxis + Ellipsoids[eb].unitZAxis),
    //            }, AlignStrength));
    //
    //          //
    //          //          if(PushDistance > EdgeLengthFactor)
    //          //          {
    //          //            LineList.Add(L);
    //          //          }
    //
    //double LLen = L.Length;
    //
    //          if((PushDistance - LLen) / LLen > EdgeLengthFactor)
    //          {
    //            LineList.Add(L);
    //            ConnectedEdges[ea].Add(LineList.Count - 1);
    //            ConnectedEdges[eb].Add(LineList.Count - 1);
    //          }
    //
    //          //
    //          //          if((PushDistance - LLen) > EdgeLengthFactor)
    //          //          {
    //          //            LineList.Add(L);
    //          //          }
    //
    //
    //if(!Double.IsNaN(PushDistance))
    //{
    //  totalOverlap = totalOverlap + 2 * Math.Abs(PushDistance);
    //}
    //        }
    //
    //
    //      }
    //
    //      //create spring forces and add to goals
    //      //for all pairs colliding, also add alignment
    //
    //      PS.SimpleStep(GoalList);
    //
    //
    //
    //
    //
    //      //evaluate pressure, and increase the scaling factor if needed
    //      AA = Eval3;
    //      BB = totalOverlap;
    //      if(adaptToPressure)
    //      {
    //        updateScale(ref scaleEllipsoids, ref totalOverlap, ref Ellipsoids, ref targetPressure);
    //      }
    //      //Output the mesh, and how many iterations it took to converge
    //      EllipsoidCenters = PS.GetPositionsGH();
    //
    //      LongAxes = La;
    //      ShortAxes = Sa;
    //
    //      count++;
    //      if(count % StopAtNoDecrease == 0)
    //      {
    //if(PS.GetvSum() >= EnergySum)  // GetvSum returns the sum of the squares of the particle velocities
    //{
    //  Running = false;
    //}
    //        EnergySum = PS.GetvSum();
    //      }
    //
    //
    //
    //      Iterations = count;
    //
    //
    //      //optional post-packing connectivity culling
    //      if(ValenceFilter)
    //      {
    //        var Keep = new bool[LineList.Count];
    //for(int i = 0;i < Pts.Count;i++)
    //        {
    //int CurrentValence = ConnectedEdges[i].Count;
    //          var EdgeIndices = new int[CurrentValence];
    //int TargetValence = 6;// TODO: Replace this for boundary faces/edges
    //
    //          var EdgeLengths = new double[CurrentValence];
    //
    //for(int j = 0;j < CurrentValence;j++)
    //          {
    //EdgeLengths[j] = LineList[ConnectedEdges[i][j]].Length;
    //            EdgeIndices[j] = j;
    //          }
    //
    //          Array.Sort(EdgeLengths, EdgeIndices);
    //
    //int Maximum = Math.Min(TargetValence, ConnectedEdges[i].Count);
    //for(int j = 0;j < Maximum;j++)
    //          {
    //Keep[ConnectedEdges[i][EdgeIndices[j]]] = true;
    //          }
    //        }
    //
    //        var KeptLines = new List<Line>();
    //for(int i = 0;i < LineList.Count;i++)
    //        {
    //          if(Keep[i])
    //          {
    //            KeptLines.Add(LineList[i]);
    //          }
    //        }
    //
    //        Lines = KeptLines;
    //
    //      }
    //      else
    //      {
    //        Lines = LineList;
    //      }
    //
    //
    //
    //
    //
    //
    //      EE = ev1mean;
    //      EEE = ev1stdev;
    //      EEEE = ev1min;
    //    }
    //
    //
# ---------- filter_by_valence: C# additional code ----------
  //
  //
  //
  //List<Vector3d> Evec1 = new List<Vector3d>();
  //List<Vector3d> Evec2 = new List<Vector3d>();
  //List<Vector3d> Evec3 = new List<Vector3d>();
  //
  //List<double> Eval1 = new List<double>();
  //List<double> Eval2 = new List<double>();
  //List<double> Eval3 = new List<double>();
  //
  //List<double> localData = new List<double>();
  //
  //List<Vector3d> La = new List<Vector3d>();
  //List<Vector3d> Sa = new List<Vector3d>();
  //
  //  //this makes the component autorefresh
  //
  //public override void AfterRunScript()
  //{
  //  if(Running)
  //  {
  //    GH_Document doc = this.Component.OnPingDocument();
  //    GH_Document.GH_ScheduleDelegate callback = new GH_Document.GH_ScheduleDelegate(ScheduleCallback);
  //    doc.ScheduleSolution(1, callback);
  //  }
  //}
  //
  //private void ScheduleCallback(GH_Document doc)
  //{
  //  this.Component.ExpireSolution(false);
  //}
  //
  //public static double StdDev(ref List<double> values)
  //{
  //  double ret = 0;
  //  int count = values.Count();
  //  if (count > 1)
  //  {
  //    //Compute the Average
  //    double avg = values.Average();
  //
  //    //Perform the Sum of (value-avg)^2
  //    double sum = values.Sum(d => (d - avg) * (d - avg));
  //
  //    //Put it all together
  //    ret = Math.Sqrt(sum / count);
  //  }
  //  return ret;
  //}
  //
  //public void updateScale(ref double scale, ref double totalAbsOverlap, ref List<Ellipsoid> ellis, ref double target)
  //{
  //  if(totalAbsOverlap < target){
  //    scale = scale * 1.01;
  //    for(int i = 0; i < ellis.Count(); i++){
  //      ellis[i].scale(scale);
  //    }
  //  }
  //  else{
  //    scale = scale * 0.99;
  //  }
  //}
  //
  public void InterpolateTensor(Point3d[] Pts, List<double> Data, ref List<Vector3d> Evec1, ref List<Vector3d> Evec2, ref List<Vector3d> Evec3, ref List<double> Eval1, ref List<double> Eval2, ref List<double> Eval3)
  {    int nOfPoints = Pts.Count();

    List<Point3d> G = new List<Point3d>();
    List<double> T0 = new List<double>();
    List<double> T1 = new List<double>();
    List<double> T2 = new List<double>();
    List<double> T3 = new List<double>();
    List<double> T4 = new List<double>();
    List<double> T5 = new List<double>();

    while(Data.Any())
    {
      List <double> localDataList = Data.Take(9).ToList();

      G.Add(new Point3d(localDataList[0], localDataList[1], localDataList[2]));

      T0.Add(localDataList[3]);
      T1.Add(localDataList[4]);
      T2.Add(localDataList[5]);
      T3.Add(localDataList[6]);
      T4.Add(localDataList[7]);
      T5.Add(localDataList[8]);

      Data = Data.Skip(9).ToList();
    }

    var EigenVectors = new Vector3d[nOfPoints][];
    var EigenValues = new Double[nOfPoints][];

    var EVA = new Vector3d[nOfPoints];
    var EVB = new Vector3d[nOfPoints];
    var EVC = new Vector3d[nOfPoints];
    var EigenValuesA = new double[nOfPoints];
    var EigenValuesB = new double[nOfPoints];
    var EigenValuesC = new double[nOfPoints];

    //find grid count and size
    int xCount, yCount, zCount;
    xCount = yCount = zCount = 0;
    double xSize, ySize, zSize;
    xSize = ySize = zSize = 0;

    var Tensors = new StressTensor[G.Count];
    for(int i = 0;i < G.Count;i++)
    {
      Tensors[i] = new StressTensor(new List<double>{T0[i],T1[i],T2[i],T1[i],T3[i],T4[i],T2[i],T4[i],T5[i]});
    }
    Array.Sort(G.ToArray(), Tensors);

    G.Sort();

    zSize = G[1].Z - G[0].Z;

    for(int i = 1;i < G.Count;i++)
    {
      if(G[i].Y > G[0].Y)
      {
        ySize = G[i].Y - G[0].Y;
        zCount = i;
        break;
      }
    }

    for(int i = 1;i < G.Count;i++)
    {
      if(G[i].X > G[0].X)
      {
        xSize = G[i].X - G[0].X;
        yCount = i / zCount;
        break;
      }
    }

    xCount = G.Count / (zCount * yCount);

    var Grid = new StressTensor[xCount, yCount, zCount];

    for(int i = 0; i < xCount;i++)
    {
      for(int j = 0; j < yCount; j++)
      {
        for(int k = 0; k < zCount; k++)
        {
          Grid[i, j, k] = Tensors[k + j * zCount + i * zCount * yCount];
        }
      }
    }
    // for each point in P, find its coordinates in the grid
    // output the 8 points/indices of the corners
    // and the point coordinates of the position within that cell

    var arrayOfCellCoords = new Point3d[nOfPoints]; // always in [0,1]^3
    var arrayOfTensors0 = new double[nOfPoints][];
    var arrayOfTensors1 = new double[nOfPoints][];
    var arrayOfTensors2 = new double[nOfPoints][];
    var arrayOfTensors3 = new double[nOfPoints][];
    var arrayOfTensors4 = new double[nOfPoints][];
    var arrayOfTensors5 = new double[nOfPoints][];
    var arrayOfTensors6 = new double[nOfPoints][];
    var arrayOfTensors7 = new double[nOfPoints][];

    System.Threading.Tasks.Parallel.For(0, nOfPoints,
      j => {
      var PVec = Pts[j] - G[0];  //position vector of the current point relative to grid origin

      var PX = PVec.X / xSize;
      var PY = PVec.Y / ySize;
      var PZ = PVec.Z / zSize;

      int PXF,PXC,PYF,PYC,PZF,PZC;

      var CoordsInCell = new Point3d();

      if(PX < 0)
      {
        PXF = 0; PXC = 1; CoordsInCell.X = 0;
      }
      else if(PX > xCount - 1)
      {
        PXF = xCount - 2; PXC = xCount - 1; CoordsInCell.X = 1;
      }
      else
      {
        PXF = (int) Math.Floor(PX); PXC = (int) Math.Ceiling(PX); CoordsInCell.X = PX - PXF;
      }


      if(PY < 0)
      {
        PYF = 0; PYC = 1; CoordsInCell.Y = 0;
      }
      else if(PY > yCount - 1)
      {
        PYF = yCount - 2; PYC = yCount - 1; CoordsInCell.Y = 1;
      }
      else
      {
        PYF = (int) Math.Floor(PY); PYC = (int) Math.Ceiling(PY); CoordsInCell.Y = PY - PYF;
      }


      if(PZ < 0)
      {
        PZF = 0; PZC = 1; CoordsInCell.Z = 0;
      }
      else if(PZ > zCount - 1)
      {
        PZF = zCount - 2; PZC = zCount - 1; CoordsInCell.Z = 1;
      }
      else
      {
        PZF = (int) Math.Floor(PZ); PZC = (int) Math.Ceiling(PZ); CoordsInCell.Z = PZ - PZF;
      }


      //
      //      int PXF = Math.Max(Math.Min((int) Math.Floor(PX), xCount - 1), 0);
      //      int PYF = Math.Max(Math.Min((int) Math.Floor(PY), yCount - 1), 0);
      //      int PZF = Math.Max(Math.Min((int) Math.Floor(PZ), zCount - 1), 0);
      //
      //      int PXC = Math.Max(Math.Min((int) Math.Ceiling(PX), xCount - 1), 0);
      //      int PYC = Math.Max(Math.Min((int) Math.Ceiling(PY), yCount - 1), 0);
      //      int PZC = Math.Max(Math.Min((int) Math.Ceiling(PZ), zCount - 1), 0);

      //     arrayOfCellCoords[j] = new Point3d(Math.Min(Math.Max(PX - PXF, 0), 1), Math.Min(Math.Max(PY - PYF, 0), 1), Math.Min(Math.Max(PZ - PZF, 0), 1));

      arrayOfCellCoords[j] = CoordsInCell;

      arrayOfTensors0[j] = Grid[PXF, PYF, PZF].Values;
      arrayOfTensors1[j] = Grid[PXF, PYF, PZC].Values;
      arrayOfTensors2[j] = Grid[PXF, PYC, PZF].Values;
      arrayOfTensors3[j] = Grid[PXF, PYC, PZC].Values;
      arrayOfTensors4[j] = Grid[PXC, PYF, PZF].Values;
      arrayOfTensors5[j] = Grid[PXC, PYF, PZC].Values;
      arrayOfTensors6[j] = Grid[PXC, PYC, PZF].Values;
      arrayOfTensors7[j] = Grid[PXC, PYC, PZC].Values;

      var Corners = new StressTensor[8];

      Corners[0] = new StressTensor();
      Corners[1] = new StressTensor();
      Corners[2] = new StressTensor();
      Corners[3] = new StressTensor();
      Corners[4] = new StressTensor();
      Corners[5] = new StressTensor();
      Corners[6] = new StressTensor();
      Corners[7] = new StressTensor();

      Corners[0].Values = (double[]) arrayOfTensors0[j];
      Corners[1].Values = (double[]) arrayOfTensors1[j];
      Corners[2].Values = (double[]) arrayOfTensors2[j];
      Corners[3].Values = (double[]) arrayOfTensors3[j];
      Corners[4].Values = (double[]) arrayOfTensors4[j];
      Corners[5].Values = (double[]) arrayOfTensors5[j];
      Corners[6].Values = (double[]) arrayOfTensors6[j];
      Corners[7].Values = (double[]) arrayOfTensors7[j];

      var EVec = new Vector3d[3];
      var EVal = new Double[3];

      var T = new Double[3]{arrayOfCellCoords[j].X,arrayOfCellCoords[j].Y,arrayOfCellCoords[j].Z};
      //var T = new Double[3]{0.5,0.5,0.5};

      StressTensor tensorAtPoint = TriLinearInterpolate(Corners, T);
      EigenSolve(tensorAtPoint.Values, out EVal, out EVec);

      int[] ott = new int[3]; // o ne, t wo, t hree
      ott[0] = 0;
      ott[1] = 1;
      ott[2] = 2;
      double[] ev = new double[]{Math.Abs(EVal[0]),Math.Abs(EVal[1]),Math.Abs(EVal[2])};
      //sort according to maximum absolute value of Eval
      Array.Sort(ev, ott);

      EVA[j] = EVec[ott[2]];
      EVB[j] = EVec[ott[1]];
      EVC[j] = EVec[ott[0]];

      EigenValuesA[j] = Math.Abs(EVal[ott[2]]);
      EigenValuesB[j] = Math.Abs(EVal[ott[1]]);
      EigenValuesC[j] = Math.Abs(EVal[ott[0]]);
      });

    Evec1 = EVA.ToList();
    Evec2 = EVB.ToList();
    Evec3 = EVC.ToList();
    Eval1 = EigenValuesA.ToList();
    Eval2 = EigenValuesB.ToList();
    Eval3 = EigenValuesC.ToList();
  }

  //public void SweepAndPrune(List < Ellipsoid > Ellipsoids, Point3d[] Positions, ref List<int> CollideRef0, ref List<int> CollideRef1)
  //{
  //  List <AABB> boxes = new List<AABB>();
  //
  //  //use the points to create AABB objects
  //  for (int i = 0; i < Ellipsoids.Count; i++)
  //  {
  //    Ellipsoids[i].position = Positions[i];
  //    Ellipsoids[i].calculateBoundingBox();
  //
  //    boxes.Add(new AABB(Ellipsoids[i].boundingBoxMin, Ellipsoids[i].boundingBoxMax, i));
  //  }
  //
  //  List <EndPoint> sortedInX = new List<EndPoint>();
  //
  //  //add the endpoints in x
  //  foreach (AABB boxForPoint in boxes) {
  //    sortedInX.Add(boxForPoint.min[0]);//change this 0 to 1 or 2 to sort in Y or Z - will also need to change the second half of the test function
  //    sortedInX.Add(boxForPoint.max[0]);//change this 0 to 1 or 2 to sort in Y or Z
  //  }
  //
  //  //sort by the num value of each EndPoint
  //  sortedInX.Sort(EndPoint.compareEndPoints);
  //
  //  List <int> openBoxes = new List<int>();
  //
  //  foreach (EndPoint endPoint in sortedInX)
  //  {
  //    if (endPoint.isMin)
  //    {
  //      AABB thisPointOwner = endPoint.owner;
  //      //check against all in openBoxes
  //      foreach(int openBoxRef in openBoxes) {
  //        //if it collides output the integers of the branches than collide
  //        //do they collide in y?
  //        if(thisPointOwner.max[1].num > boxes[openBoxRef].min[1].num && thisPointOwner.min[1].num < boxes[openBoxRef].max[1].num) {
  //          //they collide in y, do they collide in z?
  //          if(thisPointOwner.max[2].num > boxes[openBoxRef].min[2].num && thisPointOwner.min[2].num < boxes[openBoxRef].max[2].num) {
  //            //they collide in z
  //            //therefore they collide! Add to the list of collide refs
  //            CollideRef0.Add(endPoint.owner.branchRef);
  //            CollideRef1.Add(boxes[openBoxRef].branchRef);
  //          }
  //        }
  //      }
  //      //add corresponding box to openBoxes
  //      openBoxes.Add(thisPointOwner.branchRef);
  //
  //    } else
  //    {
  //      //it must be an max point
  //      //remove corresponding box from openBoxes
  //      openBoxes.Remove(endPoint.owner.branchRef);
  //    }
  //  }
  //
  //}
  //
  //public class EllipsoidCollide // No longer a Goal object itself. This can detect collision and output info then used for the actual goal
  //{
  //
  //  Ellipsoid e1;
  //  Ellipsoid e2;
  //
  //  public double overlap;
  //  public double extension;
  //
  //  public EllipsoidCollide(Ellipsoid _e1, Ellipsoid _e2)
  //  {
  //    e1 = _e1;
  //    e2 = _e2;
  //  }
  //
  //  public double CalculateCollision()
  //  {
  //
  //    e1.calculateAxesAndScales();
  //    e2.calculateAxesAndScales();
  //
  //    //calculate distance vectors back and forth, and the length of the distance
  //    //this will become part of the narrow phase check
  //    Vector3d pjk = new Vector3d(e2.position - e1.position);
  //    double pjkLength = pjk.Length;
  //    Vector3d pkj = new Vector3d(-pjk);
  //
  //    //store direction before transforming distance vectors
  //    Vector3d pushVector = new Vector3d(pjk);
  //
  //    //Transform connection vector onto "sphere" coordinates of either ellipsoid
  //    e1.calculateInverse();
  //    e2.calculateInverse();
  //    //find length of vector inside each ellipsoid
  //    double jDistance = e1.findDistanceInside(pjk);
  //    double kDistance = e2.findDistanceInside(pkj);
  //
  //    double touchingDistance = jDistance + kDistance;
  //    if(pjkLength - (touchingDistance) < 0)
  //    {
  //      return touchingDistance;
  //    }
  //    else
  //    {
  //      return -1;
  //    }
  //
  //    //      //longest overlap is:
  //    //      extension = pjkLength - (jDistance + kDistance);
  //    //
  //    //      //scalar w quantifying overlap in ]0,1]. w = 1 means no overlap, w close to 0 means a lot of overlap
  //    //      double overlap = pjkLength / (jDistance + kDistance);
  //    //
  //    //      if(overlap <= 1.0 && overlap > 0)
  //    //      {
  //    //        pushVector.Unitize();
  //    //        return extension * pushVector;
  //    //      } else
  //    //      {
  //    //        return Vector3d.Zero;
  //    //      }
  //
  //  }
  //
  //}
  //
  //public class Ellipsoid {
  //
  //  //centre point of the ellipsoid
  //  public Point3d position;
  //  //transform matrix that defines the scale and rotation make 3x3 (but really a 1x9)
  //  double[] transform;
  //  //the inverse transform this is calculated once and then referenced..
  //  double[] inverse;
  //
  //  //unitized vectors for the axis
  //  //perhaps store the squared values as they are
  //  public Vector3d unitXAxis;
  //  double scaleX;
  //  public Vector3d unitYAxis;
  //  double scaleY;
  //  public Vector3d unitZAxis;
  //  double scaleZ;
  //
  //  //points defining the bounding box
  //  public Point3d boundingBoxMin;
  //  public Point3d boundingBoxMax;
  //
  //  //constructor
  //  public Ellipsoid(Point3d tPos) {
  //    //set the values use Vector3d.Axis and caluate bounding box function
  //    position = tPos;
  //
  //    //set the transfrom as an identity matrix
  //    transform = new double[]{1,0,0,0,1,0,0,0,1};
  //    inverse = new double[]{1,0,0,0,1,0,0,0,1};
  //
  //    //could use calculateAxes but a waste of three unitize calls!
  //    unitXAxis = Vector3d.XAxis;
  //    scaleX = 1.0;
  //    unitYAxis = Vector3d.YAxis;
  //    scaleY = 1.0;
  //    unitZAxis = Vector3d.ZAxis;
  //    scaleZ = 1.0;
  //
  //    calculateBoundingBox();
  //  }
  //
  //  //takes an set of vectors and updates the transform - taken from the eigenvectors of the interpolated field
  //  public void updateTransform(Vector3d xAxis, Vector3d yAxis, Vector3d zAxis) {
  //    transform[0] = xAxis[0];
  //    transform[3] = xAxis[1];
  //    transform[6] = xAxis[2];
  //
  //    transform[1] = yAxis[0];
  //    transform[4] = yAxis[1];
  //    transform[7] = yAxis[2];
  //
  //    transform[2] = zAxis[0];
  //    transform[5] = zAxis[1];
  //    transform[8] = zAxis[2];
  //  }
  //
  //  public void scale(double s)
  //  {
  //    for(int i = 0; i < 9;i++)
  //    {
  //      transform[i] = s * transform[i];
  //    }
  //  }
  //
  //  public void calculateInverse() {
  //    inverse[0] = transform[0] / (scaleX * scaleX);
  //    inverse[1] = transform[3] / (scaleX * scaleX);
  //    inverse[2] = transform[6] / (scaleX * scaleX);
  //
  //    inverse[3] = transform[1] / (scaleY * scaleY);
  //    inverse[4] = transform[4] / (scaleY * scaleY);
  //    inverse[5] = transform[7] / (scaleY * scaleY);
  //
  //    inverse[6] = transform[2] / (scaleZ * scaleZ);
  //    inverse[7] = transform[5] / (scaleZ * scaleZ);
  //    inverse[8] = transform[8] / (scaleZ * scaleZ);
  //  }
  //
  //  //calculate and return boundingBox
  //  public void calculateBoundingBox() {
  //    //takes a transform matrix representation of an ellipsoid and returns two points defining the min x,y,z and max x,y,x
  //    double[] minAndMaxX = getMinAndMax(position.X, 0);
  //    double[] minAndMaxY = getMinAndMax(position.Y, 3);
  //    double[] minAndMaxZ = getMinAndMax(position.Z, 6);
  //
  //    boundingBoxMin = new Point3d(minAndMaxX[0], minAndMaxY[0], minAndMaxZ[0]);
  //    boundingBoxMax = new Point3d(minAndMaxX[1], minAndMaxY[1], minAndMaxZ[1]);
  //
  //
  //  }
  //
  //  //method used by the calculate bounding box method
  //  private double[] getMinAndMax(double position, int adder) {
  //    double m11 = transform[adder];
  //    double m12 = transform[adder + 1];
  //    double m13 = transform[adder + 2];
  //    double d = Math.Sqrt(m11 * m11 + m12 * m12 + m13 * m13);
  //    double[] minMax = { position - d, position + d };
  //    return minMax;
  //  }
  //
  //  //set updated unit vectors for
  //  public void calculateAxesAndScales() {
  //    unitXAxis = new Vector3d(transform[0], transform[3], transform[6]);
  //    scaleX = unitXAxis.Length;
  //    unitXAxis.Unitize();
  //    unitYAxis = new Vector3d(transform[1], transform[4], transform[7]);
  //    scaleY = unitYAxis.Length;
  //    unitYAxis.Unitize();
  //    unitZAxis = new Vector3d(transform[2], transform[5], transform[8]);
  //    scaleZ = unitZAxis.Length;
  //    unitZAxis.Unitize();
  //  }
  //
  //  //combines the postion and the transform to create an Affine transform
  //  public double[] createAffineTransform() {
  //    return new double[]{transform[0],transform[1],transform[2],position[0],transform[3],transform[4],transform[5],position[1],transform[6],transform[7],transform[8],position[2],0,0,0,1};
  //  }
  //
  //  //using similarity ratios: 1/transformedLength = distanceInside/inputlegth
  //  public double findDistanceInside(Vector3d inputVector) {
  //    Vector3d transformed = transformVector(inputVector);
  //    return inputVector.Length / transformed.Length;
  //  }
  //
  //  //method used by findDistanceInside method
  //  private Vector3d transformVector(Vector3d toTransform) {
  //    Vector3d transformedVector = new Vector3d();
  //    transformedVector[0] = inverse[0] * toTransform[0] + inverse[1] * toTransform[1] + inverse[2] * toTransform[2];
  //    transformedVector[1] = inverse[3] * toTransform[0] + inverse[4] * toTransform[1] + inverse[5] * toTransform[2];
  //    transformedVector[2] = inverse[6] * toTransform[0] + inverse[7] * toTransform[1] + inverse[8] * toTransform[2];
  //    return transformedVector;
  //  }
  //}
  //
  //public class AABB {
  //  public EndPoint[] min;//an array of size 3 with the x,y,z value for the AABB min
  //  public EndPoint[] max;//an array of size 3 with the x,y,z value for the AABB max
  //  public int branchRef;
  //
  //  //constructor
  //  public AABB(Point3d tMin, Point3d tMax, int tBranchRef) {
  //    min = new EndPoint[] {new EndPoint(tMin.X, true, this), new EndPoint(tMin.Y, true, this), new EndPoint(tMin.Z, true, this)};
  //    max = new EndPoint[] {new EndPoint(tMax.X, false, this), new EndPoint(tMax.Y, false, this), new EndPoint(tMax.Z, false, this)};
  //    branchRef = tBranchRef;
  //  }
  //}
  //
  //public class EndPoint {
  //  public AABB owner;
  //  public double num;//its actual value - corresponds to the x,y or z value
  //  public bool isMin;//is this a min point or a max point?
  //
  //  //constructor
  //  public EndPoint(double tNum, bool tIsMin, AABB tOwner) {
  //    num = tNum;
  //    isMin = tIsMin;
  //    owner = tOwner;
  //  }
  //
  //  //used as a comparison to sort the endpoints
  //  public static int compareEndPoints(EndPoint x, EndPoint y)
  //  {
  //    return x.num.CompareTo(y.num);
  //  }
  //}
  public class StressTensor
  {
    public double[] Values;

    public StressTensor()
    {
      Values = new Double[9]{0,0,0,0,0,0,0,0,0};
    }

    public StressTensor(List < double > Vals)
    {
      Values = Vals.ToArray();
    }
  }
  //
  //
  //
  //
  public StressTensor LinearInterpolate(StressTensor TensorA, StressTensor TensorB, double T)
  {
    var Interp = new StressTensor();
    int NaNorZeroCount = 0;
    for(int i = 0;i < 9;i++)
    {
      Interp.Values[i] = 0;
      if(!Double.IsNaN(TensorA.Values[i]) )
      {
        Interp.Values[i] += (1 - T) * TensorA.Values[i];
      }
      else{
        Interp.Values[i] += (1 - T) * TensorB.Values[i];
        NaNorZeroCount++;
      }
      if(!Double.IsNaN(TensorB.Values[i]))
      {
        Interp.Values[i] += T * TensorB.Values[i];
      }
      else{
        Interp.Values[i] += T * TensorA.Values[i];
        NaNorZeroCount++;
      }

      if(NaNorZeroCount == 2)
      {
        Interp.Values[i] = double.NaN;
      }
    }

    return Interp;

  }


  /// <summary>
  /// given stress tensors at the 8 corners of a cube, and coordinates of a point within that cube
  /// perform a trilinear interpolation
  /// </summary>
  /// <param name="CornerTensors">Tensor values at the corners, ordered 000,001,010,011,100,101,110,111</param>
  /// <param name="T">3 numbers in the range 0 to 1</param>
  /// <returns>the interpolated stress tensor at the given coordinates</returns>
  ///
  public StressTensor TriLinearInterpolate(StressTensor[] CornerTensors, double[] T)
  {
    //first get the 4 values along the edges in the x direction
    StressTensor SX0 = LinearInterpolate(CornerTensors[0], CornerTensors[4], T[0]);
    StressTensor SX1 = LinearInterpolate(CornerTensors[1], CornerTensors[5], T[0]);
    StressTensor SX2 = LinearInterpolate(CornerTensors[2], CornerTensors[6], T[0]);
    StressTensor SX3 = LinearInterpolate(CornerTensors[3], CornerTensors[7], T[0]);

    //interpolate along Y
    StressTensor SY0 = LinearInterpolate(SX0, SX2, T[1]);
    StressTensor SY1 = LinearInterpolate(SX1, SX3, T[1]);

    //and finally along Z
    var ST = LinearInterpolate(SY0, SY1, T[2]);
    bool HasNaN = false;
    for(int i = 0;i < 9;i++)
    {
      if(Double.IsNaN(ST.Values[i])){HasNaN = true;}
    }
    if(!HasNaN)
    {
      return LinearInterpolate(SY0, SY1, T[2]);
    }
    else
    {
      var Mx = double.MaxValue;
      //var Mx = ev1max;

      return new StressTensor(new List<double>{Mx,0,0,0,Mx,0,0,0,Mx});
    }

  }

  public class DescendingAbsoluteVals : Comparer < double > {
    public override int Compare(double x, double y)
    {
      return (y * y).CompareTo(x * x);
    }
  }

  public static void EigenSolve(double[] x, out double[] EigenValues, out Vector3d[] EigenVectors)
  {
    double[,] matValues = new double[3, 3]{{x[0],x[1],x[2]},{x[3],x[4],x[5]},{x[6],x[7],x[8]}};
    double[,] OutMatValues = new double[3, 3];
    double[] OutVecValues = new double[3];
    Eigen eigenCalculate = new Eigen();

    eigenCalculate.eigen_decomposition(matValues, OutMatValues, OutVecValues);

    var EigenVectorsUnsorted = new Vector3d[3];

    if (eigenCalculate.calcDone)
    {
      EigenVectorsUnsorted[0] = new Vector3d(OutMatValues[0, 0], OutMatValues[1, 0], OutMatValues[2, 0]);
      EigenVectorsUnsorted[1] = new Vector3d(OutMatValues[0, 1], OutMatValues[1, 1], OutMatValues[2, 1]);
      EigenVectorsUnsorted[2] = new Vector3d(OutMatValues[0, 2], OutMatValues[1, 2], OutMatValues[2, 2]);
    }

    Array.Sort(OutVecValues, EigenVectorsUnsorted, new DescendingAbsoluteVals());
    EigenValues = OutVecValues;
    EigenVectors = EigenVectorsUnsorted;
  }


  public class Eigen
  {
    public bool startCalc = false;
    public bool calcDone = false;

    ///////////////////////////////
    //Eigen solver implementation
    ///////////////////////////////
    private static double hypot2(double x, double y)
    {
      return Math.Sqrt(x * x + y * y);
    }

    private static void tred2(double[,] V, double[] d, double[] e)
    {
      for (int j = 0; j < 3; j++)
      {
        d[j] = V[3 - 1, j];
      }

      for (int i = 3 - 1; i > 0; i--)
      {
        double scale = 0.0;
        double h = 0.0;

        for (int k = 0; k < i; k++)
        {
          scale = scale + Math.Abs(d[k]);
        }

        if (scale == 0.0)
        {
          e[i] = d[i - 1];
          for (int j = 0; j < i; j++)
          {
            d[j] = V[i - 1, j];
            V[i, j] = 0.0;
            V[j, i] = 0.0;
          }
        }
        else
        {
          for (int k = 0; k < i; k++)
          {
            d[k] /= scale;
            h += d[k] * d[k];
          }

          double f = d[i - 1];
          double g = Math.Sqrt(h);

          if (f > 0)
          {
            g = -g;
          }

          e[i] = scale * g;
          h = h - f * g;
          d[i - 1] = f - g;

          for (int j = 0; j < i; j++)
          {
            e[j] = 0.0;
          }

          for (int j = 0; j < i; j++)
          {
            f = d[j];
            V[j, i] = f;
            g = e[j] + V[j, j] * f;

            for (int k = j + 1; k <= i - 1; k++)
            {
              g += V[k, j] * d[k];
              e[k] += V[k, j] * f;
            }

            e[j] = g;
          }

          f = 0.0;

          for (int j = 0; j < i; j++)
          {
            e[j] /= h;
            f += e[j] * d[j];
          }

          double hh = f / (h + h);

          for (int j = 0; j < i; j++)
          {
            e[j] -= hh * d[j];
          }

          for (int j = 0; j < i; j++)
          {
            f = d[j];
            g = e[j];

            for (int k = j; k <= i - 1; k++)
            {
              V[k, j] -= (f * e[k] + g * d[k]);
            }

            d[j] = V[i - 1, j];
            V[i, j] = 0.0;
          }
        }
        d[i] = h;
      }

      for (int i = 0; i < 3 - 1; i++)
      {
        V[3 - 1, i] = V[i, i];
        V[i, i] = 1.0;

        double h = d[i + 1];

        if (h != 0.0)
        {
          for (int k = 0; k <= i; k++)
          {
            d[k] = V[k, i + 1] / h;
          }
          for (int j = 0; j <= i; j++)
          {
            double g = 0.0;

            for (int k = 0; k <= i; k++)
            {
              g += V[k, i + 1] * V[k, j];
            }
            for (int k = 0; k <= i; k++)
            {
              V[k, j] -= g * d[k];
            }
          }
        }
        for (int k = 0; k <= i; k++)
        {
          V[k, i + 1] = 0.0;
        }
      }
      for (int j = 0; j < 3; j++)
      {
        d[j] = V[3 - 1, j];
        V[3 - 1, j] = 0.0;
      }

      V[3 - 1, 3 - 1] = 1.0;
      e[0] = 0.0;
    }

    static void tql2(double[,] V, double[] d, double[] e)
    {
      for (int i = 1; i < 3; i++)
      {
        e[i - 1] = e[i];
      }
      e[3 - 1] = 0.0;

      double f = 0.0;
      double tst1 = 0.0;
      double eps = Math.Pow(2.0, -52.0);
      for (int l = 0; l < 3; l++)
      {
        tst1 = Math.Max(tst1, Math.Abs(d[l]) + Math.Abs(e[l]));
        int m = l;

        while (m < 3)//not in original code, was m < 3!!!
        {
          if (Math.Abs(e[m]) <= eps * tst1)
          {
            break;
          }
          m++;
        }

        if (m > l)
        {
          int iter = 0;
          do
          {
            iter = iter + 1;

            double g = d[l];
            double p = (d[l + 1] - g) / (2.0 * e[l]);
            double r = hypot2(p, 1.0);

            if (p < 0)
            {
              r = -r;
            }

            d[l] = e[l] / (p + r);
            d[l + 1] = e[l] * (p + r);

            double dl1 = d[l + 1];
            double h = g - d[l];

            for (int i = l + 2; i < 3; i++)
            {
              d[i] -= h;
            }

            f = f + h;
            p = d[m];

            double c = 1.0;
            double c2 = c;
            double c3 = c;
            double el1 = e[l + 1];
            double s = 0.0;
            double s2 = 0.0;

            for (int i = m - 1; i >= l; i--)
            {
              c3 = c2;
              c2 = c;
              s2 = s;
              g = c * e[i];
              h = c * p;
              r = hypot2(p, e[i]);
              e[i + 1] = s * r;
              s = e[i] / r;
              c = p / r;
              p = c * d[i] - s * g;
              d[i + 1] = h + s * (c * g + s * d[i]);

              for (int k = 0; k < 3; k++)
              {
                h = V[k, i + 1];
                V[k, i + 1] = s * V[k, i] + c * h;
                V[k, i] = c * V[k, i] - s * h;
              }
            }

            p = -s * s2 * c3 * el1 * e[l] / dl1;
            e[l] = s * p;
            d[l] = c * p;
          } while (Math.Abs(e[l]) > eps * tst1);
        }

        d[l] = d[l] + f;
        e[l] = 0.0;
      }

      for (int i = 0; i < 3 - 1; i++)
      {
        int k = i;
        double p = d[i];

        for (int j = i + 1; j < 3; j++)
        {
          if (d[j] < p)
          {
            k = j;
            p = d[j];
          }
        }
        if (k != i)
        {
          d[k] = d[i];
          d[i] = p;

          for (int j = 0; j < 3; j++)
          {
            p = V[j, i];
            V[j, i] = V[j, k];
            V[j, k] = p;
          }
        }
      }
    }

    public void eigen_decomposition(double[,] A, double[,] V, double[] d)
    {
      double[] e = new double[3];
      for (int i = 0; i < 3; i++)
      {
        for (int j = 0; j < 3; j++)
        {
          V[i, j] = A[i, j];
        }
      }
      tred2(V, d, e);
      tql2(V, d, e);

      calcDone = true;
    }

  }

  //public static Color ColorAt(Mesh mesh, int faceIndex, double t0, double t1, double t2, double t3)
  //{
  //  // int rc = -1;
  //  var color = Rhino.Display.Color4f.Black;
  //
  //  if( mesh.VertexColors.Count != 0)
  //  {
  //    // test to see if face exists
  //    if( faceIndex >= 0 && faceIndex < mesh.Faces.Count )
  //    {
  //      /// Barycentric quad coordinates for the point on the mesh
  //      /// face mesh.Faces[FaceIndex].
  //
  //      /// If the face is a triangle
  //      /// disregard T[3] (it should be set to 0.0).
  //
  //      /// If the face is
  //      /// a quad and is split between vertexes 0 and 2, then T[3]
  //      /// will be 0.0 when point is on the triangle defined by vi[0],
  //      /// vi[1], vi[2]
  //
  //      /// T[1] will be 0.0 when point is on the
  //      /// triangle defined by vi[0], vi[2], vi[3].
  //
  //      /// If the face is a
  //      /// quad and is split between vertexes 1 and 3, then T[2] will
  //      /// be -1 when point is on the triangle defined by vi[0],
  //      /// vi[1], vi[3]
  //
  //      /// and m_t[0] will be -1 when point is on the
  //      /// triangle defined by vi[1], vi[2], vi[3].
  //
  //      MeshFace face = mesh.Faces[faceIndex];
  //
  //      // Collect data for barycentric evaluation.
  //      Color p0, p1, p2;
  //
  //      if(face.IsTriangle)
  //      {
  //        p0 = mesh.VertexColors[face.A];
  //        p1 = mesh.VertexColors[face.B];
  //        p2 = mesh.VertexColors[face.C];
  //      }
  //      else
  //      {
  //        if( t3 == 0 )
  //        { // point is on subtriangle {0,1,2}
  //          p0 = mesh.VertexColors[face.A];
  //          p1 = mesh.VertexColors[face.B];
  //          p2 = mesh.VertexColors[face.C];
  //        }
  //        else if( t1 == 0 )
  //        { // point is on subtriangle {0,2,3}
  //          p0 = mesh.VertexColors[face.A];
  //          p1 = mesh.VertexColors[face.C];
  //          p2 = mesh.VertexColors[face.D];
  //          //t0 = t0;
  //          t1 = t2;
  //          t2 = t3;
  //        }
  //        else if( t2 == -1 )
  //        { // point is on subtriangle {0,1,3}
  //          p0 = mesh.VertexColors[face.A];
  //          p1 = mesh.VertexColors[face.B];
  //          p2 = mesh.VertexColors[face.D];
  //          //t0 = t0;
  //          //t1 = t1;
  //          t2 = t3;
  //        }
  //        else
  //        { // point must be on remaining subtriangle {1,2,3}
  //          p0 = mesh.VertexColors[face.B];
  //          p1 = mesh.VertexColors[face.C];
  //          p2 = mesh.VertexColors[face.D];
  //          t0 = t1;
  //          t1 = t2;
  //          t2 = t3;
  //        }
  //      }
  //
  ///**
  //        double r = t0 * p0.FractionRed() + t1 * p1.FractionRed() + t2 * p2.FractionRed();
  //        double g = t0 * p0.FractionGreen() + t1 * p1.FractionGreen() + t2 * p2.FractionGreen();
  //       double b = t0 * p0.FractionBlue() + t1 * p1.FractionBlue() + t2 * p2.FractionBlue();
  //
  //        ON_Color color;
  //        color.SetFractionalRGB(r, g, b);
  //
  //        unsigned int abgr = (unsigned int)color;
  //        rc = (int) ABGR_to_ARGB(abgr);
  //
  //    var c0 = new Rhino.Display.Color4f(p0);
  //    var c1 = new Rhino.Display.Color4f(p1);
  //    var c2 = new Rhino.Display.Color4f(p2);
  //    float s0 = (float) t0;
  //    float s1 = (float) t1;
  //    float s2 = (float) t2;
  //
  //    float R = s0 * c0.R + s1 * c1.R + s2 * c2.R;
  //    float G = s0 * c0.G + s1 * c1.G + s2 * c2.G;
  //    float B = s0 * c0.B + s1 * c1.B + s2 * c2.B;
  //    color = new Rhino.Display.Color4f(R, G, B, 1);
  //  }
  //}
  //  return color.AsSystemColor();
  //}
  //
  //public static Color ColorAt(Mesh mesh, MeshPoint meshPoint)
  //{
  //  return ColorAt(mesh, meshPoint.FaceIndex, meshPoint.T[0], meshPoint.T[1], meshPoint.T[2], meshPoint.T[3]);
  //}
  //
  //public class Align : GoalObject
  //{
  //  public double Strength;
  //  public List<Vector3d> Vec;
  //
  //  public Align(int ea, int eb, Vector3d[] _Vec, double k)
  //  {
  //    PIndex = new int[2]{ea,eb};
  //    Move = new Vector3d[2];
  //    Weighting = new double[2]{k,k};
  //    Vec = _Vec.ToList();
  //    Strength = k;
  //  }
  //
  //  public override void Calculate(List<KangarooSolver.Particle> p)
  //  {
  //    Point3d p0 = p[PIndex[0]].Position;
  //    Point3d p1 = p[PIndex[1]].Position;
  //    var EdgeVec = new Vector3d();
  //    EdgeVec = p1 - p0;
  //
  //    double AngleX = Vector3d.VectorAngle(Vec[0], EdgeVec);
  //    double AngleY = Vector3d.VectorAngle(Vec[1], EdgeVec);
  //    double AngleZ = Vector3d.VectorAngle(Vec[2], EdgeVec);
  //    double AngleNX = Vector3d.VectorAngle(-Vec[0], EdgeVec);
  //    double AngleNY = Vector3d.VectorAngle(-Vec[1], EdgeVec);
  //    double AngleNZ = Vector3d.VectorAngle(-Vec[2], EdgeVec);
  //
  //    double lowest = AngleX;
  //    Vector3d TargetDir = Vec[0];
  //
  //    if (AngleY < lowest)
  //    {
  //      TargetDir = Vec[1];
  //      lowest = AngleY;
  //    }
  //
  //    if (AngleZ < lowest)
  //    {
  //      TargetDir = Vec[2];
  //      lowest = AngleZ;
  //    }
  //
  //    if (AngleNX < lowest)
  //    {
  //      TargetDir = -Vec[0];
  //      lowest = AngleNX;
  //    }
  //    if (AngleNY < lowest)
  //    {
  //      TargetDir = -Vec[1];
  //      lowest = AngleNY;
  //    }
  //    if (AngleNZ < lowest)
  //    {
  //      TargetDir = -Vec[2];
  //    }
  //
  //    Vector3d V = EdgeVec;
  //    Vector3d Dir = TargetDir;
  //
  //    Vector3d To = (V - (V * Dir) * Dir) * 0.5;
  //
  //    Move[0] = To;
  //    Move[1] = -To;
  //
  //    if(!Dir.IsZero && lowest < Math.PI / 9)
  //    {
  //      Weighting[0] = Strength;
  //      Weighting[1] = Strength;
  //    }
  //    else
  //    {
  //      Weighting[0] = 0;
  //      Weighting[1] = 0;
  //    }
  //  }
  //}
  //
  //
  //public class NonLinearRepel : GoalObject
  //{
  //  public int Exponent;
  //  public double Length;
  //  public double Multiplier;
  //  public double Stiffness;
  //
  //  public NonLinearRepel(int Pt0, int Pt1, double Len, double Mult, double k, int q)
  //  {
  //
  //    PIndex = new int[2]{Pt0,Pt1};
  //    Move = new Vector3d[2];
  //    Weighting = new double[2]{k,k};
  //    Exponent = q;
  //    Length = Len;
  //    Multiplier = Mult;
  //    Stiffness = k;
  //  }
  //
  //  public override void Calculate(List<KangarooSolver.Particle> p)
  //  {
  //    Vector3d Current = p[PIndex[1]].Position - p[PIndex[0]].Position;
  //
  //    double CurrentLength = Current.Length;
  //    double Overlap = Length - CurrentLength;
  //    Current.Unitize();
  //
  //    if(Overlap > 0)
  //    {
  //      Move[0] = -0.5 * Current * Overlap;
  //      Move[1] = 0.5 * Current * Overlap;
  //
  //      Weighting[0] = Weighting[1] =
  //        //  Stiffness * (Math.Pow(CurrentLength * Multiplier, Exponent) - Math.Pow(Length * Multiplier, Exponent));
  //        Stiffness * Math.Pow((Length - Overlap) * Multiplier, Exponent);
  //    }
  //    else
  //    {
  //      Weighting[0] = Weighting[1] = 0;
  //    }
  //
  //  }
  //
  //  public override object Output(List<KangarooSolver.Particle> p)
  //  {
  //    Line L = new Line(p[PIndex[0]].Position, p[PIndex[1]].Position);
  //    return L;
  //  }
  //}
  //  */
  //
# ---------- end filter_by_valence ----------
medges = MeshEdges(Mesh=conmesh)  # -> NakedEdges, flatten(InteriorEdges), NonManifoldEdges; disabled
dupln = RemoveDuplicateLines(Lines=medges.InteriorEdges, Tolerance=1e-08)  # disabled
crv = Curve(dupln)  # disabled
dupln_2 = RemoveDuplicateLines(Lines=crv, Tolerance=0.005)  # disabled
filter_by_angle = CSharpScript(
    Data=flatten(split_7.ListA),
    Lines=crv,
    Angle=number_slider_3,
    Reference="C:\USERS\DPIKER\DESKTOP\MECHANOADAPTIVEGENERATION-MASTER (1)\MECHANOADAPTIVEGENERATION-MASTER\lib\KangarooSolver.dll")  # -> out, F; inputs Data: list of Double, Lines: list of Line, Angle: Double; disabled
# ---------- filter_by_angle: C# ----------
    //for each line
    //get the stress directions at its midpoint
    //get its angle with each of the 6 directions (+/-)
    //keep only those with an angle less than Angle

    List<Vector3d > Evec1 = new List<Vector3d>();
    List<Vector3d> Evec2 = new List<Vector3d>();
    List<Vector3d> Evec3 = new List<Vector3d>();

    List<double> Eval1 = new List<double>();
    List<double> Eval2 = new List<double>();
    List<double> Eval3 = new List<double>();

    var MidPts = new Point3d[Lines.Count];

    for(int i = 0;i < Lines.Count;i++)
    {
      MidPts[i] = Lines[i].PointAt(0.5);
    }

    InterpolateTensor(MidPts, Data, ref Evec1, ref Evec2, ref Evec3, ref Eval1, ref Eval2, ref Eval3);

    List<Line> KeptLines = new List<Line>();
    for(int i = 0;i < Lines.Count;i++)
    {

      double vAngle1 = Vector3d.VectorAngle(Lines[i].Direction, Evec1[i]);
      double vAngle2 = Vector3d.VectorAngle(Lines[i].Direction, Evec2[i]);
      double vAngle3 = Vector3d.VectorAngle(Lines[i].Direction, Evec3[i]);

      if(
        vAngle1 < Angle || Math.PI - vAngle1 < Angle ||
        vAngle2 < Angle || Math.PI - vAngle2 < Angle ||
        vAngle3 < Angle || Math.PI - vAngle3 < Angle
        )
      {
        KeptLines.Add(Lines[i]);
      }
    }


    F = KeptLines;
    //    /*
    //
    //    InterpolateTensor(Pts.ToArray(), localData, ref Evec1, ref Evec2, ref Evec3, ref Eval1, ref Eval2, ref Eval3);
    //
    //
    //
    //    var ix = new List<int>();
    //
    //    if(Evec1 != null && Evec2 != null && Evec3 != null || true){
    //      for(int i = 0; i < Pts.Count;i++)
    //      {
    //        PS.AddParticle(Pts[i], 1); //add a particle for every point
    //        ix.Add(i);
    //        Ellipsoids.Add(new Ellipsoid(Pts[i]));
    //
    //        //translate these values to rs and rl
    //
    //        double ClampEval = Math.Max(Eval1[i], ev1min);
    //        ClampEval = Math.Min(ClampEval, ev1max);
    //
    //        double evParam = (ClampEval - ev1min) / (ev1max - ev1min);
    //
    //        double effectiveLongAxisLength = minLongAxisLength + (1 - evParam) * (maxLongAxisLength - minLongAxisLength);
    //
    //        // double effectiveLongAxisLength = minLongAxisLength + (Eval1[i] - ev1max) / (ev1min - ev1max) * (maxLongAxisLength - minLongAxisLength);
    //
    //        //   effectiveLongAxisLength = Math.Max(Math.Min(Math.Abs(effectiveLongAxisLength), maxLongAxisLength / scaleEllipsoids), minLongAxisLength / scaleEllipsoids);
    //        La.Add(scaleEllipsoids * effectiveLongAxisLength * Evec1[i]);
    //
    //        //double ratio = Math.Max(Math.Min(Math.Abs(Eval2[i]), maxLongAxisLength / scaleEllipsoids) / effectiveLongAxisLength, minSlenderness);
    //        double ratio = Math.Max(minSlenderness, Eval2[i] / Eval1[i]);
    //
    //        Sa.Add(scaleEllipsoids * ratio * effectiveLongAxisLength * Evec2[i]);
    //
    //        //if this ellipsoid is a sphere, it can have maximally a radius of maxRadiusCofficient*maxLongAxisLength; This is to restrict the volume.
    //        double maxRadiusCoefficient = 0.75;
    //        double volumeRatio = maxRadiusCoefficient * maxLongAxisLength / (Math.Pow(ratio * ratio, 0.33333333) * effectiveLongAxisLength);
    //        if( volumeRatio < 1)
    //        {
    //          Sa[i] *= volumeRatio;
    //          La[i] *= volumeRatio;
    //          effectiveLongAxisLength *= volumeRatio;
    //        }
    //
    //        Ellipsoids[i].updateTransform(scaleEllipsoids * effectiveLongAxisLength * Evec1[i], scaleEllipsoids * ratio * effectiveLongAxisLength * Evec2[i], scaleEllipsoids * ratio * effectiveLongAxisLength * Evec3[i]);
    //      }
    //    }
    //
    //    GoalList.Add(new KangarooSolver.Goals.SolidPoint(ix, M, true, boundaryCollideStrength));
    //
    //    for(int i = 0;i < FixedPointIndices.Count();i++)
    //    {
    //      GoalList.Add(new KangarooSolver.Goals.Anchor(FixedPointIndices[i], Pts[FixedPointIndices[i]], 10000));
    //    }
    //    count = 0;
    //    EnergySum = double.MaxValue;
    //
    //    isInitialized = true;
    //    A = Pts[FixedPointIndices[FixedPointIndices.Count() - 1]];
    //  }
    //  else
    //  {
    //  double totalOverlap = 0.0;
    //  Running = Run;
    //
    //  int GoalsToKeep = 1 + FixedPointIndices.Count(); //Note that if more goals are added in the in the initialization, this number should be increased accordingly
    //  GoalList.RemoveRange(GoalsToKeep, GoalList.Count - GoalsToKeep); //clear everything apart from the SolidPoint Goal.
    //
    //  (GoalList[0] as KangarooSolver.Goals.SolidPoint).Strength = boundaryCollideStrength;
    //
    //  var Positions = PS.GetPositionArray();
    //
    //  //update the ellipsoid transformations from field
    //  InterpolateTensor(Positions, localData, ref Evec1, ref Evec2, ref Evec3, ref Eval1, ref Eval2, ref Eval3);
    //
    //
    //  for(int i = 0; i < Positions.Count();i++)
    //  if(Evec1 != null && Evec2 != null && Evec3 != null || true){
    //  {
    //
    //  double ClampEval = Math.Max(Eval1[i], ev1min);
    //  ClampEval = Math.Min(ClampEval, ev1max);
    //  double evParam = (ClampEval - ev1min) / (ev1max - ev1min);
    //  double effectiveLongAxisLength = minLongAxisLength + (1 - evParam) * (maxLongAxisLength - minLongAxisLength);
    //
    //
    //  // double effectiveLongAxisLength = minLongAxisLength + (Eval1[i] - ev1max) / (ev1min - ev1max) * (maxLongAxisLength - minLongAxisLength);
    //  //   effectiveLongAxisLength = Math.Max(Math.Min(Math.Abs(effectiveLongAxisLength), maxLongAxisLength / scaleEllipsoids), minLongAxisLength / scaleEllipsoids);
    //  La[i] = scaleEllipsoids * effectiveLongAxisLength * Evec1[i];
    //
    //  //double ratio = Math.Max(Math.Min(Math.Abs(Eval2[i]), maxLongAxisLength / scaleEllipsoids) / effectiveLongAxisLength, minSlenderness);
    //  double ratio = Math.Max(minSlenderness, Eval2[i] / Eval1[i]);
    //
    //  Sa[i] = scaleEllipsoids * ratio * effectiveLongAxisLength * Evec2[i];
    //
    //  //if this ellipsoid is a sphere, it can have maximally a radius of maxRadiusCofficient*maxLongAxisLength; This is to restrict the volume.
    //  double maxRadiusCoefficient = 0.5;
    //  double volumeRatio = maxRadiusCoefficient * maxLongAxisLength / (Math.Pow(ratio * ratio, 0.33333333) * effectiveLongAxisLength);
    //  if( volumeRatio < 1)
    //  {
    //  Sa[i] *= volumeRatio;
    //  La[i] *= volumeRatio;
    //  effectiveLongAxisLength *= volumeRatio;
    //}
    //
    //            Ellipsoids[i].updateTransform(scaleEllipsoids * effectiveLongAxisLength * Evec1[i], scaleEllipsoids * ratio * effectiveLongAxisLength * Evec2[i], scaleEllipsoids * ratio * effectiveLongAxisLength * Evec3[i]);
    //
    //          }
    //        }
    //
    //      //A pair of matching lists to contain the collisions
    //List<int> CollideRef0 = new List<int>();
    //List<int> CollideRef1 = new List<int>();
    //
    //      //use SAP to find AABB collisions
    //
    //      SweepAndPrune(Ellipsoids, Positions, ref CollideRef0, ref CollideRef1);
    //
    //      //narrow phase collision
    //
    //      var ConnectedEdges = new List<int>[Positions.Length];
    //for(int i = 0;i < Positions.Length;i++)
    //      {
    //        ConnectedEdges[i] = new List<int>();
    //      }
    //
    //      LineList.Clear();
    //for(int i = 0;i < CollideRef0.Count();i++)
    //      {
    //int ea = CollideRef0[i];
    //int eb = CollideRef1[i];
    //        var Collision = new EllipsoidCollide(Ellipsoids[ea], Ellipsoids[eb]);
    //double PushDistance = Collision.CalculateCollision();
    //
    //        if(PushDistance != -1 )
    //        {
    //          //GoalList.Add(new KangarooSolver.Goals.Spring(eb, ea, PushDistance, 1));
    //
    //          GoalList.Add(new NonLinearRepel(eb, ea, PushDistance, 1, 0.01, -2));
    //
    //Line L = new Line(Positions[ea], Positions[eb]);
    //
    //          GoalList.Add(new Align(eb, ea, new Vector3d[3]
    //            {
    //            0.5 * (Ellipsoids[ea].unitXAxis + Ellipsoids[eb].unitXAxis),
    //            0.5 * (Ellipsoids[ea].unitYAxis + Ellipsoids[eb].unitYAxis),
    //            0.5 * (Ellipsoids[ea].unitZAxis + Ellipsoids[eb].unitZAxis),
    //            }, AlignStrength));
    //
    //          //
    //          //          if(PushDistance > EdgeLengthFactor)
    //          //          {
    //          //            LineList.Add(L);
    //          //          }
    //
    //double LLen = L.Length;
    //
    //          if((PushDistance - LLen) / LLen > EdgeLengthFactor)
    //          {
    //            LineList.Add(L);
    //            ConnectedEdges[ea].Add(LineList.Count - 1);
    //            ConnectedEdges[eb].Add(LineList.Count - 1);
    //          }
    //
    //          //
    //          //          if((PushDistance - LLen) > EdgeLengthFactor)
    //          //          {
    //          //            LineList.Add(L);
    //          //          }
    //
    //
    //if(!Double.IsNaN(PushDistance))
    //{
    //  totalOverlap = totalOverlap + 2 * Math.Abs(PushDistance);
    //}
    //        }
    //
    //
    //      }
    //
    //      //create spring forces and add to goals
    //      //for all pairs colliding, also add alignment
    //
    //      PS.SimpleStep(GoalList);
    //
    //
    //
    //
    //
    //      //evaluate pressure, and increase the scaling factor if needed
    //      AA = Eval3;
    //      BB = totalOverlap;
    //      if(adaptToPressure)
    //      {
    //        updateScale(ref scaleEllipsoids, ref totalOverlap, ref Ellipsoids, ref targetPressure);
    //      }
    //      //Output the mesh, and how many iterations it took to converge
    //      EllipsoidCenters = PS.GetPositionsGH();
    //
    //      LongAxes = La;
    //      ShortAxes = Sa;
    //
    //      count++;
    //      if(count % StopAtNoDecrease == 0)
    //      {
    //if(PS.GetvSum() >= EnergySum)  // GetvSum returns the sum of the squares of the particle velocities
    //{
    //  Running = false;
    //}
    //        EnergySum = PS.GetvSum();
    //      }
    //
    //
    //
    //      Iterations = count;
    //
    //
    //      //optional post-packing connectivity culling
    //      if(ValenceFilter)
    //      {
    //        var Keep = new bool[LineList.Count];
    //for(int i = 0;i < Pts.Count;i++)
    //        {
    //int CurrentValence = ConnectedEdges[i].Count;
    //          var EdgeIndices = new int[CurrentValence];
    //int TargetValence = 6;// TODO: Replace this for boundary faces/edges
    //
    //          var EdgeLengths = new double[CurrentValence];
    //
    //for(int j = 0;j < CurrentValence;j++)
    //          {
    //EdgeLengths[j] = LineList[ConnectedEdges[i][j]].Length;
    //            EdgeIndices[j] = j;
    //          }
    //
    //          Array.Sort(EdgeLengths, EdgeIndices);
    //
    //int Maximum = Math.Min(TargetValence, ConnectedEdges[i].Count);
    //for(int j = 0;j < Maximum;j++)
    //          {
    //Keep[ConnectedEdges[i][EdgeIndices[j]]] = true;
    //          }
    //        }
    //
    //        var KeptLines = new List<Line>();
    //for(int i = 0;i < LineList.Count;i++)
    //        {
    //          if(Keep[i])
    //          {
    //            KeptLines.Add(LineList[i]);
    //          }
    //        }
    //
    //        Lines = KeptLines;
    //
    //      }
    //      else
    //      {
    //        Lines = LineList;
    //      }
    //
    //
    //
    //
    //
    //
    //      EE = ev1mean;
    //      EEE = ev1stdev;
    //      EEEE = ev1min;
    //    }
    //
    //
# ---------- filter_by_angle: C# additional code ----------
  //
  //
  //
  //List<Vector3d> Evec1 = new List<Vector3d>();
  //List<Vector3d> Evec2 = new List<Vector3d>();
  //List<Vector3d> Evec3 = new List<Vector3d>();
  //
  //List<double> Eval1 = new List<double>();
  //List<double> Eval2 = new List<double>();
  //List<double> Eval3 = new List<double>();
  //
  //List<double> localData = new List<double>();
  //
  //List<Vector3d> La = new List<Vector3d>();
  //List<Vector3d> Sa = new List<Vector3d>();
  //
  //  //this makes the component autorefresh
  //
  //public override void AfterRunScript()
  //{
  //  if(Running)
  //  {
  //    GH_Document doc = this.Component.OnPingDocument();
  //    GH_Document.GH_ScheduleDelegate callback = new GH_Document.GH_ScheduleDelegate(ScheduleCallback);
  //    doc.ScheduleSolution(1, callback);
  //  }
  //}
  //
  //private void ScheduleCallback(GH_Document doc)
  //{
  //  this.Component.ExpireSolution(false);
  //}
  //
  //public static double StdDev(ref List<double> values)
  //{
  //  double ret = 0;
  //  int count = values.Count();
  //  if (count > 1)
  //  {
  //    //Compute the Average
  //    double avg = values.Average();
  //
  //    //Perform the Sum of (value-avg)^2
  //    double sum = values.Sum(d => (d - avg) * (d - avg));
  //
  //    //Put it all together
  //    ret = Math.Sqrt(sum / count);
  //  }
  //  return ret;
  //}
  //
  //public void updateScale(ref double scale, ref double totalAbsOverlap, ref List<Ellipsoid> ellis, ref double target)
  //{
  //  if(totalAbsOverlap < target){
  //    scale = scale * 1.01;
  //    for(int i = 0; i < ellis.Count(); i++){
  //      ellis[i].scale(scale);
  //    }
  //  }
  //  else{
  //    scale = scale * 0.99;
  //  }
  //}
  //
  public void InterpolateTensor(Point3d[] Pts, List<double> Data, ref List<Vector3d> Evec1, ref List<Vector3d> Evec2, ref List<Vector3d> Evec3, ref List<double> Eval1, ref List<double> Eval2, ref List<double> Eval3)
  {    int nOfPoints = Pts.Count();

    List<Point3d> G = new List<Point3d>();
    List<double> T0 = new List<double>();
    List<double> T1 = new List<double>();
    List<double> T2 = new List<double>();
    List<double> T3 = new List<double>();
    List<double> T4 = new List<double>();
    List<double> T5 = new List<double>();

    while(Data.Any())
    {
      List <double> localDataList = Data.Take(9).ToList();

      G.Add(new Point3d(localDataList[0], localDataList[1], localDataList[2]));

      T0.Add(localDataList[3]);
      T1.Add(localDataList[4]);
      T2.Add(localDataList[5]);
      T3.Add(localDataList[6]);
      T4.Add(localDataList[7]);
      T5.Add(localDataList[8]);

      Data = Data.Skip(9).ToList();
    }

    var EigenVectors = new Vector3d[nOfPoints][];
    var EigenValues = new Double[nOfPoints][];

    var EVA = new Vector3d[nOfPoints];
    var EVB = new Vector3d[nOfPoints];
    var EVC = new Vector3d[nOfPoints];
    var EigenValuesA = new double[nOfPoints];
    var EigenValuesB = new double[nOfPoints];
    var EigenValuesC = new double[nOfPoints];

    //find grid count and size
    int xCount, yCount, zCount;
    xCount = yCount = zCount = 0;
    double xSize, ySize, zSize;
    xSize = ySize = zSize = 0;

    var Tensors = new StressTensor[G.Count];
    for(int i = 0;i < G.Count;i++)
    {
      Tensors[i] = new StressTensor(new List<double>{T0[i],T1[i],T2[i],T1[i],T3[i],T4[i],T2[i],T4[i],T5[i]});
    }
    Array.Sort(G.ToArray(), Tensors);

    G.Sort();

    zSize = G[1].Z - G[0].Z;

    for(int i = 1;i < G.Count;i++)
    {
      if(G[i].Y > G[0].Y)
      {
        ySize = G[i].Y - G[0].Y;
        zCount = i;
        break;
      }
    }

    for(int i = 1;i < G.Count;i++)
    {
      if(G[i].X > G[0].X)
      {
        xSize = G[i].X - G[0].X;
        yCount = i / zCount;
        break;
      }
    }

    xCount = G.Count / (zCount * yCount);

    var Grid = new StressTensor[xCount, yCount, zCount];

    for(int i = 0; i < xCount;i++)
    {
      for(int j = 0; j < yCount; j++)
      {
        for(int k = 0; k < zCount; k++)
        {
          Grid[i, j, k] = Tensors[k + j * zCount + i * zCount * yCount];
        }
      }
    }
    // for each point in P, find its coordinates in the grid
    // output the 8 points/indices of the corners
    // and the point coordinates of the position within that cell

    var arrayOfCellCoords = new Point3d[nOfPoints]; // always in [0,1]^3
    var arrayOfTensors0 = new double[nOfPoints][];
    var arrayOfTensors1 = new double[nOfPoints][];
    var arrayOfTensors2 = new double[nOfPoints][];
    var arrayOfTensors3 = new double[nOfPoints][];
    var arrayOfTensors4 = new double[nOfPoints][];
    var arrayOfTensors5 = new double[nOfPoints][];
    var arrayOfTensors6 = new double[nOfPoints][];
    var arrayOfTensors7 = new double[nOfPoints][];

    System.Threading.Tasks.Parallel.For(0, nOfPoints,
      j => {
      var PVec = Pts[j] - G[0];  //position vector of the current point relative to grid origin

      var PX = PVec.X / xSize;
      var PY = PVec.Y / ySize;
      var PZ = PVec.Z / zSize;

      int PXF,PXC,PYF,PYC,PZF,PZC;

      var CoordsInCell = new Point3d();

      if(PX < 0)
      {
        PXF = 0; PXC = 1; CoordsInCell.X = 0;
      }
      else if(PX > xCount - 1)
      {
        PXF = xCount - 2; PXC = xCount - 1; CoordsInCell.X = 1;
      }
      else
      {
        PXF = (int) Math.Floor(PX); PXC = (int) Math.Ceiling(PX); CoordsInCell.X = PX - PXF;
      }


      if(PY < 0)
      {
        PYF = 0; PYC = 1; CoordsInCell.Y = 0;
      }
      else if(PY > yCount - 1)
      {
        PYF = yCount - 2; PYC = yCount - 1; CoordsInCell.Y = 1;
      }
      else
      {
        PYF = (int) Math.Floor(PY); PYC = (int) Math.Ceiling(PY); CoordsInCell.Y = PY - PYF;
      }


      if(PZ < 0)
      {
        PZF = 0; PZC = 1; CoordsInCell.Z = 0;
      }
      else if(PZ > zCount - 1)
      {
        PZF = zCount - 2; PZC = zCount - 1; CoordsInCell.Z = 1;
      }
      else
      {
        PZF = (int) Math.Floor(PZ); PZC = (int) Math.Ceiling(PZ); CoordsInCell.Z = PZ - PZF;
      }


      //
      //      int PXF = Math.Max(Math.Min((int) Math.Floor(PX), xCount - 1), 0);
      //      int PYF = Math.Max(Math.Min((int) Math.Floor(PY), yCount - 1), 0);
      //      int PZF = Math.Max(Math.Min((int) Math.Floor(PZ), zCount - 1), 0);
      //
      //      int PXC = Math.Max(Math.Min((int) Math.Ceiling(PX), xCount - 1), 0);
      //      int PYC = Math.Max(Math.Min((int) Math.Ceiling(PY), yCount - 1), 0);
      //      int PZC = Math.Max(Math.Min((int) Math.Ceiling(PZ), zCount - 1), 0);

      //     arrayOfCellCoords[j] = new Point3d(Math.Min(Math.Max(PX - PXF, 0), 1), Math.Min(Math.Max(PY - PYF, 0), 1), Math.Min(Math.Max(PZ - PZF, 0), 1));

      arrayOfCellCoords[j] = CoordsInCell;

      arrayOfTensors0[j] = Grid[PXF, PYF, PZF].Values;
      arrayOfTensors1[j] = Grid[PXF, PYF, PZC].Values;
      arrayOfTensors2[j] = Grid[PXF, PYC, PZF].Values;
      arrayOfTensors3[j] = Grid[PXF, PYC, PZC].Values;
      arrayOfTensors4[j] = Grid[PXC, PYF, PZF].Values;
      arrayOfTensors5[j] = Grid[PXC, PYF, PZC].Values;
      arrayOfTensors6[j] = Grid[PXC, PYC, PZF].Values;
      arrayOfTensors7[j] = Grid[PXC, PYC, PZC].Values;

      var Corners = new StressTensor[8];

      Corners[0] = new StressTensor();
      Corners[1] = new StressTensor();
      Corners[2] = new StressTensor();
      Corners[3] = new StressTensor();
      Corners[4] = new StressTensor();
      Corners[5] = new StressTensor();
      Corners[6] = new StressTensor();
      Corners[7] = new StressTensor();

      Corners[0].Values = (double[]) arrayOfTensors0[j];
      Corners[1].Values = (double[]) arrayOfTensors1[j];
      Corners[2].Values = (double[]) arrayOfTensors2[j];
      Corners[3].Values = (double[]) arrayOfTensors3[j];
      Corners[4].Values = (double[]) arrayOfTensors4[j];
      Corners[5].Values = (double[]) arrayOfTensors5[j];
      Corners[6].Values = (double[]) arrayOfTensors6[j];
      Corners[7].Values = (double[]) arrayOfTensors7[j];

      var EVec = new Vector3d[3];
      var EVal = new Double[3];

      var T = new Double[3]{arrayOfCellCoords[j].X,arrayOfCellCoords[j].Y,arrayOfCellCoords[j].Z};
      //var T = new Double[3]{0.5,0.5,0.5};

      StressTensor tensorAtPoint = TriLinearInterpolate(Corners, T);
      EigenSolve(tensorAtPoint.Values, out EVal, out EVec);

      int[] ott = new int[3]; // o ne, t wo, t hree
      ott[0] = 0;
      ott[1] = 1;
      ott[2] = 2;
      double[] ev = new double[]{Math.Abs(EVal[0]),Math.Abs(EVal[1]),Math.Abs(EVal[2])};
      //sort according to maximum absolute value of Eval
      Array.Sort(ev, ott);

      EVA[j] = EVec[ott[2]];
      EVB[j] = EVec[ott[1]];
      EVC[j] = EVec[ott[0]];

      EigenValuesA[j] = Math.Abs(EVal[ott[2]]);
      EigenValuesB[j] = Math.Abs(EVal[ott[1]]);
      EigenValuesC[j] = Math.Abs(EVal[ott[0]]);
      });

    Evec1 = EVA.ToList();
    Evec2 = EVB.ToList();
    Evec3 = EVC.ToList();
    Eval1 = EigenValuesA.ToList();
    Eval2 = EigenValuesB.ToList();
    Eval3 = EigenValuesC.ToList();
  }

  //public void SweepAndPrune(List < Ellipsoid > Ellipsoids, Point3d[] Positions, ref List<int> CollideRef0, ref List<int> CollideRef1)
  //{
  //  List <AABB> boxes = new List<AABB>();
  //
  //  //use the points to create AABB objects
  //  for (int i = 0; i < Ellipsoids.Count; i++)
  //  {
  //    Ellipsoids[i].position = Positions[i];
  //    Ellipsoids[i].calculateBoundingBox();
  //
  //    boxes.Add(new AABB(Ellipsoids[i].boundingBoxMin, Ellipsoids[i].boundingBoxMax, i));
  //  }
  //
  //  List <EndPoint> sortedInX = new List<EndPoint>();
  //
  //  //add the endpoints in x
  //  foreach (AABB boxForPoint in boxes) {
  //    sortedInX.Add(boxForPoint.min[0]);//change this 0 to 1 or 2 to sort in Y or Z - will also need to change the second half of the test function
  //    sortedInX.Add(boxForPoint.max[0]);//change this 0 to 1 or 2 to sort in Y or Z
  //  }
  //
  //  //sort by the num value of each EndPoint
  //  sortedInX.Sort(EndPoint.compareEndPoints);
  //
  //  List <int> openBoxes = new List<int>();
  //
  //  foreach (EndPoint endPoint in sortedInX)
  //  {
  //    if (endPoint.isMin)
  //    {
  //      AABB thisPointOwner = endPoint.owner;
  //      //check against all in openBoxes
  //      foreach(int openBoxRef in openBoxes) {
  //        //if it collides output the integers of the branches than collide
  //        //do they collide in y?
  //        if(thisPointOwner.max[1].num > boxes[openBoxRef].min[1].num && thisPointOwner.min[1].num < boxes[openBoxRef].max[1].num) {
  //          //they collide in y, do they collide in z?
  //          if(thisPointOwner.max[2].num > boxes[openBoxRef].min[2].num && thisPointOwner.min[2].num < boxes[openBoxRef].max[2].num) {
  //            //they collide in z
  //            //therefore they collide! Add to the list of collide refs
  //            CollideRef0.Add(endPoint.owner.branchRef);
  //            CollideRef1.Add(boxes[openBoxRef].branchRef);
  //          }
  //        }
  //      }
  //      //add corresponding box to openBoxes
  //      openBoxes.Add(thisPointOwner.branchRef);
  //
  //    } else
  //    {
  //      //it must be an max point
  //      //remove corresponding box from openBoxes
  //      openBoxes.Remove(endPoint.owner.branchRef);
  //    }
  //  }
  //
  //}
  //
  //public class EllipsoidCollide // No longer a Goal object itself. This can detect collision and output info then used for the actual goal
  //{
  //
  //  Ellipsoid e1;
  //  Ellipsoid e2;
  //
  //  public double overlap;
  //  public double extension;
  //
  //  public EllipsoidCollide(Ellipsoid _e1, Ellipsoid _e2)
  //  {
  //    e1 = _e1;
  //    e2 = _e2;
  //  }
  //
  //  public double CalculateCollision()
  //  {
  //
  //    e1.calculateAxesAndScales();
  //    e2.calculateAxesAndScales();
  //
  //    //calculate distance vectors back and forth, and the length of the distance
  //    //this will become part of the narrow phase check
  //    Vector3d pjk = new Vector3d(e2.position - e1.position);
  //    double pjkLength = pjk.Length;
  //    Vector3d pkj = new Vector3d(-pjk);
  //
  //    //store direction before transforming distance vectors
  //    Vector3d pushVector = new Vector3d(pjk);
  //
  //    //Transform connection vector onto "sphere" coordinates of either ellipsoid
  //    e1.calculateInverse();
  //    e2.calculateInverse();
  //    //find length of vector inside each ellipsoid
  //    double jDistance = e1.findDistanceInside(pjk);
  //    double kDistance = e2.findDistanceInside(pkj);
  //
  //    double touchingDistance = jDistance + kDistance;
  //    if(pjkLength - (touchingDistance) < 0)
  //    {
  //      return touchingDistance;
  //    }
  //    else
  //    {
  //      return -1;
  //    }
  //
  //    //      //longest overlap is:
  //    //      extension = pjkLength - (jDistance + kDistance);
  //    //
  //    //      //scalar w quantifying overlap in ]0,1]. w = 1 means no overlap, w close to 0 means a lot of overlap
  //    //      double overlap = pjkLength / (jDistance + kDistance);
  //    //
  //    //      if(overlap <= 1.0 && overlap > 0)
  //    //      {
  //    //        pushVector.Unitize();
  //    //        return extension * pushVector;
  //    //      } else
  //    //      {
  //    //        return Vector3d.Zero;
  //    //      }
  //
  //  }
  //
  //}
  //
  //public class Ellipsoid {
  //
  //  //centre point of the ellipsoid
  //  public Point3d position;
  //  //transform matrix that defines the scale and rotation make 3x3 (but really a 1x9)
  //  double[] transform;
  //  //the inverse transform this is calculated once and then referenced..
  //  double[] inverse;
  //
  //  //unitized vectors for the axis
  //  //perhaps store the squared values as they are
  //  public Vector3d unitXAxis;
  //  double scaleX;
  //  public Vector3d unitYAxis;
  //  double scaleY;
  //  public Vector3d unitZAxis;
  //  double scaleZ;
  //
  //  //points defining the bounding box
  //  public Point3d boundingBoxMin;
  //  public Point3d boundingBoxMax;
  //
  //  //constructor
  //  public Ellipsoid(Point3d tPos) {
  //    //set the values use Vector3d.Axis and caluate bounding box function
  //    position = tPos;
  //
  //    //set the transfrom as an identity matrix
  //    transform = new double[]{1,0,0,0,1,0,0,0,1};
  //    inverse = new double[]{1,0,0,0,1,0,0,0,1};
  //
  //    //could use calculateAxes but a waste of three unitize calls!
  //    unitXAxis = Vector3d.XAxis;
  //    scaleX = 1.0;
  //    unitYAxis = Vector3d.YAxis;
  //    scaleY = 1.0;
  //    unitZAxis = Vector3d.ZAxis;
  //    scaleZ = 1.0;
  //
  //    calculateBoundingBox();
  //  }
  //
  //  //takes an set of vectors and updates the transform - taken from the eigenvectors of the interpolated field
  //  public void updateTransform(Vector3d xAxis, Vector3d yAxis, Vector3d zAxis) {
  //    transform[0] = xAxis[0];
  //    transform[3] = xAxis[1];
  //    transform[6] = xAxis[2];
  //
  //    transform[1] = yAxis[0];
  //    transform[4] = yAxis[1];
  //    transform[7] = yAxis[2];
  //
  //    transform[2] = zAxis[0];
  //    transform[5] = zAxis[1];
  //    transform[8] = zAxis[2];
  //  }
  //
  //  public void scale(double s)
  //  {
  //    for(int i = 0; i < 9;i++)
  //    {
  //      transform[i] = s * transform[i];
  //    }
  //  }
  //
  //  public void calculateInverse() {
  //    inverse[0] = transform[0] / (scaleX * scaleX);
  //    inverse[1] = transform[3] / (scaleX * scaleX);
  //    inverse[2] = transform[6] / (scaleX * scaleX);
  //
  //    inverse[3] = transform[1] / (scaleY * scaleY);
  //    inverse[4] = transform[4] / (scaleY * scaleY);
  //    inverse[5] = transform[7] / (scaleY * scaleY);
  //
  //    inverse[6] = transform[2] / (scaleZ * scaleZ);
  //    inverse[7] = transform[5] / (scaleZ * scaleZ);
  //    inverse[8] = transform[8] / (scaleZ * scaleZ);
  //  }
  //
  //  //calculate and return boundingBox
  //  public void calculateBoundingBox() {
  //    //takes a transform matrix representation of an ellipsoid and returns two points defining the min x,y,z and max x,y,x
  //    double[] minAndMaxX = getMinAndMax(position.X, 0);
  //    double[] minAndMaxY = getMinAndMax(position.Y, 3);
  //    double[] minAndMaxZ = getMinAndMax(position.Z, 6);
  //
  //    boundingBoxMin = new Point3d(minAndMaxX[0], minAndMaxY[0], minAndMaxZ[0]);
  //    boundingBoxMax = new Point3d(minAndMaxX[1], minAndMaxY[1], minAndMaxZ[1]);
  //
  //
  //  }
  //
  //  //method used by the calculate bounding box method
  //  private double[] getMinAndMax(double position, int adder) {
  //    double m11 = transform[adder];
  //    double m12 = transform[adder + 1];
  //    double m13 = transform[adder + 2];
  //    double d = Math.Sqrt(m11 * m11 + m12 * m12 + m13 * m13);
  //    double[] minMax = { position - d, position + d };
  //    return minMax;
  //  }
  //
  //  //set updated unit vectors for
  //  public void calculateAxesAndScales() {
  //    unitXAxis = new Vector3d(transform[0], transform[3], transform[6]);
  //    scaleX = unitXAxis.Length;
  //    unitXAxis.Unitize();
  //    unitYAxis = new Vector3d(transform[1], transform[4], transform[7]);
  //    scaleY = unitYAxis.Length;
  //    unitYAxis.Unitize();
  //    unitZAxis = new Vector3d(transform[2], transform[5], transform[8]);
  //    scaleZ = unitZAxis.Length;
  //    unitZAxis.Unitize();
  //  }
  //
  //  //combines the postion and the transform to create an Affine transform
  //  public double[] createAffineTransform() {
  //    return new double[]{transform[0],transform[1],transform[2],position[0],transform[3],transform[4],transform[5],position[1],transform[6],transform[7],transform[8],position[2],0,0,0,1};
  //  }
  //
  //  //using similarity ratios: 1/transformedLength = distanceInside/inputlegth
  //  public double findDistanceInside(Vector3d inputVector) {
  //    Vector3d transformed = transformVector(inputVector);
  //    return inputVector.Length / transformed.Length;
  //  }
  //
  //  //method used by findDistanceInside method
  //  private Vector3d transformVector(Vector3d toTransform) {
  //    Vector3d transformedVector = new Vector3d();
  //    transformedVector[0] = inverse[0] * toTransform[0] + inverse[1] * toTransform[1] + inverse[2] * toTransform[2];
  //    transformedVector[1] = inverse[3] * toTransform[0] + inverse[4] * toTransform[1] + inverse[5] * toTransform[2];
  //    transformedVector[2] = inverse[6] * toTransform[0] + inverse[7] * toTransform[1] + inverse[8] * toTransform[2];
  //    return transformedVector;
  //  }
  //}
  //
  //public class AABB {
  //  public EndPoint[] min;//an array of size 3 with the x,y,z value for the AABB min
  //  public EndPoint[] max;//an array of size 3 with the x,y,z value for the AABB max
  //  public int branchRef;
  //
  //  //constructor
  //  public AABB(Point3d tMin, Point3d tMax, int tBranchRef) {
  //    min = new EndPoint[] {new EndPoint(tMin.X, true, this), new EndPoint(tMin.Y, true, this), new EndPoint(tMin.Z, true, this)};
  //    max = new EndPoint[] {new EndPoint(tMax.X, false, this), new EndPoint(tMax.Y, false, this), new EndPoint(tMax.Z, false, this)};
  //    branchRef = tBranchRef;
  //  }
  //}
  //
  //public class EndPoint {
  //  public AABB owner;
  //  public double num;//its actual value - corresponds to the x,y or z value
  //  public bool isMin;//is this a min point or a max point?
  //
  //  //constructor
  //  public EndPoint(double tNum, bool tIsMin, AABB tOwner) {
  //    num = tNum;
  //    isMin = tIsMin;
  //    owner = tOwner;
  //  }
  //
  //  //used as a comparison to sort the endpoints
  //  public static int compareEndPoints(EndPoint x, EndPoint y)
  //  {
  //    return x.num.CompareTo(y.num);
  //  }
  //}
  public class StressTensor
  {
    public double[] Values;

    public StressTensor()
    {
      Values = new Double[9]{0,0,0,0,0,0,0,0,0};
    }

    public StressTensor(List < double > Vals)
    {
      Values = Vals.ToArray();
    }
  }
  //
  //
  //
  //
  public StressTensor LinearInterpolate(StressTensor TensorA, StressTensor TensorB, double T)
  {
    var Interp = new StressTensor();
    int NaNorZeroCount = 0;
    for(int i = 0;i < 9;i++)
    {
      Interp.Values[i] = 0;
      if(!Double.IsNaN(TensorA.Values[i]) )
      {
        Interp.Values[i] += (1 - T) * TensorA.Values[i];
      }
      else{
        Interp.Values[i] += (1 - T) * TensorB.Values[i];
        NaNorZeroCount++;
      }
      if(!Double.IsNaN(TensorB.Values[i]))
      {
        Interp.Values[i] += T * TensorB.Values[i];
      }
      else{
        Interp.Values[i] += T * TensorA.Values[i];
        NaNorZeroCount++;
      }

      if(NaNorZeroCount == 2)
      {
        Interp.Values[i] = double.NaN;
      }
    }

    return Interp;

  }


  /// <summary>
  /// given stress tensors at the 8 corners of a cube, and coordinates of a point within that cube
  /// perform a trilinear interpolation
  /// </summary>
  /// <param name="CornerTensors">Tensor values at the corners, ordered 000,001,010,011,100,101,110,111</param>
  /// <param name="T">3 numbers in the range 0 to 1</param>
  /// <returns>the interpolated stress tensor at the given coordinates</returns>
  ///
  public StressTensor TriLinearInterpolate(StressTensor[] CornerTensors, double[] T)
  {
    //first get the 4 values along the edges in the x direction
    StressTensor SX0 = LinearInterpolate(CornerTensors[0], CornerTensors[4], T[0]);
    StressTensor SX1 = LinearInterpolate(CornerTensors[1], CornerTensors[5], T[0]);
    StressTensor SX2 = LinearInterpolate(CornerTensors[2], CornerTensors[6], T[0]);
    StressTensor SX3 = LinearInterpolate(CornerTensors[3], CornerTensors[7], T[0]);

    //interpolate along Y
    StressTensor SY0 = LinearInterpolate(SX0, SX2, T[1]);
    StressTensor SY1 = LinearInterpolate(SX1, SX3, T[1]);

    //and finally along Z
    var ST = LinearInterpolate(SY0, SY1, T[2]);
    bool HasNaN = false;
    for(int i = 0;i < 9;i++)
    {
      if(Double.IsNaN(ST.Values[i])){HasNaN = true;}
    }
    if(!HasNaN)
    {
      return LinearInterpolate(SY0, SY1, T[2]);
    }
    else
    {
      var Mx = double.MaxValue;
      //var Mx = ev1max;

      return new StressTensor(new List<double>{Mx,0,0,0,Mx,0,0,0,Mx});
    }

  }

  public class DescendingAbsoluteVals : Comparer <double>{
    public override int Compare(double x, double y)
    {
      return (y * y).CompareTo(x * x);
    }
  }

  public static void EigenSolve(double[] x, out double[] EigenValues, out Vector3d[] EigenVectors)
  {
    double[,] matValues = new double[3, 3]{{x[0],x[1],x[2]},{x[3],x[4],x[5]},{x[6],x[7],x[8]}};
    double[,] OutMatValues = new double[3, 3];
    double[] OutVecValues = new double[3];
    Eigen eigenCalculate = new Eigen();

    eigenCalculate.eigen_decomposition(matValues, OutMatValues, OutVecValues);

    var EigenVectorsUnsorted = new Vector3d[3];

    if (eigenCalculate.calcDone)
    {
      EigenVectorsUnsorted[0] = new Vector3d(OutMatValues[0, 0], OutMatValues[1, 0], OutMatValues[2, 0]);
      EigenVectorsUnsorted[1] = new Vector3d(OutMatValues[0, 1], OutMatValues[1, 1], OutMatValues[2, 1]);
      EigenVectorsUnsorted[2] = new Vector3d(OutMatValues[0, 2], OutMatValues[1, 2], OutMatValues[2, 2]);
    }

    Array.Sort(OutVecValues, EigenVectorsUnsorted, new DescendingAbsoluteVals());
    EigenValues = OutVecValues;
    EigenVectors = EigenVectorsUnsorted;
  }


  public class Eigen
  {
    public bool startCalc = false;
    public bool calcDone = false;

    ///////////////////////////////
    //Eigen solver implementation
    ///////////////////////////////
    private static double hypot2(double x, double y)
    {
      return Math.Sqrt(x * x + y * y);
    }

    private static void tred2(double[,] V, double[] d, double[] e)
    {
      for (int j = 0; j < 3; j++)
      {
        d[j] = V[3 - 1, j];
      }

      for (int i = 3 - 1; i > 0; i--)
      {
        double scale = 0.0;
        double h = 0.0;

        for (int k = 0; k < i; k++)
        {
          scale = scale + Math.Abs(d[k]);
        }

        if (scale == 0.0)
        {
          e[i] = d[i - 1];
          for (int j = 0; j < i; j++)
          {
            d[j] = V[i - 1, j];
            V[i, j] = 0.0;
            V[j, i] = 0.0;
          }
        }
        else
        {
          for (int k = 0; k < i; k++)
          {
            d[k] /= scale;
            h += d[k] * d[k];
          }

          double f = d[i - 1];
          double g = Math.Sqrt(h);

          if (f > 0)
          {
            g = -g;
          }

          e[i] = scale * g;
          h = h - f * g;
          d[i - 1] = f - g;

          for (int j = 0; j < i; j++)
          {
            e[j] = 0.0;
          }

          for (int j = 0; j < i; j++)
          {
            f = d[j];
            V[j, i] = f;
            g = e[j] + V[j, j] * f;

            for (int k = j + 1; k <= i - 1; k++)
            {
              g += V[k, j] * d[k];
              e[k] += V[k, j] * f;
            }

            e[j] = g;
          }

          f = 0.0;

          for (int j = 0; j < i; j++)
          {
            e[j] /= h;
            f += e[j] * d[j];
          }

          double hh = f / (h + h);

          for (int j = 0; j < i; j++)
          {
            e[j] -= hh * d[j];
          }

          for (int j = 0; j < i; j++)
          {
            f = d[j];
            g = e[j];

            for (int k = j; k <= i - 1; k++)
            {
              V[k, j] -= (f * e[k] + g * d[k]);
            }

            d[j] = V[i - 1, j];
            V[i, j] = 0.0;
          }
        }
        d[i] = h;
      }

      for (int i = 0; i < 3 - 1; i++)
      {
        V[3 - 1, i] = V[i, i];
        V[i, i] = 1.0;

        double h = d[i + 1];

        if (h != 0.0)
        {
          for (int k = 0; k <= i; k++)
          {
            d[k] = V[k, i + 1] / h;
          }
          for (int j = 0; j <= i; j++)
          {
            double g = 0.0;

            for (int k = 0; k <= i; k++)
            {
              g += V[k, i + 1] * V[k, j];
            }
            for (int k = 0; k <= i; k++)
            {
              V[k, j] -= g * d[k];
            }
          }
        }
        for (int k = 0; k <= i; k++)
        {
          V[k, i + 1] = 0.0;
        }
      }
      for (int j = 0; j < 3; j++)
      {
        d[j] = V[3 - 1, j];
        V[3 - 1, j] = 0.0;
      }

      V[3 - 1, 3 - 1] = 1.0;
      e[0] = 0.0;
    }

    static void tql2(double[,] V, double[] d, double[] e)
    {
      for (int i = 1; i < 3; i++)
      {
        e[i - 1] = e[i];
      }
      e[3 - 1] = 0.0;

      double f = 0.0;
      double tst1 = 0.0;
      double eps = Math.Pow(2.0, -52.0);
      for (int l = 0; l < 3; l++)
      {
        tst1 = Math.Max(tst1, Math.Abs(d[l]) + Math.Abs(e[l]));
        int m = l;

        while (m < 3)//not in original code, was m < 3!!!
        {
          if (Math.Abs(e[m]) <= eps * tst1)
          {
            break;
          }
          m++;
        }

        if (m > l)
        {
          int iter = 0;
          do
          {
            iter = iter + 1;

            double g = d[l];
            double p = (d[l + 1] - g) / (2.0 * e[l]);
            double r = hypot2(p, 1.0);

            if (p < 0)
            {
              r = -r;
            }

            d[l] = e[l] / (p + r);
            d[l + 1] = e[l] * (p + r);

            double dl1 = d[l + 1];
            double h = g - d[l];

            for (int i = l + 2; i < 3; i++)
            {
              d[i] -= h;
            }

            f = f + h;
            p = d[m];

            double c = 1.0;
            double c2 = c;
            double c3 = c;
            double el1 = e[l + 1];
            double s = 0.0;
            double s2 = 0.0;

            for (int i = m - 1; i >= l; i--)
            {
              c3 = c2;
              c2 = c;
              s2 = s;
              g = c * e[i];
              h = c * p;
              r = hypot2(p, e[i]);
              e[i + 1] = s * r;
              s = e[i] / r;
              c = p / r;
              p = c * d[i] - s * g;
              d[i + 1] = h + s * (c * g + s * d[i]);

              for (int k = 0; k < 3; k++)
              {
                h = V[k, i + 1];
                V[k, i + 1] = s * V[k, i] + c * h;
                V[k, i] = c * V[k, i] - s * h;
              }
            }

            p = -s * s2 * c3 * el1 * e[l] / dl1;
            e[l] = s * p;
            d[l] = c * p;
          } while (Math.Abs(e[l]) > eps * tst1);
        }

        d[l] = d[l] + f;
        e[l] = 0.0;
      }

      for (int i = 0; i < 3 - 1; i++)
      {
        int k = i;
        double p = d[i];

        for (int j = i + 1; j < 3; j++)
        {
          if (d[j] < p)
          {
            k = j;
            p = d[j];
          }
        }
        if (k != i)
        {
          d[k] = d[i];
          d[i] = p;

          for (int j = 0; j < 3; j++)
          {
            p = V[j, i];
            V[j, i] = V[j, k];
            V[j, k] = p;
          }
        }
      }
    }

    public void eigen_decomposition(double[,] A, double[,] V, double[] d)
    {
      double[] e = new double[3];
      for (int i = 0; i < 3; i++)
      {
        for (int j = 0; j < 3; j++)
        {
          V[i, j] = A[i, j];
        }
      }
      tred2(V, d, e);
      tql2(V, d, e);

      calcDone = true;
    }

  }

  //public static Color ColorAt(Mesh mesh, int faceIndex, double t0, double t1, double t2, double t3)
  //{
  //  // int rc = -1;
  //  var color = Rhino.Display.Color4f.Black;
  //
  //  if( mesh.VertexColors.Count != 0)
  //  {
  //    // test to see if face exists
  //    if( faceIndex >= 0 && faceIndex < mesh.Faces.Count )
  //    {
  //      /// Barycentric quad coordinates for the point on the mesh
  //      /// face mesh.Faces[FaceIndex].
  //
  //      /// If the face is a triangle
  //      /// disregard T[3] (it should be set to 0.0).
  //
  //      /// If the face is
  //      /// a quad and is split between vertexes 0 and 2, then T[3]
  //      /// will be 0.0 when point is on the triangle defined by vi[0],
  //      /// vi[1], vi[2]
  //
  //      /// T[1] will be 0.0 when point is on the
  //      /// triangle defined by vi[0], vi[2], vi[3].
  //
  //      /// If the face is a
  //      /// quad and is split between vertexes 1 and 3, then T[2] will
  //      /// be -1 when point is on the triangle defined by vi[0],
  //      /// vi[1], vi[3]
  //
  //      /// and m_t[0] will be -1 when point is on the
  //      /// triangle defined by vi[1], vi[2], vi[3].
  //
  //      MeshFace face = mesh.Faces[faceIndex];
  //
  //      // Collect data for barycentric evaluation.
  //      Color p0, p1, p2;
  //
  //      if(face.IsTriangle)
  //      {
  //        p0 = mesh.VertexColors[face.A];
  //        p1 = mesh.VertexColors[face.B];
  //        p2 = mesh.VertexColors[face.C];
  //      }
  //      else
  //      {
  //        if( t3 == 0 )
  //        { // point is on subtriangle {0,1,2}
  //          p0 = mesh.VertexColors[face.A];
  //          p1 = mesh.VertexColors[face.B];
  //          p2 = mesh.VertexColors[face.C];
  //        }
  //        else if( t1 == 0 )
  //        { // point is on subtriangle {0,2,3}
  //          p0 = mesh.VertexColors[face.A];
  //          p1 = mesh.VertexColors[face.C];
  //          p2 = mesh.VertexColors[face.D];
  //          //t0 = t0;
  //          t1 = t2;
  //          t2 = t3;
  //        }
  //        else if( t2 == -1 )
  //        { // point is on subtriangle {0,1,3}
  //          p0 = mesh.VertexColors[face.A];
  //          p1 = mesh.VertexColors[face.B];
  //          p2 = mesh.VertexColors[face.D];
  //          //t0 = t0;
  //          //t1 = t1;
  //          t2 = t3;
  //        }
  //        else
  //        { // point must be on remaining subtriangle {1,2,3}
  //          p0 = mesh.VertexColors[face.B];
  //          p1 = mesh.VertexColors[face.C];
  //          p2 = mesh.VertexColors[face.D];
  //          t0 = t1;
  //          t1 = t2;
  //          t2 = t3;
  //        }
  //      }
  //
  ///**
  //        double r = t0 * p0.FractionRed() + t1 * p1.FractionRed() + t2 * p2.FractionRed();
  //        double g = t0 * p0.FractionGreen() + t1 * p1.FractionGreen() + t2 * p2.FractionGreen();
  //       double b = t0 * p0.FractionBlue() + t1 * p1.FractionBlue() + t2 * p2.FractionBlue();
  //
  //        ON_Color color;
  //        color.SetFractionalRGB(r, g, b);
  //
  //        unsigned int abgr = (unsigned int)color;
  //        rc = (int) ABGR_to_ARGB(abgr);
  //
  //    var c0 = new Rhino.Display.Color4f(p0);
  //    var c1 = new Rhino.Display.Color4f(p1);
  //    var c2 = new Rhino.Display.Color4f(p2);
  //    float s0 = (float) t0;
  //    float s1 = (float) t1;
  //    float s2 = (float) t2;
  //
  //    float R = s0 * c0.R + s1 * c1.R + s2 * c2.R;
  //    float G = s0 * c0.G + s1 * c1.G + s2 * c2.G;
  //    float B = s0 * c0.B + s1 * c1.B + s2 * c2.B;
  //    color = new Rhino.Display.Color4f(R, G, B, 1);
  //  }
  //}
  //  return color.AsSystemColor();
  //}
  //
  //public static Color ColorAt(Mesh mesh, MeshPoint meshPoint)
  //{
  //  return ColorAt(mesh, meshPoint.FaceIndex, meshPoint.T[0], meshPoint.T[1], meshPoint.T[2], meshPoint.T[3]);
  //}
  //
  //public class Align : GoalObject
  //{
  //  public double Strength;
  //  public List<Vector3d> Vec;
  //
  //  public Align(int ea, int eb, Vector3d[] _Vec, double k)
  //  {
  //    PIndex = new int[2]{ea,eb};
  //    Move = new Vector3d[2];
  //    Weighting = new double[2]{k,k};
  //    Vec = _Vec.ToList();
  //    Strength = k;
  //  }
  //
  //  public override void Calculate(List<KangarooSolver.Particle> p)
  //  {
  //    Point3d p0 = p[PIndex[0]].Position;
  //    Point3d p1 = p[PIndex[1]].Position;
  //    var EdgeVec = new Vector3d();
  //    EdgeVec = p1 - p0;
  //
  //    double AngleX = Vector3d.VectorAngle(Vec[0], EdgeVec);
  //    double AngleY = Vector3d.VectorAngle(Vec[1], EdgeVec);
  //    double AngleZ = Vector3d.VectorAngle(Vec[2], EdgeVec);
  //    double AngleNX = Vector3d.VectorAngle(-Vec[0], EdgeVec);
  //    double AngleNY = Vector3d.VectorAngle(-Vec[1], EdgeVec);
  //    double AngleNZ = Vector3d.VectorAngle(-Vec[2], EdgeVec);
  //
  //    double lowest = AngleX;
  //    Vector3d TargetDir = Vec[0];
  //
  //    if (AngleY < lowest)
  //    {
  //      TargetDir = Vec[1];
  //      lowest = AngleY;
  //    }
  //
  //    if (AngleZ < lowest)
  //    {
  //      TargetDir = Vec[2];
  //      lowest = AngleZ;
  //    }
  //
  //    if (AngleNX < lowest)
  //    {
  //      TargetDir = -Vec[0];
  //      lowest = AngleNX;
  //    }
  //    if (AngleNY < lowest)
  //    {
  //      TargetDir = -Vec[1];
  //      lowest = AngleNY;
  //    }
  //    if (AngleNZ < lowest)
  //    {
  //      TargetDir = -Vec[2];
  //    }
  //
  //    Vector3d V = EdgeVec;
  //    Vector3d Dir = TargetDir;
  //
  //    Vector3d To = (V - (V * Dir) * Dir) * 0.5;
  //
  //    Move[0] = To;
  //    Move[1] = -To;
  //
  //    if(!Dir.IsZero && lowest < Math.PI / 9)
  //    {
  //      Weighting[0] = Strength;
  //      Weighting[1] = Strength;
  //    }
  //    else
  //    {
  //      Weighting[0] = 0;
  //      Weighting[1] = 0;
  //    }
  //  }
  //}
  //
  //
  //public class NonLinearRepel : GoalObject
  //{
  //  public int Exponent;
  //  public double Length;
  //  public double Multiplier;
  //  public double Stiffness;
  //
  //  public NonLinearRepel(int Pt0, int Pt1, double Len, double Mult, double k, int q)
  //  {
  //
  //    PIndex = new int[2]{Pt0,Pt1};
  //    Move = new Vector3d[2];
  //    Weighting = new double[2]{k,k};
  //    Exponent = q;
  //    Length = Len;
  //    Multiplier = Mult;
  //    Stiffness = k;
  //  }
  //
  //  public override void Calculate(List<KangarooSolver.Particle> p)
  //  {
  //    Vector3d Current = p[PIndex[1]].Position - p[PIndex[0]].Position;
  //
  //    double CurrentLength = Current.Length;
  //    double Overlap = Length - CurrentLength;
  //    Current.Unitize();
  //
  //    if(Overlap > 0)
  //    {
  //      Move[0] = -0.5 * Current * Overlap;
  //      Move[1] = 0.5 * Current * Overlap;
  //
  //      Weighting[0] = Weighting[1] =
  //        //  Stiffness * (Math.Pow(CurrentLength * Multiplier, Exponent) - Math.Pow(Length * Multiplier, Exponent));
  //        Stiffness * Math.Pow((Length - Overlap) * Multiplier, Exponent);
  //    }
  //    else
  //    {
  //      Weighting[0] = Weighting[1] = 0;
  //    }
  //
  //  }
  //
  //  public override object Output(List<KangarooSolver.Particle> p)
  //  {
  //    Line L = new Line(p[PIndex[0]].Position, p[PIndex[1]].Position);
  //    return L;
  //  }
  //}
  //  */
  //
# ---------- end filter_by_angle ----------
scale = Scale(Geometry=simple_filter_by_valence.EV2, Center=Point(0, 0, 0), Factor=number_slider_4)  # -> Geometry, Transform; disabled
scale_2 = Scale(Geometry=simple_filter_by_valence.EV3, Center=Point(0, 0, 0), Factor=number_slider_4)  # -> Geometry, Transform; disabled
scale_3 = Scale(Geometry=simple_filter_by_valence.EV1, Center=Point(0, 0, 0), Factor=number_slider_4)  # -> Geometry, Transform; disabled
crv_2 = Curve(simple_filter_by_valence.F0)  # disabled
crv_3 = Curve(simple_filter_by_valence.F3)  # disabled
crv_4 = Curve(simple_filter_by_valence.F2)  # disabled
crv_5 = Curve(simple_filter_by_valence.F4)  # disabled
crv_6 = Curve(simple_filter_by_valence.F5)  # disabled
crv_7 = Curve(simple_filter_by_valence.F1)  # disabled
vdis = VectorDisplay(Vector=scale_3.Geometry)  # disabled
vdis_2 = VectorDisplay(Vector=scale.Geometry)  # disabled
vdis_3 = VectorDisplay(Vector=scale_2.Geometry)  # disabled
crv_8 = Curve([crv_6, crv_5, crv_3, crv_4, crv_2, crv_7])  # disabled
countconnections_2 = CSharpScript()  # -> out, A; inputs LinesForEachPoint: tree of Line; disabled; same code as countconnections
bar_graph_2 = BarGraph(countconnections_2.A, BarColor=RGB(255, 0, 90))  # disabled
bar_graph_3 = BarGraph(countconnections_2.A, BarColor=RGB(255, 0, 90))  # disabled

# ----
# Display lines
pipe = Pipe(Radius=0.003, Caps=0)  # disabled

# ==== cluster Colourful: Display objects in bright colours
geo = ClusterInput()
geo_2 = Geometry(geo)
clean = CleanTree(RemoveNulls=True, RemoveInvalid=True, RemoveEmpty=False, Tree=flatten(geo_2))
lng = ListLength(List=clean)
S = Shader([{ambient=RGB(128, 128, 128), diffuse=RGB(11, 125, 222), emission=RGB(3, 38, 67), shine=0.5, specular=RGB(255, 255, 255), transparency=0}, {ambient=RGB(128, 128, 128), diffuse=RGB(222, 37, 11), emission=RGB(67, 11, 3), shine=0.5, specular=RGB(255, 255, 255), transparency=0}, {ambient=RGB(128, 128, 128), diffuse=RGB(71, 222, 11), emission=RGB(21, 67, 3), shine=0.5, specular=RGB(255, 255, 255), transparency=0}, {ambient=RGB(128, 128, 128), diffuse=RGB(222, 194, 11), emission=RGB(67, 58, 3), shine=0.5, specular=RGB(255, 255, 255), transparency=0}])
repeat = RepeatData(Data=S, Length=lng)
preview = CustomPreview(Geometry=clean, Shader=repeat)

# ==== cluster LightGrey
geo = ClusterInput()
geo_2 = Geometry(geo)
clean = CleanTree(RemoveNulls=True, RemoveInvalid=True, RemoveEmpty=False, Tree=flatten(geo_2))
S = Shader({ambient=RGB(128, 128, 128), diffuse=RGB(224, 224, 224), emission=RGB(0, 0, 0), shine=0.5, specular=RGB(255, 255, 255), transparency=0})
preview = CustomPreview(Geometry=clean, Shader=S)

# ==== cluster Shift15AlongX
C = ClusterInput()
bbox = BoundingBox(Content=C, Plane=PlaneXY(0, 0, 0))  # -> Box, Box_2
boxprop = BoxProperties(Box=bbox.Box)  # -> Center, Diagonal, Area, Volume, Degeneracy
pdecon = Deconstruct(Point=boxprop.Diagonal)  # -> XComponent, YComponent, ZComponent
num = Number(1.5)
multiplication = Multiplication(A=pdecon.XComponent, B=num)
G = ClusterInput()
vec = VectorXYZ(XComponent=multiplication, YComponent=0, ZComponent=0)  # -> Vector, Length
move = Move(Geometry=G, Motion=vec.Vector)  # -> Geometry, Transform
G_2 = ClusterOutput(move.Geometry)

# ==== cluster VisualiseEllipsoids
pts = ClusterInput()
longaxes = ClusterInput()
shortaxes = ClusterInput()
ellipsoid_transforms = CSharpScript(Pts=pts, longAxes=longaxes, shortAxes=shortaxes)  # -> out, A; inputs Pts: list of Point3d, longAxes: list of Vector3d, shortAxes: list of Vector3d
# ---------- ellipsoid_transforms: C# ----------
    int count = Pts.Count();

    List<Transform> transforms = new List<Transform>();

    for(int i = 0; i < count; i++){
      Transform t = new Transform(1.0);

      t.M03 = Pts[i].X;
      t.M13 = Pts[i].Y;
      t.M23 = Pts[i].Z;

      t.M00 = longAxes[i][0];
      t.M10 = longAxes[i][1];
      t.M20 = longAxes[i][2];

      t.M01 = shortAxes[i][0];
      t.M11 = shortAxes[i][1];
      t.M21 = shortAxes[i][2];

      double la = longAxes[i].Length;
      double sa = shortAxes[i].Length;
      Vector3d xprod = Vector3d.CrossProduct(longAxes[i], shortAxes[i]);
      xprod.Unitize();

      t.M02 = sa * xprod[0];
      t.M12 = sa * xprod[1];
      t.M22 = sa * xprod[2];

      transforms.Add(t);
    }
    A = transforms;
# ---------- end ellipsoid_transforms ----------
msphere = MeshSphere(Base=PlaneXY(0, 0, 0), Radius=1, UCount=6, VCount=9)
transform = Transform(Geometry=msphere, Transform=ellipsoid_transforms.A)
G = ClusterOutput(transform)
